# Grasshopper definition LilyPad.gh (Grasshopper 1.0.8)
# plug-ins: treesloth01, Pufferfish, Human, GSA, LilyPad

srf = Surface(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)
edges = BrepEdges(Brep=srf)  # -> Naked, Interior, NonManifold
qrmesh = QuadRemesh(Geometry=srf, Settings={aqc=True, as=50, dhe=True, gci=0, null=False, pme=2, sa=0, tqc=2000})
item = ListItem(List=edges.Naked, Index=3, Wrap=True)
demesh = DeconstructMesh(Mesh=qrmesh)  # -> Vertices, Faces, Colours, Normals
pull = PullPoint(Point=demesh.Vertices, Geometry=item, ClosestOnly=True)  # -> ClosestPoint, Distance, Index
smaller = SmallerThan(FirstNumber=pull.Distance, SecondNumber=0.01)  # -> SmallerThan, OrEqualTo
cull = CullPattern(List=demesh.Vertices, CullPattern=smaller.SmallerThan)
mat = CreateMaterial(Material_type="Steel", Design_Code="EN 1993-1-1:2005", Grade="S355")
duppt = RemoveDuplicatePts(Points=flatten(cull), Tolerance=0.01)
loadcase = CreateLoadCase(CaseID="1", Name="DL", Type="Dead")
prop2d = Create2DProperty(Thickness_cm="2", Material=mat, Type="Shell", Unit="cm")
support = CreateSupport(Point=duppt, Plane=PlaneXY(0, 0, 0), x=True, xx=False, y=True, yy=False, z=True, zz=False)
σa = CreateAnalysisCase(Name="L1", Description="L1")
elem2d = Create2DElement(Geometry=qrmesh, Property2D=prop2d, Preview3dSection=False)
σt = CreateAnalysisTask(AnalysisCases=σa, casesParamIndex=2, Solver="Static")
faceload = CreateFaceLoad(
    LoadCase=loadcase,
    Loadable2DObjects=elem2d,
    Axis=0,
    Direction="z",
    Projected=False,
    Value_kN_m²="-1",
    Type="Uniform",
    Unit="kN/m²")
model = CreateModel(
    GSAGeometryIn_m=flatten([support, elem2d]),
    Load=faceload,
    AnalysisTasksCombinations=σt,
    ReMesh=True,
    Tolerance=0.01,
    Unit="m")
panel = Panel("C:\Users\Matt C\Documents\GitHub\PrincipalStressLines\Testing Files\LilyPad_Rev00.gwb")
save = Button()
save_2 = SaveGSAModel(GSAModel=model, Save=save, FileAndPath=panel)
# C:\Users\4Matt\Documents\GitHub\PrincipalStressLines\Example Files\GSA Model_Slab_8Node.gwb
panel_2 = Panel("C:\Users\4Matt\Documents\GitHub\PrincipalStressLines\Example Files\Model.gwb")
panel_3 = Panel("C:\Users\Matt C\Documents\GitHub\PrincipalStressLines\Testing Files\LilyPad_Rev00.gwb")
open = OpenModel(FilenameAndPath=panel_3)
getanalysis = GetModelAnalysis(GSAModel=open)  # -> AnalysisTasks, AnalysisCases, CombinationCases, DesignTasks
panel_4 = Panel(getanalysis.AnalysisCases)
getgeo = GetModelGeometry(GSAModel=open, Mode=1, Unit="m")  # -> NodesIn_m, _1DElementsIn_m, _2DElementsIn_m, _3DElementsIn_m, _1DMembersIn_m, _2DMembersIn_m, _3DMembersIn_m, Assemblies
getres = GetResult(GSAModel=open, T="A", Case=1)
nodedisp = NodeDisplacements(Result=getres, Max_Min="All", Unit="mm")  # -> TranslationsX_mm, TranslationsY_mm, TranslationsZ_mm, TranslationsXYZ_mm, RotationXX_rad, RotationYY_rad, RotationZZ_rad, RotationXYZ_rad, NodeIDs
nodeedit = EditNode(Node=getgeo.NodesIn_m, Mode=1)  # -> Node, NodeNumber, NodePosition, NodeLocalAxis, NodeRestraints, DamperProperty, MassProperty, SpringProperty, NodeName, NodeColour
elem2dedit = Edit2DElement(Element2D=getgeo._2DElementsIn_m, Preview3dSection=False)  # -> Element2D, Number, Geometry, _2DProperty, Group, ElementType, Offset, OrientationAngle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
num = Number(nodedisp.RotationXX_rad)
num_2 = Number(nodedisp.RotationYY_rad)
num_3 = Number(nodedisp.RotationZZ_rad)
subtraction = Subtraction(A=elem2dedit.Topology, B=1)
vec = VectorXYZ(XComponent=num, YComponent=num_2, ZComponent=num_3)  # -> Vector, Length
int = Integer(nodeedit.NodeNumber)
int_2 = Integer(elem2dedit.Topology)
int_3 = Integer(subtraction)
mindex = MemberIndex(Set=int, Member=int_2)  # -> Index, Count
shift = ShiftPaths(Data=mindex.Index, Offset=-1)
panel_5 = Panel("""0
4
1
7
5
3
6
2""")
panel_6 = Panel("""2
6
3
5
7
1
4
0""")
panel_7 = Panel("""3
7
0
6
4
2
5
1""")

# ----
# FEA Data Import
displacement_vectors = Vector(vec.Vector)
element_node_ids = Number(simplify(shift))
node_locations = Point(nodeedit.NodePosition)

panel_9 = Panel("""1
4
0
5
7
2
6
3""")
item_2 = ListItem(List=element_node_ids, Index=panel_9, Wrap=True)
tstat = TreeStatistics(Tree=item_2)  # -> Paths, Length, Count
item_3 = ListItem(List=tstat.Paths, Index=0, Wrap=True)

# ----
# Setup
item_4 = ListItem(List=node_locations, Index=item_2, Wrap=True)
item_5 = ListItem(List=displacement_vectors, Index=item_2, Wrap=True)
item_6 = ListItem(List=item_4, Index=0, Wrap=True)  # -> Item, Item1, Item2, Item3, Item4, Item5, Item6, Item7
item_7 = ListItem(List=item_5, Index=0, Wrap=True)  # -> Item, Item1, Item2, Item3, Item4, Item5, Item6, Item7
item_8 = ListItem(List=item_2, Index=0, Wrap=True)  # -> Item, Item1, Item2, Item3, Item4, Item5, Item6, Item7
merge = Merge(Data1=item_6.Item1, Data2=item_6.Item3, Data3=item_6.Item4, Data4=item_6.Item6)  # -> flatten(Result)
merge_2 = Merge(Data1=item_7.Item1, Data2=item_7.Item3, Data3=item_7.Item4, Data4=item_7.Item6)  # -> flatten(Result)
quad = MeshQuad(CornerA=item_8.Item, CornerB=item_8.Item2, CornerC=item_8.Item7, CornerD=item_8.Item5)
conmesh = ConstructMesh(Vertices=node_locations, Faces=flatten(quad))
cullpt = CullDuplicates(Points=merge, Tolerance=0.001, CullMode=1)  # -> Points, Indices, Valence
item_9 = ListItem(List=merge_2, Index=cullpt.Indices, Wrap=True)
_8isoparaslab = _8NodeIsoparametricSlab(
    Mesh=conmesh,
    MidNodes=cullpt.Points,
    RotationsCorners=displacement_vectors,
    RotationsMidNodes=item_9,
    PoissonsRatio="0.15")  # -> PrincipleDirection1, PrincipleDirection2

split = SplitTree(Data=item_2, Masks=flatten(item_3))  # -> Positive, Negative
panel_10 = Panel(shift)
item_10 = ListItem(List=node_locations, Index=split.Positive, Wrap=True)
points = PointList(Points=item_10)
md_slider = MDSlider(
    SliderMode=0,
    slider_value=Point(0.1740060202, 0.1629677749, 0.5),
    x_domain=Domain(0, 8),
    y_domain=Domain(0, 8),
    z_domain=Domain(0, 1))
number_slider = Slider(0.02, range=0..1)
_10º = PowerOf10(Value=Slider(-4, range=-10..0))
dam = DataDam(DataA=md_slider, BufferDelay=10000000, BufferMode=0)

# ----
# Evaluation
eval = EvaluatePrincipalMesh(Principal=_8isoparaslab.PrincipleDirection2, Location=md_slider)
# Results
eval_2 = EvaluatePrincipalMesh(Principal=_8isoparaslab.PrincipleDirection1, Location=md_slider)
vdis = VectorDisplay(Anchor=md_slider, Vector=eval_2)
vdis_2 = VectorDisplay(Anchor=md_slider, Vector=eval)

number_slider_2 = Slider(5, range=1..5)
sls = StressLines(
    PrincipalMesh=_8isoparaslab.PrincipleDirection2,
    Seed=dam,
    StepTolerance=number_slider,
    MaxError=_10º,
    Seperation="0.25",
    TestDist="0.1")

# ----
# Stress Line
stress_line = StressLine(PrincipalMesh=_8isoparaslab.PrincipleDirection2, Seed=md_slider, StepTolerance=number_slider, MaxError=_10º)
preview = CustomPreview(
    Geometry=stress_line,
    Material={diffuse=RGB(13, 201, 0), emission=RGB(4, 60, 0), shine=0.5, specular=RGB(255, 255, 255), transparency=0})

sls_2 = StressLines(
    PrincipalMesh=_8isoparaslab.PrincipleDirection1,
    Seed=dam,
    StepTolerance=number_slider,
    MaxError=_10º,
    Seperation="0.25",
    TestDist="0.1")

# ----
# Stress Line
stress_line_2 = StressLine(PrincipalMesh=_8isoparaslab.PrincipleDirection1, Seed=md_slider, StepTolerance=number_slider, MaxError=_10º)
preview_2 = CustomPreview(
    Geometry=stress_line_2,
    Material={diffuse=RGB(13, 201, 0), emission=RGB(4, 60, 0), shine=0.5, specular=RGB(255, 255, 255), transparency=0})

# ----
# Stress Lines
swatch = ColourSwatch(SwatchColor=RGB(82, 184, 59))
previewlw = CustomPreviewLineweights(Geometry=sls_2, Shader=swatch, Thickness=number_slider_2, Absolute=False)

# ----
# Stress Lines
previewlw_2 = CustomPreviewLineweights(Geometry=sls, Shader=ColourSwatch(SwatchColor=RGB(224, 255, 71)), Thickness=number_slider_2, Absolute=False)

crv = Curve([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])
crv_2 = Curve([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])
mesh = Mesh(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)
crv_3 = Curve([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])
crv_4 = Curve([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])
mesh_2 = Mesh(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)
crv_5 = Curve([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])
crv_6 = Curve([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])
mesh_3 = Mesh(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)
crv_7 = Curve([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])
crv_8 = Curve([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])
mesh_4 = Mesh(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)
crv_9 = Curve([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])
crv_10 = Curve([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])
mesh_5 = Mesh(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)
crv_11 = Curve([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])
crv_12 = Curve([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])
mesh_6 = Mesh(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)
explode = Explode(Curve=crv_4, Recursive=True)  # -> Segments, Vertices
material = CreateMaterial(
    Diffuse=ColourSwatch(SwatchColor=RGB(201, 81, 107)),
    Specular=RGB(255, 255, 255),
    Emission=ColourSwatch(SwatchColor=RGB(56, 56, 56)),
    Transparency=0,
    Shine=0)
mshnakededgs = MeshNakedEdges(Mesh=mesh_2)  # -> Naked, R
explode_2 = Explode(Curve=crv_3, Recursive=True)  # -> Segments, Vertices
lng = ListLength(List=explode.Segments)
preview_3 = CustomPreview(Geometry=mesh_2, Material=material)
lng_2 = ListLength(List=explode_2.Segments)
join = JoinCurves(Curves=mshnakededgs.Naked, Preserve=False)
division = Division(A=lng, B=2)
division_2 = Division(A=lng_2, B=2)
round = Round(Number=division)  # -> Nearest, Floor, Ceiling
round_2 = Round(Number=division_2)  # -> Nearest, Floor, Ceiling
number_slider_3 = Slider(1, range=0..1)
partition = PartitionList(List=explode.Segments, Size=round.Nearest)  # -> simplify(Chunks)
partition_2 = PartitionList(List=explode_2.Segments, Size=round_2.Nearest)  # -> simplify(Chunks)
split_2 = SplitTree(Data=partition_2, Masks=flatten("{?;0}"))  # -> reverse(Positive), Negative
split_3 = SplitTree(Data=partition, Masks=flatten("{?;0}"))  # -> reverse(Positive), Negative
folder_with_images = Panel("C:\Users\Matt C\Pictures\Animations\LilyPad_3")
merge_3 = Merge(Data1=split_2.Positive, Data2=split_2.Negative)
merge_4 = Merge(Data1=split_3.Positive, Data2=split_3.Negative)
watermark = BooleanToggle(False)
boomerang = BooleanToggle(True)
name = Panel("social")
flip_last = FlipLast(Data=merge_3)
run = BooleanToggle(False)
mp4 = BooleanToggle(True)
gif = BooleanToggle(False)
frame_rate = Panel("20")
flip_last_2 = FlipLast(Data=merge_4)
pt = ConstructPoint(XCoordinate="30", YCoordinate="30", ZCoordinate=0)
shift_2 = ShiftPaths(Data=flip_last, Offset=-1)  # -> flatten(Data)
shift_3 = ShiftPaths(Data=flip_last_2, Offset=-1)  # -> flatten(Data)
animation_maker_rev02 = Python3Script(
    run=run,
    image_folder=folder_with_images,
    output_mp4=mp4,
    output_gif=gif,
    watermark=watermark,
    boomerang=boomerang,
    animation_name=name,
    frame_rate=frame_rate)  # -> out, run; inputs image_folder: String, watermark: Boolean, frame_rate: Double
# ---------- animation_maker_rev02: Python ----------
# venv: animationTools
#r: opencv-python, Pillow
import System
import Rhino
import Grasshopper
import re

import rhinoscriptsyntax as rs
import cv2
import os
from PIL import Image
import tkinter as tk
from tkinter import scrolledtext
from time import sleep

import tempfile
import shutil

import ghpythonlib as gh


        
def extract_number_end(filename):
    """
    Extracts the last integer in a filename before the extension.
    Handles leading zeros and multiple underscores.
    """
    match = re.search(r'(\d+)(?=\.[^.]+$)', filename)
    return int(match.group(1)) if match else float('inf')
        

if(run):
    # --- Configuration ---
    video_path = os.path.join(image_folder, animation_name+'.mp4')
    gif_path = os.path.join(image_folder, animation_name+'.gif')

    # --- Setup Tkinter window ---
    root = tk.Tk()
    root.title("Progress Window")

    text_area = scrolledtext.ScrolledText(root, width=60, height=20)
    text_area.pack(padx=10, pady=10)
    root.update()  # Render the window

    def log(msg):
        print(msg)
        text_area.insert(tk.END, msg + '\n')
        text_area.see(tk.END)  # Auto-scroll to the latest line
        root.update()          # Update GUI immediately

    if(watermark):
        #--- Add watermarks to images---
        log("adding watermark to images")
        input_folder = image_folder
            
        # --- Create a temporary folder ---
        watermarked_folder = tempfile.mkdtemp(prefix="watermarked_")
        log("Temporary output folder:" + watermarked_folder)
        watermark_path = "G:/Shared drives/Format General/Code scripts/Grasshopper/FormatSnippet/Animations and Images/watermark.png"

        os.makedirs(watermarked_folder, exist_ok=True)

        # Load watermark once
        watermark = Image.open(watermark_path).convert("RGBA")

        # Apply 50% transparency to existing alpha
        r, g, b, a = watermark.split()
        a = a.point(lambda p: int(p * 0.5))
        watermark = Image.merge("RGBA", (r, g, b, a))

        for filename in os.listdir(input_folder):
            if filename.lower().endswith((".jpg", ".jpeg", ".png")):
                img_path = os.path.join(input_folder, filename)
                img = Image.open(img_path).convert("RGBA")

                # Resize watermark if needed (optional)
                # Example: scale to 20% of image width
                scale = 0.5
                new_w = int(img.width * scale)
                wm_resized = watermark.resize((new_w, int(watermark.height * (new_w / watermark.width))), Image.LANCZOS)

                # Position watermark (bottom-right)
                x = img.width - wm_resized.width - 10
                y = img.height - wm_resized.height - 10

                # Create a transparent layer
                layer = Image.new("RGBA", img.size, (0,0,0,0))
                layer.paste(wm_resized, (x, y))

                # Composite image + watermark
                watermarked = Image.alpha_composite(img, layer)

                # Save back as PNG or JPG
                out_path = os.path.join(watermarked_folder, filename)
                watermarked.convert("RGB").save(out_path, "JPEG", quality=95)

                log("Saved:" + out_path)
        #change image folder to temp folder with water marked images
        image_folder = watermarked_folder



    # --- Get sorted image files ---
    valid_extensions = ('.jpg', '.jpeg', '.png')
    images = sorted([f for f in os.listdir(image_folder) if f.lower().endswith(valid_extensions)],
    key= extract_number_end)

    if not images:
        raise ValueError("No valid image files found in the folder.")

    # --- alter images list to create boomerang loop effect
    if(boomerang):
        images =  images + list(reversed(images))
    
    # --- Read first frame to get dimensions ---
    first_frame = cv2.imread(os.path.join(image_folder, images[0]))
    height, width, _ = first_frame.shape

    # --- Create MP4 video ---
    if output_mp4:
        fourcc = cv2.VideoWriter_fourcc(*'mp4v')
        video = cv2.VideoWriter(video_path, fourcc, frame_rate, (width, height))
        for i, image_file in enumerate(images):
            frame = cv2.imread(os.path.join(image_folder, image_file))
            video.write(frame)
            log(f"Added frame {i} to MP4.")
        video.release()
        log(f"MP4 video saved to {video_path}")

    # --- Create GIF ---
    if output_gif:
        frames = []
        for image_file in images:
            img_path = os.path.join(image_folder, image_file)
            img = Image.open(img_path).convert('RGB')
            frames.append(img)
            log(f"Added frame {image_file} to GIF.")
        log("Saving Gif... be patient")
        frames[0].save(
            gif_path,
            save_all=True,
            append_images=frames[1:],
            duration=int(1000 / frame_rate),
            loop=0
        )
        log(f"GIF animation saved to {gif_path}")

    # --- Finalize ---
    if(watermark):
        shutil.rmtree(watermarked_folder)
        log("deleting temp folder")
    log("Process complete.")
    log("Closing Window")
    text_area.configure(state='disabled')  # Make read-only

    # Schedule the window to close after 100 milliseconds (0.1 seconds)
    root.after(100, root.destroy)

    root.mainloop()
    cv2.destroyAllWindows()
# ---------- end animation_maker_rev02 ----------
texttoscreen = RenderTextToScreen(Text="Hemisphere Dome", Location=pt, Size=20, Color=RGB(0, 0, 0), Font="Inconsolata", m_scWithvp=False)
lng_3 = ListLength(List=shift_3)
lng_4 = ListLength(List=shift_2)
c_script = CSharpScript(toggle=run, trigger=animation_maker_rev02.run)  # inputs toggle: Boolean, trigger: Boolean
# ---------- c_script: C# ----------
// Grasshopper Script Instance
#region Usings
using System;
using System.Linq;
using System.Collections;
using System.Collections.Generic;
using System.Drawing;

using Rhino;
using Rhino.Geometry;

using Grasshopper;
using Grasshopper.Kernel;
using Grasshopper.Kernel.Data;
using Grasshopper.Kernel.Types;
using Grasshopper.Kernel.Special;
#endregion

public class Script_Instance : GH_ScriptInstance
{
    #region Notes
    /* 
      Members:
        RhinoDoc RhinoDocument
        GH_Document GrasshopperDocument
        IGH_Component Component
        int Iteration

      Methods (Virtual & overridable):
        Print(string text)
        Print(string format, params object[] args)
        Reflect(object obj)
        Reflect(object obj, string method_name)
    */
    #endregion

    private void RunScript(bool toggle, bool trigger)
    {
        // Write your logic here
        if(trigger)
        {
            var input0 = Component.Params.Input[0].Sources[0];
            ((GH_BooleanToggle) input0).Value = false;
            input0.ExpireSolution(true);
        }
    }
}
# ---------- end c_script ----------
multiplication = Multiplication(A=number_slider_3, B=lng_4)
multiplication_2 = Multiplication(A=number_slider_3, B=lng_3)
round_3 = Round(Number=multiplication)  # -> Nearest, Floor, Ceiling
round_4 = Round(Number=multiplication_2)  # -> Nearest, Floor, Ceiling
panel_11 = Panel(animation_maker_rev02.out)
series = Series(Start=0, Step=1, Count=round_3.Nearest)
series_2 = Series(Start=0, Step=1, Count=round_4.Nearest)
item_11 = ListItem(List=shift_3, Index=series_2, Wrap=True)
item_12 = ListItem(List=shift_2, Index=series, Wrap=True)
number_slider_4 = Slider(5, range=1..5)
previewlw_3 = CustomPreviewLineweights(Geometry=item_12, Shader=ColourSwatch(SwatchColor=RGB(82, 184, 59)), Thickness=number_slider_4, Absolute=False)
previewlw_4 = CustomPreviewLineweights(Geometry=item_11, Shader=ColourSwatch(SwatchColor=RGB(224, 255, 71)), Thickness=number_slider_4, Absolute=False)
previewlw_5 = CustomPreviewLineweights(Geometry=join, Shader=ColourSwatch(SwatchColor=RGB(89, 89, 89)), Thickness="8", Absolute=False)
