# Grasshopper definition 01LilyPad_Simple Intro_Standard.gh (Grasshopper 1.0.8)
# plug-ins: LilyPad

# ----
# Structure: 4 Node Quads or  3 Node Triangles
# Analysis Input: None
# Field Generation Method: Displacement Field Method - Standard Order
# Choose refinement
panel = Panel("2")

# ----
# Step 1: Create Input Mesh
rectangle = Rectangle(Plane=PlaneXY(0, 0, 0), XSize=Domain(0, 1), YSize=Domain(-0.5, 0.5), Radius=0)  # -> Rectangle, Length
mplane = MeshPlane(Boundary=rectangle.Rectangle, WidthCount=panel, HeightCount=panel)  # -> Mesh, Area
tri = Triangulate(Mesh=mplane.Mesh)  # -> Mesh, Count

# ----
# Select Mesh Type to see the difference
list = ValueList({"Triangular": 0, "Quad": 1}, selected="Quad")
filter = StreamFilter(Gate=list, Stream0=tri.Mesh, Stream1=mplane.Mesh)

medges = MeshEdges(Mesh=filter)  # -> NakedEdges, InteriorEdges, NonManifoldEdges

# ---- group: Step 2:Create Nodal Translation For Mesh Node
# Step 2: Create Deformation Results
# here we are making up some results but these should be generated by a finite element program
demesh = DeconstructMesh(Mesh=filter)  # -> Vertices, Faces, Colours, Normals
md_slider = MDSlider(
    SliderMode=0,
    slider_value=Point(0, 0.4981928446, 0.5),
    x_domain=Domain(0, 1),
    y_domain=Domain(-0.5, 0.5),
    z_domain=Domain(0, 1))
dist = Distance(PointA=demesh.Vertices, PointB=md_slider)
dots = DotDisplay(Point=md_slider, Colour=RGB(0, 0, 0), Size=0.01)
bnd = Bounds(Numbers=dist)
remap = RemapNumbers(Value=dist, Source=bnd, Target="0.1 to 0")  # -> Mapped, Clipped
graph = GraphMapper(remap.Mapped, x0=0, x1=1, y0=0, y1=1, Ox=0, Oy=0, Px=1, Py=1, container_name="Parabola")
neg = Negative(Value=graph)
Y = UnitY(Factor=neg)
vdis = VectorDisplay(Anchor=demesh.Vertices, Vector=expr("x", Y))

# ----
# Step 3: Create Principle Mesh
# Displacement Field Method (Standard Order)
list_2 = ValueList({"Bending Stress Lines": True, "In-Plane Stress Lines": False}, selected="In-Plane Stress Lines")
poisson_s_ratio = Panel("0.3")
defmesh = CreateDeformationMesh(Mesh=filter, Translations=Y, Rotations=Vector(0, 0, 0), PoissonsRatio=poisson_s_ratio, BendingStressLines=list_2)  # -> PrincipalDirection1, PrincipalDirection2

# ---- group: Step 4: Selecting Seed Point
# Step 4: Create a Seed Point
# This can be any point on the mesh
medges_2 = MeshEdges(Mesh=filter)  # -> NakedEdges, InteriorEdges, NonManifoldEdges
md_slider_2 = MDSlider(SliderMode=0, slider_value=Point(0.5, 0.5, 0.5), x_domain=Domain(0, 1), y_domain=Domain(0, 1), z_domain=Domain(0, 1))
join = JoinCurves(Curves=medges_2.NakedEdges, Preserve=False)
boundary = BoundarySurfaces(Edges=join)
srf = Surface(boundary)
evalsrf = EvaluateSurface(Surface=reparameterize(srf), Point=md_slider_2)  # -> Point, Normal, UDirection, VDirection, Frame
meshcp = MeshClosestPoint(Point=evalsrf.Point, Mesh=filter)  # -> Point, Index, Parameter
dots_2 = DotDisplay(Point=meshcp.Point, Colour=RGB(0, 0, 0), Size=0.01)

# ----
# Step 5.2: Produce Stress lines through a seeding
number_slider = Slider(-5, range=-10..0)
number_slider_2 = Slider(0.004, range=0..1)
number_slider_3 = Slider(0.2, range=0..10)
number_slider_4 = Slider(0.01, range=0..0.1)
_10º = PowerOf10(Value=number_slider)
sls = StressLines(
    PrincipalMesh=defmesh.PrincipalDirection2,
    Seed=meshcp.Point,
    StepTolerance=number_slider_2,
    MaxError=_10º,
    Seperation=number_slider_3,
    TestDist=number_slider_4)
sls_2 = StressLines(
    PrincipalMesh=defmesh.PrincipalDirection1,
    Seed=meshcp.Point,
    StepTolerance=number_slider_2,
    MaxError=_10º,
    Seperation=number_slider_3,
    TestDist=number_slider_4)
preview = CustomPreview(Geometry=sls, Material=ColourSwatch(SwatchColor=RGB(255, 143, 212)))
preview_2 = CustomPreview(Geometry=sls_2, Material=ColourSwatch(SwatchColor=RGB(82, 184, 59)))

# ----
# Step 5.1: Produce Stress lines one at a time
number_slider_5 = Slider(-5, range=-10..0)
_10º_2 = PowerOf10(Value=number_slider_5)
stress_line = StressLine(PrincipalMesh=defmesh.PrincipalDirection1, Seed=meshcp.Point, StepTolerance="0.1", MaxError=_10º_2)
stress_line_2 = StressLine(PrincipalMesh=defmesh.PrincipalDirection2, Seed=meshcp.Point, StepTolerance="0.1", MaxError=_10º_2)
preview_3 = CustomPreview(
    Geometry=stress_line_2,
    Material={diffuse=RGB(13, 201, 0), emission=RGB(4, 60, 0), shine=0.5, specular=RGB(255, 255, 255), transparency=0})
preview_4 = CustomPreview(
    Geometry=stress_line,
    Material={diffuse=RGB(13, 201, 0), emission=RGB(4, 60, 0), shine=0.5, specular=RGB(255, 255, 255), transparency=0})

# ----
# Step 5.0: Check Principle Directions
popgeo = PopulateGeometry(Geometry=filter, Count=100, Seed=1)
# Results
eval = EvaluatePrincipalMesh(Principal=defmesh.PrincipalDirection1, Location=popgeo)
eval_2 = EvaluatePrincipalMesh(Principal=defmesh.PrincipalDirection2, Location=popgeo)
vdisex = VectorDisplayEx(Point=popgeo, Vector=expr("x/10", eval), Colour=RGB(255, 143, 212), Width=2)
vdisex_2 = VectorDisplayEx(Point=popgeo, Vector=expr("x/10", eval_2), Colour=RGB(82, 184, 59), Width=2)
