# Grasshopper definition 10LilyPad_FlatPlate_KarambaVectorMesh.gh (Grasshopper 1.0.8)
# plug-ins: Karamba3D, LilyPad

# ----
# Choose refinement
panel = Panel("50")

# ----
# Structure: Square Plate Cantilever
# Analysis Input: Karamba 3D
# Field Generation Method: Vector Field Method
# Step 1: Create Input Mesh
panel_2 = Panel("-5 to 5")
rectangle = Rectangle(Plane=PlaneXY(0, 0, 0), XSize=panel_2, YSize=panel_2, Radius=0)  # -> Rectangle, Length
mplane = MeshPlane(Boundary=rectangle.Rectangle, WidthCount=panel, HeightCount=panel)  # -> Mesh, Area
tri = Triangulate(Mesh=mplane.Mesh)  # -> Mesh, Count

preview = CustomPreview(Geometry=tri.Mesh, Material=ColourSwatch(SwatchColor=RGB(97, 97, 97)))

# ---- group: Step 2:Create Nodal Translation For Mesh Node
# Step 2.0: Create Deformation Results
# we're using karamba to generate the deformation results in this case
matselect = MaterialSelectionKaramba3D(menu=[dropdown(1), dropdown(0)])
pt = ConstructPoint(XCoordinate="5", YCoordinate=0, ZCoordinate=0)
Y = UnitY(Factor="-1")
panel_3 = Panel("""-5
5""")
pt_2 = ConstructPoint(XCoordinate="-5", YCoordinate=panel_3, ZCoordinate=0)
crosec = CrossSectionKaramba3D(FamilyNameOfCrossSection="DefaultCroSec", NameOfCrossSection=matselect, Height_cm="1", mode="Shell - Const")
loads = LoadsKaramba3D(ForceVector=Y, Local=False, PosInd=pt, LCase="LC0", mode="Point")
supp = SupportKaramba3D(PosInd=pt_2, Ct_kN_m=Vector(0, 0, 0), Cr_kNm_rad=Vector(0, 0, 0), menu=[buttons(on, on, on, on, on, on)])
surfelem = CreateSurfaceElementKaramba3D(Mesh=tri.Mesh, CrossSection=crosec, LimitDistance_m=0.005, Bending=True, mode="MeshToShell")  # -> Element, Points, Info
assemble = AssembleModelKaramba3D(Elem=surfelem.Element, Support=supp, Load=loads, LimitDistance_m=0.005)  # -> Model, Info, Mass_kg, CentreOfGravity, LoadCaseNames
license = LicenseKaramba3D()
panel_4 = Panel(license)
analyse = AnalyseKaramba3D(Model=assemble.Model)  # -> AnalysedModel, MaximumDisplacement_cm, ResultingForce_kN, ChangeOfElasticEnergy_kNm
modelview = ModelViewKaramba3D(Model=analyse.AnalysedModel)  # -> Model, DeformedMesh, DeformedAxes, DeformedModel, MaximumDeformation
demesh = DeconstructMesh(Mesh=tri.Mesh)  # -> Vertices, Faces, Colours, Normals
shellview = ShellViewKaramba3D(Model=modelview.Model, IndexOfLayer=0)  # -> Model, MeshesOfRenderedShells, LegendColours, LegendTags
nodedisp = NodalDisplacementsKaramba3D(AnalysedModel=analyse.AnalysedModel, PositionsIndexes=demesh.Vertices)  # -> Model, flatten(NodalTranslations_m), flatten(NodalRotations_rad), DisplacementPosition, LoadCaseIndex
legend = Legend(Colour=shellview.LegendColours, Tags=shellview.LegendTags, LegendType=1)

# ----
vdisex = VectorDisplayEx(Point=pt, Vector=Y, Colour=RGB(0, 0, 0), Width=2)

# ----
# Step 2.1: Create Vector Results
# In this case we're using the standard Create Deformation Mesh component to generate our principle vectors.
# 
# The reason for this is to guarantee the vectors don't switch between principle directions.
# 
# Equally, the Principle Meshes generated here could be used but we want to smooth the field with the vector mesh component.
# Note On Vector Field Generation: Principle Vector Field(P1/P2) is generated for either Bending stress lines or In-plane stress lines
# Bending stress lines - rotational input is required - i.e.slab structure/dome structure
# In-plane stress lines - translational input is required - i.e.shear wall structure
list = ValueList({"Bending Stress Lines": True, "In-Plane Stress Lines": False}, selected="In-Plane Stress Lines")
poisson_s_ratio = Panel("0.3")
facen = FaceNormals(Mesh=tri.Mesh)  # -> Centers, Normals
defmesh = CreateDeformationMesh(
    Mesh=tri.Mesh,
    Translations=nodedisp.NodalTranslations_m,
    Rotations=nodedisp.NodalRotations_rad,
    PoissonsRatio=poisson_s_ratio,
    BendingStressLines=list)  # -> PrincipalDirection1, PrincipalDirection2
eval = EvaluatePrincipalMesh(Principal=defmesh.PrincipalDirection1, Location=facen.Centers)
eval_2 = EvaluatePrincipalMesh(Principal=defmesh.PrincipalDirection2, Location=facen.Centers)
vdisex_2 = VectorDisplayEx(Point=facen.Centers, Vector=expr("x/10", eval_2), Colour=RGB(255, 143, 212), Width=2)
vdisex_3 = VectorDisplayEx(Point=facen.Centers, Vector=expr("x/10", eval), Colour=RGB(82, 184, 59), Width=2)

# ---- group: Vector Field
# connect the principle vectors if they are avaliable
v2 = Data([Vector(-0.9686188556, -0.248550825, 0), Vector(-0.9897883345, -0.1425449155, 0), Vector(-0.9938092856, -0.1110995221, 0), Vector(-0.9957673359, -0.09190980768, 0), Vector(-0.9970328811, -0.07697684084, 0), Vector(-0.9978799414, -0.06508166079, 0)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])
v1 = Data([Vector(-0.248550825, 0.9686188556, 0), Vector(-0.1425449155, 0.9897883345, 0), Vector(-0.1110995221, 0.9938092856, 0), Vector(-0.09190980768, 0.9957673359, 0), Vector(-0.07697684084, 0.9970328811, 0), Vector(-0.06508166079, 0.9978799414, 0)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])

# ----
# Step 3: Create Principle Mesh
# Smoothing Radius: The Create Vector Mesh component performs a weighted average all the vectors within the radius of the point being evaluated. Closer vectors get a higher weighting
smoothing_radius = Panel("0.5")
vectormesh = CreateVectorMesh(Mesh=tri.Mesh, Vectors1st=v1, Vectors2nd=v2, Radius=smoothing_radius)  # -> PrincipleDirection1, PrincipleDirection2

# ---- group: Step 4: Selecting Seed Point
# Step 4: Create a Seed Point
# This can be any point on the mesh
medges = MeshEdges(Mesh=tri.Mesh)  # -> NakedEdges, InteriorEdges, NonManifoldEdges
md_slider = MDSlider(SliderMode=0, slider_value=Point(0.5, 0.5, 0.5), x_domain=Domain(0, 1), y_domain=Domain(0, 1), z_domain=Domain(0, 1))
join = JoinCurves(Curves=medges.NakedEdges, Preserve=False)
boundary = BoundarySurfaces(Edges=join)
srf = Surface(boundary)
evalsrf = EvaluateSurface(Surface=reparameterize(srf), Point=md_slider)  # -> Point, Normal, UDirection, VDirection, Frame
meshcp = MeshClosestPoint(Point=evalsrf.Point, Mesh=tri.Mesh)  # -> Point, Index, Parameter

# ----
sph = Sphere(Base=meshcp.Point, Radius=smoothing_radius)

# ----
# Step 5.2: Produce Stress lines through a seeding
number_slider = Slider(-4, range=-10..0)
number_slider_2 = Slider(0.1, range=0.05..1)
number_slider_3 = Slider(0.3, range=0..10)
number_slider_4 = Slider(0.08, range=0..0.1)
_10º = PowerOf10(Value=number_slider)
sls = StressLines(
    PrincipalMesh=vectormesh.PrincipleDirection2,
    Seed=meshcp.Point,
    StepTolerance=number_slider_2,
    MaxError=_10º,
    Seperation=number_slider_3,
    TestDist=number_slider_4)
sls_2 = StressLines(
    PrincipalMesh=vectormesh.PrincipleDirection1,
    Seed=meshcp.Point,
    StepTolerance=number_slider_2,
    MaxError=_10º,
    Seperation=number_slider_3,
    TestDist=number_slider_4)
preview_2 = CustomPreview(Geometry=sls, Material=ColourSwatch(SwatchColor=RGB(255, 143, 212)))
preview_3 = CustomPreview(Geometry=sls_2, Material=ColourSwatch(SwatchColor=RGB(82, 184, 59)))

# ----
# Step 5.1: Produce Stress lines one at a time
number_slider_5 = Slider(-4, range=-10..0)
_10º_2 = PowerOf10(Value=number_slider_5)
stress_line = StressLine(PrincipalMesh=vectormesh.PrincipleDirection1, Seed=meshcp.Point, StepTolerance="0.1", MaxError=_10º_2)
stress_line_2 = StressLine(PrincipalMesh=vectormesh.PrincipleDirection2, Seed=meshcp.Point, StepTolerance="0.1", MaxError=_10º_2)
preview_4 = CustomPreview(
    Geometry=stress_line_2,
    Material={diffuse=RGB(13, 201, 0), emission=RGB(4, 60, 0), shine=0.5, specular=RGB(255, 255, 255), transparency=0})
preview_5 = CustomPreview(
    Geometry=stress_line,
    Material={diffuse=RGB(13, 201, 0), emission=RGB(4, 60, 0), shine=0.5, specular=RGB(255, 255, 255), transparency=0})

# ----
# Step 5.0: Check Principle Directions
popgeo = PopulateGeometry(Geometry=tri.Mesh, Count=100, Seed=1)
# Results
eval_3 = EvaluatePrincipalMesh(Principal=vectormesh.PrincipleDirection1, Location=popgeo)
eval_4 = EvaluatePrincipalMesh(Principal=vectormesh.PrincipleDirection2, Location=popgeo)
vdisex_4 = VectorDisplayEx(Point=popgeo, Vector=expr("x/10", eval_3), Colour=RGB(255, 143, 212), Width=2)
vdisex_5 = VectorDisplayEx(Point=popgeo, Vector=expr("x/10", eval_4), Colour=RGB(82, 184, 59), Width=2)
