# Grasshopper definition 11LilyPad_FlatPlate_KarambaStandard.gh (Grasshopper 1.0.8)
# plug-ins: Karamba3D, LilyPad

# ----
# Choose refinement
panel = Panel("50")

# ----
# Structure: Square Plate Cantilever
# Analysis Input: Karamba 3D
# Field Generation Method: Displacement Field Method - Standard Order
# Step 1: Create Input Mesh
panel_2 = Panel("-5 to 5")
rectangle = Rectangle(Plane=PlaneXY(0, 0, 0), XSize=panel_2, YSize=panel_2, Radius=0)  # -> Rectangle, Length
mplane = MeshPlane(Boundary=rectangle.Rectangle, WidthCount=panel, HeightCount=panel)  # -> Mesh, Area
tri = Triangulate(Mesh=mplane.Mesh)  # -> Mesh, Count

preview = CustomPreview(Geometry=tri.Mesh, Material=ColourSwatch(SwatchColor=RGB(97, 97, 97)))

# ---- group: Step 2:Create Nodal Translation For Mesh Node
# Step 2.0: Create Deformation Results
# we're using karamba to generate the deformation results in this case
matselect = MaterialSelectionKaramba3D(menu=[dropdown(1), dropdown(0)])
pt = ConstructPoint(XCoordinate="5", YCoordinate=0, ZCoordinate=0)
Y = UnitY(Factor="-1")
panel_3 = Panel("""-5
5""")
pt_2 = ConstructPoint(XCoordinate="-5", YCoordinate=panel_3, ZCoordinate=0)
crosec = CrossSectionKaramba3D(FamilyNameOfCrossSection="DefaultCroSec", NameOfCrossSection=matselect, Height_cm="1", mode="Shell - Const")
loads = LoadsKaramba3D(ForceVector=Y, Local=False, PosInd=pt, LCase="LC0", mode="Point")
supp = SupportKaramba3D(PosInd=pt_2, Ct_kN_m=Vector(0, 0, 0), Cr_kNm_rad=Vector(0, 0, 0), menu=[buttons(on, on, on, on, on, on)])
surfelem = CreateSurfaceElementKaramba3D(Mesh=tri.Mesh, CrossSection=crosec, LimitDistance_m=0.005, Bending=True, mode="MeshToShell")  # -> Element, Points, Info
assemble = AssembleModelKaramba3D(Elem=surfelem.Element, Support=supp, Load=loads, LimitDistance_m=0.005)  # -> Model, Info, Mass_kg, CentreOfGravity, LoadCaseNames
# we're using karamba to generate the deformation results in this case
license = LicenseKaramba3D()
panel_4 = Panel(license)
analyse = AnalyseKaramba3D(Model=assemble.Model)  # -> AnalysedModel, MaximumDisplacement_cm, ResultingForce_kN, ChangeOfElasticEnergy_kNm
modelview = ModelViewKaramba3D(Model=analyse.AnalysedModel)  # -> Model, DeformedMesh, DeformedAxes, DeformedModel, MaximumDeformation
demesh = DeconstructMesh(Mesh=tri.Mesh)  # -> Vertices, Faces, Colours, Normals
shellview = ShellViewKaramba3D(Model=modelview.Model, IndexOfLayer=0)  # -> Model, MeshesOfRenderedShells, LegendColours, LegendTags
nodedisp = NodalDisplacementsKaramba3D(AnalysedModel=analyse.AnalysedModel, PositionsIndexes=demesh.Vertices)  # -> Model, flatten(NodalTranslations_m), flatten(NodalRotations_rad), DisplacementPosition, LoadCaseIndex
legend = Legend(Colour=shellview.LegendColours, Tags=shellview.LegendTags, LegendType=1)

# ----
vdisex = VectorDisplayEx(Point=pt, Vector=Y, Colour=RGB(0, 0, 0), Width=2)

# ---- group: Vector Field
# connect the deformation results if they are avaliable
displacements = Data([Vector(0, 0, 0), Vector(-6.519997199e-07, -7.135648299e-08, 0), Vector(-1.039970293e-06, -8.468748041e-08, 0), Vector(-1.309881866e-06, -1.363077033e-07, 0), Vector(-1.511960122e-06, -2.128943115e-07, 0), Vector(-1.67146234e-06, -3.039168536e-07, 0)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])
rotations = Data([Vector(0, 0, 0), Vector(0, 0, 0), Vector(0, 0, 0), Vector(0, 0, 0), Vector(0, 0, 0), Vector(0, 0, 0)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])

# ----
# Step 3: Create Principle Mesh
list = ValueList({"Bending Stress Lines": True, "In-Plane Stress Lines": False}, selected="In-Plane Stress Lines")
poisson_s_ratio = Panel("0.3")
defmesh = CreateDeformationMesh(Mesh=tri.Mesh, Translations=displacements, Rotations=rotations, PoissonsRatio=poisson_s_ratio, BendingStressLines=list)  # -> PrincipalDirection1, PrincipalDirection2

# ---- group: Step 4: Selecting Seed Point
# Step 4: Create a Seed Point
# This can be any point on the mesh
medges = MeshEdges(Mesh=tri.Mesh)  # -> NakedEdges, InteriorEdges, NonManifoldEdges
md_slider = MDSlider(SliderMode=0, slider_value=Point(0.5, 0.5, 0.5), x_domain=Domain(0, 1), y_domain=Domain(0, 1), z_domain=Domain(0, 1))
join = JoinCurves(Curves=medges.NakedEdges, Preserve=False)
boundary = BoundarySurfaces(Edges=join)
srf = Surface(boundary)
evalsrf = EvaluateSurface(Surface=reparameterize(srf), Point=md_slider)  # -> Point, Normal, UDirection, VDirection, Frame
meshcp = MeshClosestPoint(Point=evalsrf.Point, Mesh=tri.Mesh)  # -> Point, Index, Parameter
# Enable relays to run
# This may take a couple of minutes
dots = DotDisplay(Point=meshcp.Point, Colour=RGB(0, 0, 0), Size=0.1)

# ----
# Step 5.2: Produce Stress lines through a seeding
number_slider = Slider(-4, range=-10..0)
number_slider_2 = Slider(0.1, range=0.05..1)
number_slider_3 = Slider(0.3, range=0..10)
number_slider_4 = Slider(0.08, range=0..0.1)
_10º = PowerOf10(Value=number_slider)
sls = StressLines(
    PrincipalMesh=defmesh.PrincipalDirection2,
    Seed=meshcp.Point,
    StepTolerance=number_slider_2,
    MaxError=_10º,
    Seperation=number_slider_3,
    TestDist=number_slider_4)
sls_2 = StressLines(
    PrincipalMesh=defmesh.PrincipalDirection1,
    Seed=meshcp.Point,
    StepTolerance=number_slider_2,
    MaxError=_10º,
    Seperation=number_slider_3,
    TestDist=number_slider_4)
preview_2 = CustomPreview(Geometry=sls, Material=ColourSwatch(SwatchColor=RGB(255, 143, 212)))
preview_3 = CustomPreview(Geometry=sls_2, Material=ColourSwatch(SwatchColor=RGB(82, 184, 59)))

# ----
# Step 5.1: Produce Stress lines one at a time
number_slider_5 = Slider(-4, range=-10..0)
_10º_2 = PowerOf10(Value=number_slider_5)
stress_line = StressLine(PrincipalMesh=defmesh.PrincipalDirection1, Seed=meshcp.Point, StepTolerance="0.1", MaxError=_10º_2)
stress_line_2 = StressLine(PrincipalMesh=defmesh.PrincipalDirection2, Seed=meshcp.Point, StepTolerance="0.1", MaxError=_10º_2)
preview_4 = CustomPreview(
    Geometry=stress_line_2,
    Material={diffuse=RGB(13, 201, 0), emission=RGB(4, 60, 0), shine=0.5, specular=RGB(255, 255, 255), transparency=0})
preview_5 = CustomPreview(
    Geometry=stress_line,
    Material={diffuse=RGB(13, 201, 0), emission=RGB(4, 60, 0), shine=0.5, specular=RGB(255, 255, 255), transparency=0})

# ----
# Step 5.0: Check Principle Directions
popgeo = PopulateGeometry(Geometry=tri.Mesh, Count=100, Seed=1)
# Results
eval = EvaluatePrincipalMesh(Principal=defmesh.PrincipalDirection1, Location=popgeo)
eval_2 = EvaluatePrincipalMesh(Principal=defmesh.PrincipalDirection2, Location=popgeo)
vdisex_2 = VectorDisplayEx(Point=popgeo, Vector=expr("x/10", eval), Colour=RGB(255, 143, 212), Width=2)
vdisex_3 = VectorDisplayEx(Point=popgeo, Vector=expr("x/10", eval_2), Colour=RGB(82, 184, 59), Width=2)
