# Grasshopper definition 22LilyPad_FlatSlab_HigherOrder.gh (Grasshopper 1.0.8)
# plug-ins: MeshEdit Components, treesloth01, GSA, LilyPad

# ---- group: Step 2:Create Nodal Translation For Mesh Node
# Structure:  Square Slab Under UDL
# Analysis Input: Oasys GSA
# Field Generation Method: Displacement Field Method - Higher Order
# Step 2: Create Deformation Results
# In this case we are extracting the deformation data, element topology and nodal positions from an analysed GSA model
# 
# This step can be replaced with an alternative FEA program but you will need to work out how to extract the necessary data,
# but usually this is at least possible by saving the data to a spreadsheet and reading that into grasshopper
panel = Panel("C:\Users\Matt C\Documents\GitHub\PrincipalStressLines\Example Files\2_Flat Slab\LilyPad_FlatSlab_HigherOrder_GSAAnalysis.gwb")  # disabled
open = OpenModel(FilenameAndPath=panel)  # disabled
getanalysis = GetModelAnalysis(GSAModel=open)  # -> AnalysisTasks, AnalysisCases, CombinationCases, DesignTasks; disabled
panel_2 = Panel(getanalysis.AnalysisCases)  # disabled
getgeo = GetModelGeometry(GSAModel=open, Mode=1, Unit="m")  # -> NodesIn_m, _1DElementsIn_m, _2DElementsIn_m, _3DElementsIn_m, _1DMembersIn_m, _2DMembersIn_m, _3DMembersIn_m, Assemblies; disabled
getres = GetResult(GSAModel=open, T="A", Case=1)  # disabled
nodedisp = NodeDisplacements(Result=getres, Max_Min="All", Unit="mm")  # -> TranslationsX_mm, TranslationsY_mm, TranslationsZ_mm, TranslationsXYZ_mm, RotationXX_rad, RotationYY_rad, RotationZZ_rad, RotationXYZ_rad, NodeIDs; disabled
nodeedit = EditNode(Node=getgeo.NodesIn_m, Mode=1)  # -> Node, NodeNumber, NodePosition, NodeLocalAxis, NodeRestraints, DamperProperty, MassProperty, SpringProperty, NodeName, NodeColour; disabled
elem2dedit = Edit2DElement(Element2D=getgeo._2DElementsIn_m, Preview3dSection=False)  # -> Element2D, Number, Geometry, _2DProperty, Group, ElementType, Offset, OrientationAngle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; disabled
num = Number(nodedisp.RotationXX_rad)  # disabled
num_2 = Number(nodedisp.RotationYY_rad)  # disabled
num_3 = Number(nodedisp.RotationZZ_rad)  # disabled
subtraction = Subtraction(A=elem2dedit.Topology, B=1)  # disabled
vec = VectorXYZ(XComponent=num, YComponent=num_2, ZComponent=num_3)  # -> Vector, Length; disabled
int = Integer(nodeedit.NodeNumber)  # disabled
int_2 = Integer(elem2dedit.Topology)  # disabled
int_3 = Integer(subtraction)  # disabled
mindex = MemberIndex(Set=int, Member=int_2)  # -> Index, Count; disabled
shift = ShiftPaths(Data=mindex.Index, Offset=-1)  # disabled
displacement_vectors = Vector(vec.Vector)  # disabled
element_node_ids = Number(simplify(shift))  # disabled
node_locations = Point(nodeedit.NodePosition)  # disabled

# ---- group: Step 3.0: FEA Data Import
displacement_vectors_2 = Vector([Vector(-0.3817981184, 0.3817981184, 0), Vector(-0.3817981184, -0.3817981184, 0), Vector(0.3817981184, -0.3817981184, 0), Vector(0.3817981184, 0.3817981184, 0), Vector(-0.3582888544, 0.3789351285, 0), Vector(-0.3579543531, 0.3579543531, 0)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])
node_locations_2 = Point([Point(-5, -5, 0), Point(5, -5, 0), Point(5, 5, 0), Point(-5, 5, 0), Point(-4.8, -5, 0), Point(-4.8, -4.8, 0)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])

# ----
# Step 3: Create Principle Mesh
# Displacement Field Method (Higher Order)
# Connecting the input if GSA data is avaliable; otherwise remain unconnected.
element_node_ids_2 = Number(simplify(Tree({0}: [0, 4, 5, 6, 2601, 2602, 2603, 2604], {1}: [6, 5, 7, 8, 2603, 2605, 2606, 2607], {2}: [8, 7, 9, 10, 2606, 2608, 2609, 2610], {3}: [10, 9, 11, 12, 2609, 2611, 2612, 2613], {4}: [12, 11, 13, 14, 2612, 2614, 2615, 2616], {5}: [14, 13, 15, 16, 2615, 2617, 2618, 2619]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)))

# ---- group: Step 3.1: Construct Input Mesh
item = ListItem(List=element_node_ids_2, Index=0, Wrap=True)  # -> Item, Item1, Item2, Item3, Item4, Item5, Item6, Item7
quad = MeshQuad(CornerA=item.Item, CornerB=item.Item1, CornerC=item.Item2, CornerD=item.Item3)
conmesh = ConstructMesh(Vertices=node_locations_2, Faces=flatten(quad))

# ---- group: visualise corner indices
tstat = TreeStatistics(Tree=element_node_ids_2)  # -> Paths, Length, Count
item_2 = ListItem(List=tstat.Paths, Index=0, Wrap=True)
split = SplitTree(Data=element_node_ids_2, Masks=flatten(item_2))  # -> Positive, Negative
item_3 = ListItem(List=node_locations_2, Index=split.Positive, Wrap=True)
points = PointList(Points=item_3, Size=0.03)

# ---- group: Step 3.2: Create Deformation Mesh
# Note On Vector Field Generation: Principle Vector Field(P1/P2) is generated for either Bending stress lines or In-plane stress lines
# Bending stress lines - rotational input is required - i.e.slab structure/dome structure
# In-plane stress lines - translational input is required - i.e.shear wall structure
list = ValueList({"Bending Stress Lines": True, "In-Plane Stress Lines": False}, selected="Bending Stress Lines")
poisson_s_ratio = Panel("0.3")
defmeshhigh = CreateDeformationMeshHigher(
    Mesh=conmesh,
    Translations=Vector(0, 0, 0),
    Rotations=displacement_vectors_2,
    PoissonsRatio=poisson_s_ratio,
    BendingStressLines=list)  # -> PrincipalDirection1, PrincipalDirection2

# ----
preview = CustomPreview(Geometry=conmesh, Material=ColourSwatch(SwatchColor=RGB(97, 97, 97)))

# ---- group: Step 4: Selecting Seed Point
# Step 4: Create a Seed Point
cullvertices = MeshCullUnusedVertices(Mesh=conmesh)
demesh = DeconstructMesh(Mesh=cullvertices)  # -> Vertices, Faces, Colours, Normals
selecting_seed_point = Slider(500, range=0..2602)
item_4 = ListItem(List=demesh.Vertices, Index=selecting_seed_point, Wrap=True)
dots = DotDisplay(Point=item_4, Colour=RGB(0, 0, 0), Size=0.1)
seed_point = Point(item_4)

# ----
# Step 5.2: Produce Stress lines through a seeding
number_slider = Slider(-4, range=-10..0)
number_slider_2 = Slider(0.1, range=0.05..1)
number_slider_3 = Slider(0.3, range=0..10)
number_slider_4 = Slider(0.08, range=0..0.1)
_10º = PowerOf10(Value=number_slider)
sls = StressLines(
    PrincipalMesh=defmeshhigh.PrincipalDirection2,
    Seed=seed_point,
    StepTolerance=number_slider_2,
    MaxError=_10º,
    Seperation=number_slider_3,
    TestDist=number_slider_4)
sls_2 = StressLines(
    PrincipalMesh=defmeshhigh.PrincipalDirection1,
    Seed=seed_point,
    StepTolerance=number_slider_2,
    MaxError=_10º,
    Seperation=number_slider_3,
    TestDist=number_slider_4)
preview_2 = CustomPreview(Geometry=sls, Material=ColourSwatch(SwatchColor=RGB(255, 143, 212)))
preview_3 = CustomPreview(Geometry=sls_2, Material=ColourSwatch(SwatchColor=RGB(82, 184, 59)))

# ----
# Step 5.1: Produce Stress lines one at a time
number_slider_5 = Slider(-4, range=-10..0)
_10º_2 = PowerOf10(Value=number_slider_5)
stress_line = StressLine(PrincipalMesh=defmeshhigh.PrincipalDirection1, Seed=seed_point, StepTolerance="0.1", MaxError=_10º_2)
stress_line_2 = StressLine(PrincipalMesh=defmeshhigh.PrincipalDirection2, Seed=seed_point, StepTolerance="0.1", MaxError=_10º_2)
preview_4 = CustomPreview(
    Geometry=stress_line_2,
    Material={diffuse=RGB(13, 201, 0), emission=RGB(4, 60, 0), shine=0.5, specular=RGB(255, 255, 255), transparency=0})
preview_5 = CustomPreview(
    Geometry=stress_line,
    Material={diffuse=RGB(13, 201, 0), emission=RGB(4, 60, 0), shine=0.5, specular=RGB(255, 255, 255), transparency=0})

# ----
# Step 5.0: Check Principle Directions
popgeo = PopulateGeometry(Geometry=conmesh, Count=100, Seed=1)
# Results
eval = EvaluatePrincipalMesh(Principal=defmeshhigh.PrincipalDirection1, Location=popgeo)
eval_2 = EvaluatePrincipalMesh(Principal=defmeshhigh.PrincipalDirection2, Location=popgeo)
vdisex = VectorDisplayEx(Point=popgeo, Vector=expr("x/10", eval), Colour=RGB(255, 143, 212), Width=2)
vdisex_2 = VectorDisplayEx(Point=popgeo, Vector=expr("x/10", eval_2), Colour=RGB(82, 184, 59), Width=2)
