# Grasshopper definition LilyPad_Example-Slab_8Node_rv1.gh (Grasshopper 1.0.8)
# plug-ins: MeshEdit Components, treesloth01, Human, GSA, LilyPad

# ---- group: Step 0: Read GSA Analysis Results
# Input Analysis Model Results (Optional)
panel = Panel("C:\Users\glformat\Documents\GitHub\PrincipalStressLines\Example Files\GSA Model_Slab_8Node.gwb")  # disabled
open = OpenModel(FilenameAndPath=panel)  # disabled
getanalysis = GetModelAnalysis(GSAModel=open)  # -> AnalysisTasks, AnalysisCases, CombinationCases, DesignTasks; disabled
panel_2 = Panel(getanalysis.AnalysisCases)  # disabled
getgeo = GetModelGeometry(GSAModel=open, Mode=1, Unit="m")  # -> NodesIn_m, _1DElementsIn_m, _2DElementsIn_m, _3DElementsIn_m, _1DMembersIn_m, _2DMembersIn_m, _3DMembersIn_m, Assemblies; disabled
getres = GetResult(GSAModel=open, T="A", Case=1)  # disabled
nodedisp = NodeDisplacements(Result=getres, Max_Min="All", Unit="mm")  # -> TranslationsX_mm, TranslationsY_mm, TranslationsZ_mm, TranslationsXYZ_mm, RotationXX_rad, RotationYY_rad, RotationZZ_rad, RotationXYZ_rad, NodeIDs; disabled
nodeedit = EditNode(Node=getgeo.NodesIn_m, Mode=1)  # -> Node, NodeNumber, NodePosition, NodeLocalAxis, NodeRestraints, DamperProperty, MassProperty, SpringProperty, NodeName, NodeColour; disabled
elem2dedit = Edit2DElement(Element2D=getgeo._2DElementsIn_m, Preview3dSection=False)  # -> Element2D, Number, Geometry, _2DProperty, Group, ElementType, Offset, OrientationAngle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; disabled
num = Number(nodedisp.RotationXX_rad)  # disabled
num_2 = Number(nodedisp.RotationYY_rad)  # disabled
num_3 = Number(nodedisp.RotationZZ_rad)  # disabled
subtraction = Subtraction(A=elem2dedit.Topology, B=1)  # disabled
vec = VectorXYZ(XComponent=num, YComponent=num_2, ZComponent=num_3)  # -> Vector, Length; disabled
int = Integer(nodeedit.NodeNumber)  # disabled
int_2 = Integer(elem2dedit.Topology)  # disabled
int_3 = Integer(subtraction)  # disabled
mindex = MemberIndex(Set=int, Member=int_2)  # -> Index, Count; disabled
shift = ShiftPaths(Data=mindex.Index, Offset=-1)  # disabled
displacement_vectors = Vector(vec.Vector)  # disabled
element_node_ids = Number(simplify(shift))  # disabled
node_locations = Point(nodeedit.NodePosition)  # disabled

# ----
# Connecting the input if GSA data is avaliable; otherwise remain unconnected.
data = Data(node_locations)
# Structure: Square Slab Under UDL
# Analysis Input: Data/Oasys GSA
# Field Generation Method: Displacement Field Method (Higher Order)
element_node_ids_2 = Number(simplify(element_node_ids))

# ---- group: Step 1: FEA Data Import
displacement_vectors_2 = Vector(displacement_vectors)
node_locations_2 = Point(node_locations)

# ----
panel_3 = Panel(node_locations_2)

# ---- group: Step 2.2: Construct Input Mesh
item = ListItem(List=element_node_ids_2, Index=0, Wrap=True)  # -> Item, Item1, Item2, Item3, Item4, Item5, Item6, Item7
quad = MeshQuad(CornerA=item.Item, CornerB=item.Item1, CornerC=item.Item2, CornerD=item.Item3)
conmesh = ConstructMesh(Vertices=node_locations_2, Faces=flatten(quad))

# ---- group: Step 2.1: Select Corner Vetices (0,2,7,5) For Mesh Quads
tstat = TreeStatistics(Tree=element_node_ids_2)  # -> Paths, Length, Count
item_2 = ListItem(List=tstat.Paths, Index=0, Wrap=True)
split = SplitTree(Data=element_node_ids_2, Masks=flatten(item_2))  # -> Positive, Negative
item_3 = ListItem(List=node_locations_2, Index=split.Positive, Wrap=True)
pline = PolyLine(Vertices=item_3, Closed=True)
previewlw = CustomPreviewLineweights(Geometry=pline, Shader=ColourSwatch(SwatchColor=RGB(0, 0, 0)), Thickness=4, Absolute=False)
points = PointList(Points=item_3, Size=0.03)

# ---- group: Step 4: Selecting Seed Point
cullvertices = MeshCullUnusedVertices(Mesh=conmesh)
demesh = DeconstructMesh(Mesh=cullvertices)  # -> Vertices, Faces, Colours, Normals
selecting_seed_point = Slider(1352, range=0..2602)
item_4 = ListItem(List=demesh.Vertices, Index=selecting_seed_point, Wrap=True)
dots = DotDisplay(Point=item_4, Colour=RGB(0, 0, 0), Size=0.1)
seed_point = Point(item_4)

# ---- group: Step 3: Create Deformation Mesh
panel_4 = Panel("""True - Bending Stress Lines
False - In-plane Stress Lines""")
list = ItemSelector(panel_4, {"True - Bending Stress Lines", "False - In-plane Stress Lines"}, selected="True - Bending Stress Lines")
# Note On Vector Field Generation: Principle Vector Field(P1/P2) is generated for either Bending stress lines or In-plane stress lines
# Bending stress lines - rotational input is required - i.e.slab structure/dome structure
# In-plane stress lines - translational input is required - i.e.shear wall structure
cluster = Cluster(T=list)
defmeshhigh = CreateDeformationMeshHigher(
    Mesh=conmesh,
    Translations=Vector(0, 0, 0),
    Rotations=displacement_vectors_2,
    PoissonsRatio="0.15",
    BendingStressLines=cluster)  # -> PrincipalDirection1, PrincipalDirection2

# ----
# Setup
swatch = ColourSwatch(SwatchColor=RGB(97, 97, 97))
preview = CustomPreview(Geometry=conmesh, Material=swatch)

# ---- group: Step 5: Create Evenly Spaced Stress Lines
# Evenly Spaced Stress Lines
number_slider = Slider(-4, range=-10..0)
number_slider_2 = Slider(0.1, range=0..1)
number_slider_3 = Slider(0.08, range=0..0.1)
number_slider_4 = Slider(0.3, range=0..1)
_10º = PowerOf10(Value=number_slider)
sls = StressLines(
    PrincipalMesh=defmeshhigh.PrincipalDirection2,
    Seed=seed_point,
    StepTolerance=number_slider_2,
    MaxError=_10º,
    Seperation=number_slider_4,
    TestDist=number_slider_3)
sls_2 = StressLines(
    PrincipalMesh=defmeshhigh.PrincipalDirection1,
    Seed=seed_point,
    StepTolerance=number_slider_2,
    MaxError=_10º,
    Seperation=number_slider_4,
    TestDist=number_slider_3)
previewlw_2 = CustomPreviewLineweights(Geometry=sls_2, Shader=ColourSwatch(SwatchColor=RGB(82, 184, 59)), Thickness=2, Absolute=False)
previewlw_3 = CustomPreviewLineweights(Geometry=sls, Shader=ColourSwatch(SwatchColor=RGB(255, 143, 212)), Thickness=2, Absolute=False)

# ---- group: Step 5: Create A Stressline_P2
# Single Stress Line
number_slider_5 = Slider(0.364, range=0..1)
_10º_2 = PowerOf10(Value=Slider(-6, range=-10..0))
stress_line = StressLine(PrincipalMesh=defmeshhigh.PrincipalDirection2, Seed=seed_point, StepTolerance=number_slider_5, MaxError=_10º_2)
preview_2 = CustomPreview(
    Geometry=stress_line,
    Material={diffuse=RGB(255, 143, 212), emission=RGB(76, 43, 64), shine=0.5, specular=RGB(255, 255, 255), transparency=0})

# ---- group: Step 5: Create A Stressline_P1
# Single Stress Line
number_slider_6 = Slider(-4, range=-10..0)
_10º_3 = PowerOf10(Value=number_slider_6)
stress_line_2 = StressLine(PrincipalMesh=defmeshhigh.PrincipalDirection1, Seed=seed_point, StepTolerance=Slider(0.02, range=0..1), MaxError=_10º_3)
preview_3 = CustomPreview(
    Geometry=stress_line_2,
    Material={diffuse=RGB(82, 184, 59), emission=RGB(25, 55, 18), shine=0.5, specular=RGB(255, 255, 255), transparency=0})

# ---- group: Step 5: Evaluate Principle Mesh
# Evaluation
eval = EvaluatePrincipalMesh(Principal=defmeshhigh.PrincipalDirection2, Location=seed_point)
# Results
eval_2 = EvaluatePrincipalMesh(Principal=defmeshhigh.PrincipalDirection1, Location=seed_point)
vdisex = VectorDisplayEx(Point=seed_point, Vector=eval, Colour=RGB(255, 143, 212), Width=2)
vdisex_2 = VectorDisplayEx(Point=seed_point, Vector=eval_2, Colour=RGB(82, 184, 59), Width=2)

# ==== cluster Cluster
T = ClusterInput()
split = TextSplit(Text=T, Separators=" - ")
item = ListItem(List=split, Index=0, Wrap=True)  # -> flatten(Item)
bool = Boolean(item)
bool_2 = ClusterOutput(bool)
