# Grasshopper definition 30LilyPad_Freeform Shell_KarambaVectorMesh.gh (Grasshopper 1.0.8)
# plug-ins: Karamba3D, LilyPad

# Structure: Freeform Shell
# Analysis Input: Karamba 3D
# Field Generation Method: Vector Field Method
# Step 1: Create Input Mesh
inputmesh = Mesh(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)
preview = CustomPreview(Geometry=inputmesh, Material=ColourSwatch(SwatchColor=RGB(97, 97, 97)))

# ---- group: create support pts
bbox = BoundingBox(Content=inputmesh, Plane=PlaneXY(0, 0, 0))  # -> Box, Box_2
debox = DeconstructBox(Box=bbox.Box)  # -> Plane, X, Y, Z
nv = NakedVertices(Mesh=inputmesh)  # -> ClothedIndex, NakedIndex, ClothedPts, NakedPts
dedomain = DeconstructDomain(Domain=debox.Z)  # -> Start, End
pdecon = Deconstruct(Point=nv.NakedPts)  # -> XComponent, YComponent, ZComponent
addition = Addition(A="0.01", B=dedomain.Start)
smaller = SmallerThan(FirstNumber=pdecon.ZComponent, SecondNumber=addition)  # -> SmallerThan, OrEqualTo
cull = CullPattern(List=nv.NakedPts, CullPattern=smaller.SmallerThan)
duppt = RemoveDuplicatePts(Points=cull, Tolerance=0.001)
supp = SupportKaramba3D(PosInd=duppt, Ct_kN_m=Vector(0, 0, 0), Cr_kNm_rad=Vector(0, 0, 0), menu=[buttons(on, on, on, off, off, on)])

# ---- group: Step 2:Create Nodal Translation For Mesh Node
# Step 2.0: Create Deformation Results
# we're using karamba to generate the deformation results in this case
matselect = MaterialSelectionKaramba3D(menu=[dropdown(1), dropdown(0)])
Z = UnitZ(Factor="-1")
crosec = CrossSectionKaramba3D(FamilyNameOfCrossSection="DefaultCroSec", NameOfCrossSection=matselect, Height_cm="1", mode="Shell - Const")
loads = LoadsKaramba3D(Vector=Z, Mesh=inputmesh, LCase="LC0", mode="MeshLoad -Const.", menu=[buttons(off, on, off), buttons(on, on)])
surfelem = CreateSurfaceElementKaramba3D(Mesh=inputmesh, CrossSection=crosec, LimitDistance_m=0.005, Bending=True, mode="MeshToShell")  # -> Element, Points, Info
assemble = AssembleModelKaramba3D(Elem=surfelem.Element, Support=supp, Load=loads, LimitDistance_m=0.005)  # -> Model, Info, Mass_kg, CentreOfGravity, LoadCaseNames
license = LicenseKaramba3D()
panel = Panel(license)
analyse = AnalyseKaramba3D(Model=assemble.Model)  # -> AnalysedModel, MaximumDisplacement_cm, ResultingForce_kN, ChangeOfElasticEnergy_kNm
modelview = ModelViewKaramba3D(Model=analyse.AnalysedModel)  # -> Model, DeformedMesh, DeformedAxes, DeformedModel, MaximumDeformation
demesh = DeconstructMesh(Mesh=inputmesh)  # -> Vertices, Faces, Colours, Normals
shellview = ShellViewKaramba3D(Model=modelview.Model, IndexOfLayer=0)  # -> Model, MeshesOfRenderedShells, LegendColours, LegendTags
nodedisp = NodalDisplacementsKaramba3D(AnalysedModel=analyse.AnalysedModel, PositionsIndexes=demesh.Vertices)  # -> Model, flatten(NodalTranslations_m), flatten(NodalRotations_rad), DisplacementPosition, LoadCaseIndex
legend = Legend(Colour=shellview.LegendColours, Tags=shellview.LegendTags, LegendType=1)

# ----
# Step 2.1: Create Vector Results
# In this case we're using the standard Create Deformation Mesh component to generate our principle vectors.
# 
# The reason for this is to guarantee the vectors don't switch between principle directions.
# 
# Equally, the Principle Meshes generated here could be used but we want to smooth the field with the vector mesh component.
# Note On Vector Field Generation: Principle Vector Field(P1/P2) is generated for either Bending stress lines or In-plane stress lines
# Bending stress lines - rotational input is required - i.e.slab structure/dome structure
# In-plane stress lines - translational input is required - i.e.shear wall or shell structure
list = ValueList({"Bending Stress Lines": True, "In-Plane Stress Lines": False}, selected="In-Plane Stress Lines")
poisson_s_ratio = Panel("0.3")
facen = FaceNormals(Mesh=inputmesh)  # -> Centers, Normals
defmesh = CreateDeformationMesh(
    Mesh=inputmesh,
    Translations=nodedisp.NodalTranslations_m,
    Rotations=nodedisp.NodalRotations_rad,
    PoissonsRatio=poisson_s_ratio,
    BendingStressLines=list)  # -> PrincipalDirection1, PrincipalDirection2
eval = EvaluatePrincipalMesh(Principal=defmesh.PrincipalDirection1, Location=facen.Centers)
eval_2 = EvaluatePrincipalMesh(Principal=defmesh.PrincipalDirection2, Location=facen.Centers)
vdisex = VectorDisplayEx(Point=facen.Centers, Vector=expr("x/10", eval_2), Colour=RGB(255, 143, 212), Width=2)
vdisex_2 = VectorDisplayEx(Point=facen.Centers, Vector=expr("x/10", eval), Colour=RGB(82, 184, 59), Width=2)

# ---- group: Vector Field
# connect the principle vectors if they are avaliable
v2 = Data([Vector(-0.8180216499, 0.4960808853, -0.2911088037), Vector(0.9882132609, -0.08430134075, -0.127780417), Vector(-0.971499401, 0.2272824865, 0.06731705051), Vector(0.4226271966, -0.5642658017, 0.7092181313), Vector(-0.5284451072, 0.5458450393, -0.6502299299), Vector(0.4304516956, 0.8936291035, 0.1270368572)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])
v1 = Data([Vector(-0.5371807064, -0.4779772489, 0.6949637675), Vector(-0.03879825596, 0.6695329303, -0.7417683942), Vector(-0.09974473473, -0.6495874749, 0.7537155302), Vector(0.9055061215, 0.2957178473, -0.3043182851), Vector(-0.8483123746, -0.3695850224, 0.3791741373), Vector(-0.7730500855, 0.2923396823, 0.5629663182)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])

# ----
# Step 3: Create Principle Mesh
# Smoothing Radius: The Create Vector Mesh component performs a weighted average all the vectors within the radius of the point being evaluated. Closer vectors get a higher weighting
smoothing_radius = Panel("0.1")
vectormesh = CreateVectorMesh(Mesh=inputmesh, Vectors1st=v1, Vectors2nd=v2, Radius=smoothing_radius)  # -> PrincipleDirection1, PrincipleDirection2

demesh_2 = DeconstructMesh(Mesh=inputmesh)  # -> Vertices, Faces, Colours, Normals
jitter = Jitter(List=demesh_2.Vertices, Jitter=1, Seed=2)  # -> Values, Indices
item = ListItem(List=jitter.Values, Index=Slider(492, range=0..1000), Wrap=True)

# ---- group: Step 4: Selecting Seed Point
# Step 4: Create a Seed Point
# This can be any point on the mesh
# Enable relays to run
# This may take a couple of minutes
sph = Sphere(Base=item, Radius=smoothing_radius)

# ----
# Step 5.2: Produce Stress lines through a seeding
number_slider = Slider(-4, range=-10..0)
number_slider_2 = Slider(0.1, range=0.05..1)
number_slider_3 = Slider(0.2, range=0..10)
number_slider_4 = Slider(0.08, range=0..0.1)
_10º = PowerOf10(Value=number_slider)
sls = StressLines(
    PrincipalMesh=vectormesh.PrincipleDirection2,
    Seed=item,
    StepTolerance=number_slider_2,
    MaxError=_10º,
    Seperation=number_slider_3,
    TestDist=number_slider_4)
sls_2 = StressLines(
    PrincipalMesh=vectormesh.PrincipleDirection1,
    Seed=item,
    StepTolerance=number_slider_2,
    MaxError=_10º,
    Seperation=number_slider_3,
    TestDist=number_slider_4)
preview_2 = CustomPreview(Geometry=sls, Material=ColourSwatch(SwatchColor=RGB(255, 143, 212)))
preview_3 = CustomPreview(Geometry=sls_2, Material=ColourSwatch(SwatchColor=RGB(82, 184, 59)))

# ----
# Step 5.1: Produce Stress lines one at a time
number_slider_5 = Slider(-4, range=-10..0)
_10º_2 = PowerOf10(Value=number_slider_5)
stress_line = StressLine(PrincipalMesh=vectormesh.PrincipleDirection1, Seed=item, StepTolerance="0.1", MaxError=_10º_2)
stress_line_2 = StressLine(PrincipalMesh=vectormesh.PrincipleDirection2, Seed=item, StepTolerance="0.1", MaxError=_10º_2)
preview_4 = CustomPreview(
    Geometry=stress_line_2,
    Material={diffuse=RGB(13, 201, 0), emission=RGB(4, 60, 0), shine=0.5, specular=RGB(255, 255, 255), transparency=0})
preview_5 = CustomPreview(
    Geometry=stress_line,
    Material={diffuse=RGB(13, 201, 0), emission=RGB(4, 60, 0), shine=0.5, specular=RGB(255, 255, 255), transparency=0})

# ----
# Step 5.0: Check Principle Directions
popgeo = PopulateGeometry(Geometry=inputmesh, Count=100, Seed=1)
# Results
eval_3 = EvaluatePrincipalMesh(Principal=vectormesh.PrincipleDirection1, Location=popgeo)
eval_4 = EvaluatePrincipalMesh(Principal=vectormesh.PrincipleDirection2, Location=popgeo)
vdisex_3 = VectorDisplayEx(Point=popgeo, Vector=expr("x/10", eval_3), Colour=RGB(255, 143, 212), Width=2)
vdisex_4 = VectorDisplayEx(Point=popgeo, Vector=expr("x/10", eval_4), Colour=RGB(82, 184, 59), Width=2)
