# Grasshopper definition 31LilyPad_Freeform Shell_KarambaStandard.gh (Grasshopper 1.0.8)
# plug-ins: Karamba3D, LilyPad

# Structure: Freeform Shell
# Analysis Input: Karamba 3D
# Field Generation Method: Displacement Field Method - Standard Order
# Step 1: Create Input Mesh
inputmesh = Mesh(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)
preview = CustomPreview(Geometry=inputmesh, Material=ColourSwatch(SwatchColor=RGB(97, 97, 97)))

# ---- group: create support pts
bbox = BoundingBox(Content=inputmesh, Plane=PlaneXY(0, 0, 0))  # -> Box, Box_2
debox = DeconstructBox(Box=bbox.Box)  # -> Plane, X, Y, Z
nv = NakedVertices(Mesh=inputmesh)  # -> ClothedIndex, NakedIndex, ClothedPts, NakedPts
dedomain = DeconstructDomain(Domain=debox.Z)  # -> Start, End
pdecon = Deconstruct(Point=nv.NakedPts)  # -> XComponent, YComponent, ZComponent
addition = Addition(A="0.01", B=dedomain.Start)
smaller = SmallerThan(FirstNumber=pdecon.ZComponent, SecondNumber=addition)  # -> SmallerThan, OrEqualTo
cull = CullPattern(List=nv.NakedPts, CullPattern=smaller.SmallerThan)
duppt = RemoveDuplicatePts(Points=cull, Tolerance=0.001)
supp = SupportKaramba3D(PosInd=duppt, Ct_kN_m=Vector(0, 0, 0), Cr_kNm_rad=Vector(0, 0, 0), menu=[buttons(on, on, on, off, off, on)])

# ---- group: Step 2:Create Nodal Translation For Mesh Node
# Step 2.0: Create Deformation Results
# we're using karamba to generate the deformation results in this case
matselect = MaterialSelectionKaramba3D(menu=[dropdown(1), dropdown(0)])
Z = UnitZ(Factor="-1")
crosec = CrossSectionKaramba3D(FamilyNameOfCrossSection="DefaultCroSec", NameOfCrossSection=matselect, Height_cm="1", mode="Shell - Const")
loads = LoadsKaramba3D(Vector=Z, Mesh=inputmesh, LCase="LC0", mode="MeshLoad -Const.", menu=[buttons(off, on, off), buttons(on, on)])
surfelem = CreateSurfaceElementKaramba3D(Mesh=inputmesh, CrossSection=crosec, LimitDistance_m=0.005, Bending=True, mode="MeshToShell")  # -> Element, Points, Info
assemble = AssembleModelKaramba3D(Elem=surfelem.Element, Support=supp, Load=loads, LimitDistance_m=0.005)  # -> Model, Info, Mass_kg, CentreOfGravity, LoadCaseNames
license = LicenseKaramba3D()
panel = Panel(license)
analyse = AnalyseKaramba3D(Model=assemble.Model)  # -> AnalysedModel, MaximumDisplacement_cm, ResultingForce_kN, ChangeOfElasticEnergy_kNm
modelview = ModelViewKaramba3D(Model=analyse.AnalysedModel)  # -> Model, DeformedMesh, DeformedAxes, DeformedModel, MaximumDeformation
demesh = DeconstructMesh(Mesh=inputmesh)  # -> Vertices, Faces, Colours, Normals
shellview = ShellViewKaramba3D(Model=modelview.Model, IndexOfLayer=0)  # -> Model, MeshesOfRenderedShells, LegendColours, LegendTags
nodedisp = NodalDisplacementsKaramba3D(AnalysedModel=analyse.AnalysedModel, PositionsIndexes=demesh.Vertices)  # -> Model, flatten(NodalTranslations_m), flatten(NodalRotations_rad), DisplacementPosition, LoadCaseIndex
legend = Legend(Colour=shellview.LegendColours, Tags=shellview.LegendTags, LegendType=1)

# ---- group: Vector Field
# connect the deformation results if they are avaliable
displacements = Data([Vector(-4.407619488e-06, -4.233689695e-05, -2.612079899e-05), Vector(2.479066082e-07, -8.141420331e-06, -7.208402611e-06), Vector(-1.084005953e-05, -3.932911366e-06, -1.286583325e-05), Vector(-4.612577183e-06, -3.975515743e-05, -2.369796624e-05), Vector(-3.223096661e-06, -3.481404045e-05, -2.038925266e-05), Vector(-1.264387765e-06, -3.149257372e-05, -1.776143561e-05)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])
rotations = Data([Vector(3.075030193e-05, -5.306109149e-05, 5.909616278e-05), Vector(0.0001772173958, -2.444715481e-06, 5.299353717e-06), Vector(-2.291440762e-05, 1.607973354e-05, 2.90212013e-05), Vector(3.354526708e-05, -2.802332622e-05, 3.005371952e-05), Vector(4.331411154e-06, -4.651480539e-05, 6.324610816e-05), Vector(-1.101586713e-05, -7.398610052e-05, 9.987226132e-05)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])

# ----
# Step 3: Create Principle Mesh
list = ValueList({"Bending Stress Lines": True, "In-Plane Stress Lines": False}, selected="In-Plane Stress Lines")
poisson_s_ratio = Panel("0.3")
defmesh = CreateDeformationMesh(Mesh=inputmesh, Translations=displacements, Rotations=rotations, PoissonsRatio=poisson_s_ratio, BendingStressLines=list)  # -> PrincipalDirection1, PrincipalDirection2

# ---- group: Step 4: Selecting Seed Point
# Step 4: Create a Seed Point
# This can be any point on the mesh
demesh_2 = DeconstructMesh(Mesh=inputmesh)  # -> Vertices, Faces, Colours, Normals
jitter = Jitter(List=demesh_2.Vertices, Jitter=1, Seed=2)  # -> Values, Indices
item = ListItem(List=jitter.Values, Index=Slider(492, range=0..1000), Wrap=True)
# Enable relays to run
# This may take a couple of minutes
dots = DotDisplay(Point=item, Colour=RGB(0, 0, 0), Size=0.1)

# ----
# Step 5.2: Produce Stress lines through a seeding
number_slider = Slider(-4, range=-10..0)
number_slider_2 = Slider(0.1, range=0.05..1)
number_slider_3 = Slider(0.3, range=0..10)
number_slider_4 = Slider(0.08, range=0..0.1)
_10º = PowerOf10(Value=number_slider)
sls = StressLines(
    PrincipalMesh=defmesh.PrincipalDirection2,
    Seed=item,
    StepTolerance=number_slider_2,
    MaxError=_10º,
    Seperation=number_slider_3,
    TestDist=number_slider_4)
sls_2 = StressLines(
    PrincipalMesh=defmesh.PrincipalDirection1,
    Seed=item,
    StepTolerance=number_slider_2,
    MaxError=_10º,
    Seperation=number_slider_3,
    TestDist=number_slider_4)
preview_2 = CustomPreview(Geometry=sls, Material=ColourSwatch(SwatchColor=RGB(255, 143, 212)))
preview_3 = CustomPreview(Geometry=sls_2, Material=ColourSwatch(SwatchColor=RGB(82, 184, 59)))

# ----
# Step 5.1: Produce Stress lines one at a time
number_slider_5 = Slider(-4, range=-10..0)
_10º_2 = PowerOf10(Value=number_slider_5)
stress_line = StressLine(PrincipalMesh=defmesh.PrincipalDirection1, Seed=item, StepTolerance="0.1", MaxError=_10º_2)
stress_line_2 = StressLine(PrincipalMesh=defmesh.PrincipalDirection2, Seed=item, StepTolerance="0.1", MaxError=_10º_2)
preview_4 = CustomPreview(
    Geometry=stress_line_2,
    Material={diffuse=RGB(13, 201, 0), emission=RGB(4, 60, 0), shine=0.5, specular=RGB(255, 255, 255), transparency=0})
preview_5 = CustomPreview(
    Geometry=stress_line,
    Material={diffuse=RGB(13, 201, 0), emission=RGB(4, 60, 0), shine=0.5, specular=RGB(255, 255, 255), transparency=0})

# ----
# Step 5.0: Check Principle Directions
popgeo = PopulateGeometry(Geometry=inputmesh, Count=100, Seed=1)
# Results
eval = EvaluatePrincipalMesh(Principal=defmesh.PrincipalDirection1, Location=popgeo)
eval_2 = EvaluatePrincipalMesh(Principal=defmesh.PrincipalDirection2, Location=popgeo)
vdisex = VectorDisplayEx(Point=popgeo, Vector=expr("x/10", eval), Colour=RGB(255, 143, 212), Width=2)
vdisex_2 = VectorDisplayEx(Point=popgeo, Vector=expr("x/10", eval_2), Colour=RGB(82, 184, 59), Width=2)
