# Grasshopper definition Minishell_6 node tri.gh (Grasshopper 1.0.8)
# plug-ins: Karamba3D, CORE.Toolbox.Grasshopper, MeshEdit Components, treesloth01, Pufferfish, Human, Kangaroo Components, GSA, Weaverbird, LilyPad, HDTTreeUtils

number_slider = Slider(1, range=1..3)
number_slider_2 = Slider(1, range=1..3)
mesh = Mesh(<mesh referenced from the Rhino model>)
toggle = BooleanToggle(True)
mesh_2 = Mesh(mesh)
qrsettings = QuadRemeshSettings(
    TargetCount=Slider(3000, range=0..10000),
    AdaptiveSize=0,
    AdaptiveCount=False,
    HardEdges=False,
    SeamEdges=0,
    Symmetry=0,
    GuideCurves=0)
qrmesh = QuadRemesh(Geometry=mesh, Settings=qrsettings)
triremesh = TriRemesh(Geometry=qrmesh, Length=Slider(0.15, range=0..1), Iterations=25)  # -> Triangulation, Dual, Creases
wbfacepolys = WeaverbirdsFacePolylines(Mesh=triremesh.Triangulation)
disc = Discontinuity(Curve=wbfacepolys, Level=1)  # -> Points, Parameters
shatter = Shatter(Curve=graft(wbfacepolys), Parameters=disc.Parameters)
midpt = CurveMiddle(Curve=shatter)
merge = Merge(Data1=simplify(disc.Points), Data2=simplify(midpt))
duppt = RemoveDuplicatePts(Points=flatten(merge), Tolerance=0.001)
cp = ClosestPoint(Point=graft(disc.Points), Cloud=duppt)  # -> ClosestPoint, CPIndex, Distance
shift = ShiftPaths(Data=cp.CPIndex, Offset=-1)  # -> simplify(Data)
item = ListItem(List=shift, Index=0, Wrap=True)  # -> Item, Item1, Item2
triangle = MeshTriangle(CornerA=item.Item, CornerB=item.Item1, CornerC=item.Item2)
conmesh = ConstructMesh(Vertices=duppt, Faces=flatten(triangle))

number_slider_3 = Slider(1, range=1..3)
number_slider_4 = Slider(1, range=1..3)
mesh_3 = Mesh(<mesh referenced from the Rhino model>)
toggle_2 = BooleanToggle(True)
mesh_4 = Mesh(mesh_3)
qrsettings_2 = QuadRemeshSettings(
    TargetCount=Slider(3000, range=0..10000),
    AdaptiveSize=0,
    AdaptiveCount=False,
    HardEdges=False,
    SeamEdges=0,
    Symmetry=0,
    GuideCurves=0)
qrmesh_2 = QuadRemesh(Geometry=mesh_3, Settings=qrsettings_2)
triremesh_2 = TriRemesh(Geometry=qrmesh_2, Length=Slider(0.15, range=0..1), Iterations=25)  # -> Triangulation, Dual, Creases
pa = PlanarityAnalysis(Mesh=qrmesh_2, Max=Slider(0.057, range=0..1))  # -> M, P
tri = Triangulate(Mesh=pa.M)  # -> Mesh, Count
mesh_5 = Mesh(triremesh_2.Triangulation)
clean = CombineClean(Meshes=mesh_5)
wbfacepolys_2 = WeaverbirdsFacePolylines(Mesh=triremesh_2.Triangulation)
tri_2 = Triangulate(Mesh=clean)  # -> Mesh, Count
disc_2 = Discontinuity(Curve=wbfacepolys_2, Level=1)  # -> Points, Parameters
shatter_2 = Shatter(Curve=graft(wbfacepolys_2), Parameters=disc_2.Parameters)
nv = NakedVertices(Mesh=clean)  # -> ClothedIndex, NakedIndex, ClothedPts, NakedPts
midpt_2 = CurveMiddle(Curve=shatter_2)
merge_2 = Merge(Data1=simplify(disc_2.Points), Data2=simplify(midpt_2))
pdecon = Deconstruct(Point=nv.NakedPts)  # -> XComponent, YComponent, ZComponent
duppt_2 = RemoveDuplicatePts(Points=flatten(merge_2), Tolerance=0.001)
roundd = RoundToDecimalPlace(NumberX=pdecon.ZComponent, DecimalPlace=Slider(2, range=0..10), RoundType=0)  # -> Rounded, Difference
cp_2 = ClosestPoint(Point=graft(disc_2.Points), Cloud=duppt_2)  # -> ClosestPoint, CPIndex, Distance
cset = CreateSet(List=roundd.Rounded)  # -> Set, Map
number_slider_5 = Slider(0, range=0..1)
shift_2 = ShiftPaths(Data=cp_2.CPIndex, Offset=-1)  # -> simplify(Data)
assign_paths = AssignPaths(InputData=flatten(nv.NakedPts), PathsToAssign=flatten(cset.Map))
item_2 = ListItem(List=duppt_2, Index=shift_2, Wrap=True)
branch = BranchByIndex(Tree=assign_paths, Branch=Slider(2, range=0..100))
item_3 = ListItem(List=shift_2, Index=0, Wrap=True)  # -> Item, Item1, Item2
panel = Panel(item_3.Item)
triangle_2 = MeshTriangle(CornerA=item_3.Item, CornerB=item_3.Item1, CornerC=item_3.Item2)
conmesh_2 = ConstructMesh(Vertices=duppt_2, Faces=flatten(triangle_2))

# ----
# Structure: Free Form Shell Structure
# Analysis Input: Data/Oasys GSA
# Field Generation Method: Displacement Field Method (Higher Order)
panel_2 = Panel("C:\Users\glformat\Documents\GitHub\PrincipalStressLines\Testing Files\Crappershell01.gwb")
panel_3 = Panel("C:\Users\glformat\Documents\GitHub\PrincipalStressLines\Testing Files\Minishell01.gwb")

# ---- group: Step 0: Read GSA Analysis Results
# Input Analysis Model Results (Optional)
open = OpenModel(FilenameAndPath=panel_3)
getanalysis = GetModelAnalysis(GSAModel=open)  # -> AnalysisTasks, AnalysisCases, CombinationCases, DesignTasks
panel_4 = Panel(getanalysis.AnalysisCases)
getres = GetResult(GSAModel=open, T="A", Case=1)
getgeo = GetModelGeometry(GSAModel=open, Mode=1, Unit="m")  # -> NodesIn_m, _1DElementsIn_m, _2DElementsIn_m, _3DElementsIn_m, _1DMembersIn_m, _2DMembersIn_m, _3DMembersIn_m, Assemblies
nodedisp = NodeDisplacements(Result=getres, Max_Min="All", Unit="mm")  # -> TranslationsX_mm, TranslationsY_mm, TranslationsZ_mm, TranslationsXYZ_mm, RotationXX_rad, RotationYY_rad, RotationZZ_rad, RotationXYZ_rad, NodeIDs
nodeedit = EditNode(Node=getgeo.NodesIn_m, Mode=1)  # -> Node, NodeNumber, NodePosition, NodeLocalAxis, NodeRestraints, DamperProperty, MassProperty, SpringProperty, NodeName, NodeColour
elem2dedit = Edit2DElement(Element2D=getgeo._2DElementsIn_m, Preview3dSection=False)  # -> Element2D, Number, Geometry, _2DProperty, Group, ElementType, Offset, OrientationAngle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
num = Number(nodedisp.TranslationsX_mm)
num_2 = Number(nodedisp.TranslationsY_mm)
num_3 = Number(nodedisp.TranslationsZ_mm)
subtraction = Subtraction(A=elem2dedit.Topology, B=1)
vec = VectorXYZ(XComponent=num, YComponent=num_2, ZComponent=num_3)  # -> Vector, Length
int = Integer(nodeedit.NodeNumber)
int_2 = Integer(elem2dedit.Topology)
int_3 = Integer(subtraction)
mindex = MemberIndex(Set=int, Member=int_2)  # -> Index, Count
shift_3 = ShiftPaths(Data=mindex.Index, Offset=-1)
displacement_vectors = Vector(vec.Vector)
element_node_ids = Number(simplify(shift_3))
node_locations = Point(nodeedit.NodePosition)

# ----
pline = PolyLine(Closed=False)
wbtriangles = WeaverbirdsSplitTrianglesSubdivision(MeshCurves=triremesh.Triangulation, Level=Slider(2, range=0..10))

nv_2 = NakedVertices(Mesh=wbtriangles)  # -> ClothedIndex, NakedIndex, ClothedPts, NakedPts
pdecon_2 = Deconstruct(Point=nv_2.NakedPts)  # -> XComponent, YComponent, ZComponent
roundd_2 = RoundToDecimalPlace(NumberX=pdecon_2.ZComponent, DecimalPlace=Slider(2, range=0..10), RoundType=0)  # -> Rounded, Difference
cset_2 = CreateSet(List=roundd_2.Rounded)  # -> Set, Map
assign_paths_2 = AssignPaths(InputData=flatten(nv_2.NakedPts), PathsToAssign=flatten(cset_2.Map))
branch_2 = BranchByIndex(Tree=assign_paths_2, Branch=Slider(0, range=0..1))
duppt_3 = RemoveDuplicatePts(Points=branch_2, Tolerance=0.001)

mat = CreateMaterial(Material_type="Steel", Design_Code="EN 1993-1-1:2005", Grade="S355")
explode = MeshExplode(Mesh=conmesh_2, Interpolate=False)
demesh = DeconstructMesh(Mesh=conmesh_2)  # -> Vertices, Faces, Colours, Normals
# Connecting the input if GSA data is avaliable; otherwise remain unconnected.
element_node_ids_2 = Number(simplify(element_node_ids))

# ---- group: Step 1: FEA Data Import
displacement_vectors_2 = Vector(displacement_vectors)
node_locations_2 = Point(node_locations)

# ----
prop2d = Create2DProperty(Thickness_cm="2", Material=mat, Type="Shell", Unit="cm")
support = CreateSupport(Point=branch, Plane=PlaneXY(0, 0, 0), x=True, xx=False, y=True, yy=False, z=True, zz=False)
σa = CreateAnalysisCase(Name="2L1", Description="2L1")
panel_5 = Panel(node_locations_2)
elem2d = Create2DElement(Geometry=conmesh_2, Property2D=prop2d, Preview3dSection=False)
support_2 = CreateSupport(Point=demesh.Vertices, Plane=PlaneXY(0, 0, 0), x=False, xx=False, y=False, yy=False, z=False, zz=False)
σt = CreateAnalysisTask(AnalysisCases=σa, casesParamIndex=2, Solver="Static")
gravityload = CreateGravityLoad(LoadCase="1", LoadableObjects=elem2d, GravityFactor=Vector(0, 0, -1))

number_slider_6 = Slider(1, range=0..1)
matselect = MaterialSelectionKaramba3D(menu=[dropdown(1), dropdown(1), dropdown(3)])
crosec = CrossSectionKaramba3D(FamilyNameOfCrossSection="DefaultCroSec", Material=matselect, Height_cm=Slider(2, range=0..10), mode="Shell - Const")
pt = ConstructPoint(XCoordinate=0, YCoordinate=0, ZCoordinate="-15")
supp = SupportKaramba3D(PosInd=duppt_3, Ct_kN_m=Vector(0, 0, 0), Cr_kNm_rad=Vector(0, 0, 0), menu=[buttons(on, on, on, off, off, off)])
loads = LoadsKaramba3D(Vector=pt, LCase="DL", mode="Gravity")
surfelem = CreateSurfaceElementKaramba3D(Mesh=wbtriangles, CrossSection=crosec, LimitDistance_m=Slider(0.001, range=0..0.001), Bending=True, mode="MeshToShell")  # -> Element, Points, Info
panel_6 = Panel(surfelem.Element)
assemble = AssembleModelKaramba3D(
    Elem=flatten(surfelem.Element),
    Support=flatten(supp),
    Load=flatten(loads),
    LimitDistance_m=Slider(0.001, range=0..0.001))  # -> Model, Info, Mass_kg, CentreOfGravity, LoadCaseNames
resultselect = ResultSelectorKaramba3D(
    Model=assemble.Model,
    menu=[buttons(on, on), dropdown(0), dropdown(0), buttons(off, off, off, off, off, off, off), buttons(off, off, off, off, off, off), buttons(off, off, off, off, off, off, off, off), buttons(off, off, off, off, off, off, off, off)])  # -> Model, LoadCaseSelection
analyse = AnalyseKaramba3D(Model=assemble.Model)  # -> AnalysedModel, MaximumDisplacement_cm, ResultingForce_kN, ChangeOfElasticEnergy_kNm
nodedisp_2 = NodalDisplacementsKaramba3D(AnalysedModel=analyse.AnalysedModel, LoadCaseCombination=resultselect.LoadCaseSelection)  # -> Model, flatten(NodalTranslations_m), NodalRotations_rad, DisplacementPosition, LoadCaseIndex
demesh_2 = DeconstructMesh(Mesh=conmesh)  # -> Vertices, Faces, Colours, Normals
preview = CustomPreview(Geometry=conmesh, Material=ColourSwatch(SwatchColor=RGBA(158, 158, 158, 104)))
cp_3 = ClosestPoint(Point=graft(demesh_2.Vertices), Cloud=nodedisp_2.DisplacementPosition)  # -> ClosestPoint, CPIndex, Distance
item_4 = ListItem(List=nodedisp_2.NodalTranslations_m, Index=cp_3.CPIndex, Wrap=True)

# ---- group: Step 2.1: Select Corner Vetices (0,2,7,5) For Mesh Quads
tstat = TreeStatistics(Tree=element_node_ids_2)  # -> Paths, Length, Count
item_5 = ListItem(List=tstat.Paths, Index=0, Wrap=True)
split = SplitTree(Data=element_node_ids_2, Masks=flatten(item_5))  # -> Positive, Negative
item_6 = ListItem(List=node_locations_2, Index=split.Positive, Wrap=True)
pline_2 = PolyLine(Vertices=item_6, Closed=True)
previewlw = CustomPreviewLineweights(Geometry=pline_2, Shader=ColourSwatch(SwatchColor=RGB(0, 0, 0)), Thickness=4, Absolute=False)
points = PointList(Points=item_6, Size=0.03)

# ----
model = CreateModel(
    GSAGeometryIn_m=flatten([support, elem2d, support_2]),
    Load=gravityload,
    AnalysisTasksCombinations=flatten(σt),
    ReMesh=True,
    Tolerance=0.001,
    Unit="m")  # disabled
panel_7 = Panel("C:\Users\glformat\Documents\GitHub\PrincipalStressLines\Testing Files\Minishell01.gwb")  # disabled
panel_8 = Panel("C:\Users\glformat\Documents\GitHub\PrincipalStressLines\Testing Files\Crappershell01.gwb")  # disabled
save = Button()  # disabled
save_2 = SaveGSAModel(GSAModel=model, Save=True, FileAndPath=panel_7)  # disabled

# ---- group: Step 3.1: Create Deformation Mesh(Generating vector fields)
# Create Principle Mesh
demesh_3 = DeconstructMesh(Mesh=wbtriangles)  # -> Vertices, Faces, Colours, Normals
panel_9 = Panel("""True - Bending Stress Lines
False - In-plane Stress Lines""")
nodedisp_3 = NodalDisplacementsKaramba3D(AnalysedModel=nodedisp_2.Model, PositionsIndexes=demesh_3.Vertices)  # -> Model, flatten(NodalTranslations_m), flatten(NodalRotations_rad), DisplacementPosition, LoadCaseIndex
list = ItemSelector(panel_9, {"True - Bending Stress Lines", "False - In-plane Stress Lines"}, selected="False - In-plane Stress Lines")
cluster = Cluster(T=list)
facen = FaceNormals(Mesh=wbtriangles)  # -> Centers, Normals
defmesh = CreateDeformationMesh(
    Mesh=wbtriangles,
    Translations=nodedisp_3.NodalTranslations_m,
    Rotations=nodedisp_3.NodalRotations_rad,
    PoissonsRatio="0.3",
    BendingStressLines=cluster)  # -> PrincipalDirection1, PrincipalDirection2
eval = EvaluatePrincipalMesh(Principal=defmesh.PrincipalDirection1, Location=facen.Centers)
eval_2 = EvaluatePrincipalMesh(Principal=defmesh.PrincipalDirection2, Location=facen.Centers)
vdisex = VectorDisplayEx(Point=facen.Centers, Vector=expr("x/10", eval_2), Colour=RGB(255, 143, 212), Width=2)
vdisex_2 = VectorDisplayEx(Point=facen.Centers, Vector=expr("x/10", eval), Colour=RGB(82, 184, 59), Width=2)

# ---- group: Step 4: Selecting Seed Point
cullvertices = MeshCullUnusedVertices(Mesh=conmesh)
demesh_4 = DeconstructMesh(Mesh=cullvertices)  # -> Vertices, Faces, Colours, Normals
selecting_seed_point = Slider(607, range=0..2602)
item_7 = ListItem(List=demesh_4.Vertices, Index=selecting_seed_point, Wrap=True)
dots = DotDisplay(Point=item_7, Colour=RGB(0, 0, 0), Size=0.1)
seed_point = Point(item_7)

# ---- group: Step 3: Create Deformation Mesh
panel_10 = Panel("""True - Bending Stress Lines
False - In-plane Stress Lines""")
list_2 = ItemSelector(panel_10, {"True - Bending Stress Lines", "False - In-plane Stress Lines"}, selected="False - In-plane Stress Lines")
cluster_2 = Cluster(T=list_2)
defmeshhigh = CreateDeformationMeshHigher(
    Mesh=flatten(conmesh),
    Translations=flatten(item_4),
    Rotations=Vector(0, 0, 0),
    PoissonsRatio="0.15",
    BendingStressLines=cluster_2)  # -> PrincipalDirection1, PrincipalDirection2

# ---- group: Step 3.0: Input Mesh Topo Check
demesh_5 = DeconstructMesh(Mesh=wbtriangles)  # -> Vertices, Faces, Colours, Normals
deface = DeconstructFace(Face=graft(demesh_5.Faces))  # -> CornerA, CornerB, CornerC, CornerD
merge_3 = Merge(Data1=deface.CornerA, Data2=deface.CornerB, Data3=deface.CornerC, Data4=deface.CornerD)  # -> simplify(Result)
tstat_2 = TreeStatistics(Tree=merge_3)  # -> Paths, Length, Count
item_8 = ListItem(List=tstat_2.Paths, Index=0, Wrap=True)
split_2 = SplitTree(Data=merge_3, Masks=flatten(item_8))  # -> Positive, Negative
cset_3 = CreateSet(List=split_2.Positive)  # -> Set, Map
item_9 = ListItem(List=demesh_5.Vertices, Index=cset_3.Set, Wrap=True)
pline_3 = PolyLine(Vertices=item_9, Closed=True)
points_2 = PointList(Points=item_9, Size=0.05)
previewlw_2 = CustomPreviewLineweights(Geometry=pline_3, Shader=ColourSwatch(SwatchColor=RGB(0, 0, 0)), Thickness=4, Absolute=False)

# ----
preview_2 = CustomPreview(Geometry=conmesh, Material=ColourSwatch(SwatchColor=RGBA(158, 158, 158, 104)))

# ---- group: Vector Field
v1 = Data(eval)
# Input the principle stress fields that is avaliable
v2 = Data(eval_2)

# ---- group: Step 3.2: Vector Mesh (Smoothing vectors for stressline generation)
# Smoothing Radius: Vectors adjusted being the average within the radius distance
smoothing_radius = Panel("0.2")
vectormesh = CreateVectorMesh(Mesh=wbtriangles, Vectors1st=v1, Vectors2nd=v2, Radius=smoothing_radius)  # -> PrincipleDirection1, PrincipleDirection2

# ---- group: Step 5: Create Evenly Spaced Stress Lines
# Evenly Spaced Stress Lines
number_slider_7 = Slider(-4, range=-10..0)
number_slider_8 = Slider(0.1, range=0..1)
number_slider_9 = Slider(0.05, range=0..0.1)
number_slider_10 = Slider(0.1, range=0..1)
_10º = PowerOf10(Value=number_slider_7)
sls = StressLines(
    PrincipalMesh=defmeshhigh.PrincipalDirection2,
    Seed=seed_point,
    StepTolerance=number_slider_8,
    MaxError=_10º,
    Seperation=number_slider_10,
    TestDist=number_slider_9)
sls_2 = StressLines(
    PrincipalMesh=defmeshhigh.PrincipalDirection1,
    Seed=seed_point,
    StepTolerance=number_slider_8,
    MaxError=_10º,
    Seperation=number_slider_10,
    TestDist=number_slider_9)
previewlw_3 = CustomPreviewLineweights(Geometry=sls_2, Shader=ColourSwatch(SwatchColor=RGB(82, 184, 59)), Thickness=2, Absolute=False)
previewlw_4 = CustomPreviewLineweights(Geometry=sls, Shader=ColourSwatch(SwatchColor=RGB(255, 143, 212)), Thickness=2, Absolute=False)

# ---- group: Step 5: Create A Stressline_P2
# Single Stress Line
number_slider_11 = Slider(0.364, range=0..1)
_10º_2 = PowerOf10(Value=Slider(-6, range=-10..0))
stress_line = StressLine(PrincipalMesh=defmeshhigh.PrincipalDirection2, Seed=seed_point, StepTolerance=number_slider_11, MaxError=_10º_2)
preview_3 = CustomPreview(
    Geometry=stress_line,
    Material={diffuse=RGB(255, 143, 212), emission=RGB(76, 43, 64), shine=0.5, specular=RGB(255, 255, 255), transparency=0})

# ---- group: Step 5: Create A Stressline_P1
# Single Stress Line
number_slider_12 = Slider(-4, range=-10..0)
_10º_3 = PowerOf10(Value=number_slider_12)
stress_line_2 = StressLine(PrincipalMesh=defmeshhigh.PrincipalDirection1, Seed=seed_point, StepTolerance=Slider(0.02, range=0..1), MaxError=_10º_3)
preview_4 = CustomPreview(
    Geometry=stress_line_2,
    Material={diffuse=RGB(82, 184, 59), emission=RGB(25, 55, 18), shine=0.5, specular=RGB(255, 255, 255), transparency=0})

# ---- group: Step 5: Evaluate Principle Mesh
# Evaluation
eval_3 = EvaluatePrincipalMesh(Principal=defmeshhigh.PrincipalDirection2, Location=seed_point)
# Results
eval_4 = EvaluatePrincipalMesh(Principal=defmeshhigh.PrincipalDirection1, Location=seed_point)
vdisex_3 = VectorDisplayEx(Point=seed_point, Vector=eval_3, Colour=RGB(255, 143, 212), Width=2)
vdisex_4 = VectorDisplayEx(Point=seed_point, Vector=eval_4, Colour=RGB(82, 184, 59), Width=2)

# ----
sph = Sphere(Base=seed_point, Radius=smoothing_radius)

# ---- group: Step 5: Create Evenly Spaced Stress Lines
# Evenly Spaced Stress Lines
number_slider_13 = Slider(-5, range=-10..0)
number_slider_14 = Slider(0.1, range=0..1)
number_slider_15 = Slider(0.1, range=0..1)
number_slider_16 = Slider(0.05, range=0..0.1)
_10º_4 = PowerOf10(Value=number_slider_13)
number_slider_17 = Slider(2, range=1..5)
sls_3 = StressLines(
    PrincipalMesh=vectormesh.PrincipleDirection2,
    Seed=seed_point,
    StepTolerance=number_slider_14,
    MaxError=_10º_4,
    Seperation=number_slider_15,
    TestDist=number_slider_16)
sls_4 = StressLines(
    PrincipalMesh=vectormesh.PrincipleDirection1,
    Seed=seed_point,
    StepTolerance=number_slider_14,
    MaxError=_10º_4,
    Seperation=number_slider_15,
    TestDist=number_slider_16)
previewlw_5 = CustomPreviewLineweights(Geometry=sls_4, Shader=ColourSwatch(SwatchColor=RGB(82, 184, 59)), Thickness=number_slider_17, Absolute=False)
previewlw_6 = CustomPreviewLineweights(Geometry=sls_3, Shader=ColourSwatch(SwatchColor=RGB(255, 143, 212)), Thickness=number_slider_17, Absolute=False)

# ---- group: Step 5: Create A Stressline_P1
# Single Stress Line
number_slider_18 = Slider(-4, range=-10..0)
_10º_5 = PowerOf10(Value=number_slider_18)
stress_line_3 = StressLine(PrincipalMesh=vectormesh.PrincipleDirection1, Seed=seed_point, StepTolerance="0.2", MaxError=_10º_5)
stress_line_4 = StressLine(PrincipalMesh=vectormesh.PrincipleDirection2, Seed=seed_point, StepTolerance="0.2", MaxError=_10º_5)
preview_5 = CustomPreview(
    Geometry=stress_line_3,
    Material={diffuse=RGB(13, 201, 0), emission=RGB(4, 60, 0), shine=0.5, specular=RGB(255, 255, 255), transparency=0})
preview_6 = CustomPreview(
    Geometry=stress_line_4,
    Material={diffuse=RGB(13, 201, 0), emission=RGB(4, 60, 0), shine=0.5, specular=RGB(255, 255, 255), transparency=0})

# ---- group: Step 5: Evaluate Principle Mesh
# Vectors
eval_5 = EvaluatePrincipalMesh(Principal=vectormesh.PrincipleDirection2, Location=seed_point)
# Results
eval_6 = EvaluatePrincipalMesh(Principal=vectormesh.PrincipleDirection1, Location=seed_point)
vdisex_5 = VectorDisplayEx(Point=seed_point, Vector=eval_5, Colour=RGB(255, 143, 212), Width=2)
vdisex_6 = VectorDisplayEx(Point=seed_point, Vector=eval_6, Colour=RGB(82, 184, 59), Width=2)

# ---- group: Step 2.2: Construct Input Mesh
item_10 = ListItem(List=element_node_ids_2, Index=0, Wrap=True)  # -> Item, Item1, Item2, Item3, Item4, Item5, Item6, Item7

# ----
triangle_3 = MeshTriangle(CornerA=item_10.Item, CornerB=item_10.Item1, CornerC=item_10.Item2)

# ---- group: Step 2.2: Construct Input Mesh (continued)
conmesh_3 = ConstructMesh(Vertices=node_locations_2, Faces=flatten(triangle_3))

# ---- group: Step 3: Create Deformation Mesh
panel_11 = Panel("""True - Bending Stress Lines
False - In-plane Stress Lines""")
list_3 = ItemSelector(panel_11, {"True - Bending Stress Lines", "False - In-plane Stress Lines"}, selected="False - In-plane Stress Lines")
# Note On Vector Field Generation: Principle Vector Field(P1/P2) is generated for either Bending stress lines or In-plane stress lines
# Bending stress lines - rotational input is required - i.e.slab structure/dome structure
# In-plane stress lines - translational input is required - i.e.shear wall structure
cluster_3 = Cluster(T=list_3)
defmeshhigh_2 = CreateDeformationMeshHigher(
    Mesh=conmesh_3,
    Translations=displacement_vectors_2,
    Rotations=Vector(0, 0, 0),
    PoissonsRatio="0.15",
    BendingStressLines=cluster_3)  # -> PrincipalDirection1, PrincipalDirection2

# ---- group: Step 4: Selecting Seed Point
cullvertices_2 = MeshCullUnusedVertices(Mesh=conmesh_3)
demesh_6 = DeconstructMesh(Mesh=cullvertices_2)  # -> Vertices, Faces, Colours, Normals
selecting_seed_point_2 = Slider(607, range=0..2602)
item_11 = ListItem(List=demesh_6.Vertices, Index=selecting_seed_point_2, Wrap=True)
dots_2 = DotDisplay(Point=item_11, Colour=RGB(0, 0, 0), Size=0.1)
seed_point_2 = Point(item_11)

# ----
# Setup
swatch = ColourSwatch(SwatchColor=RGBA(158, 158, 158, 104))
preview_7 = CustomPreview(Geometry=conmesh_3, Material=swatch)

# ---- group: Step 5: Create Evenly Spaced Stress Lines
# Evenly Spaced Stress Lines
number_slider_19 = Slider(-4, range=-10..0)
number_slider_20 = Slider(0.1, range=0..1)
number_slider_21 = Slider(0.05, range=0..0.1)
number_slider_22 = Slider(0.1, range=0..1)
_10º_6 = PowerOf10(Value=number_slider_19)
sls_5 = StressLines(
    PrincipalMesh=defmeshhigh_2.PrincipalDirection2,
    Seed=seed_point_2,
    StepTolerance=number_slider_20,
    MaxError=_10º_6,
    Seperation=number_slider_22,
    TestDist=number_slider_21)
sls_6 = StressLines(
    PrincipalMesh=defmeshhigh_2.PrincipalDirection1,
    Seed=seed_point_2,
    StepTolerance=number_slider_20,
    MaxError=_10º_6,
    Seperation=number_slider_22,
    TestDist=number_slider_21)
previewlw_7 = CustomPreviewLineweights(Geometry=sls_6, Shader=ColourSwatch(SwatchColor=RGB(82, 184, 59)), Thickness=2, Absolute=False)
previewlw_8 = CustomPreviewLineweights(Geometry=sls_5, Shader=ColourSwatch(SwatchColor=RGB(255, 143, 212)), Thickness=2, Absolute=False)

# ---- group: Step 5: Create A Stressline_P2
# Single Stress Line
number_slider_23 = Slider(0.364, range=0..1)
_10º_7 = PowerOf10(Value=Slider(-6, range=-10..0))
stress_line_5 = StressLine(PrincipalMesh=defmeshhigh_2.PrincipalDirection2, Seed=seed_point_2, StepTolerance=number_slider_23, MaxError=_10º_7)
preview_8 = CustomPreview(
    Geometry=stress_line_5,
    Material={diffuse=RGB(255, 143, 212), emission=RGB(76, 43, 64), shine=0.5, specular=RGB(255, 255, 255), transparency=0})

# ---- group: Step 5: Create A Stressline_P1
# Single Stress Line
number_slider_24 = Slider(-4, range=-10..0)
_10º_8 = PowerOf10(Value=number_slider_24)
stress_line_6 = StressLine(
    PrincipalMesh=defmeshhigh_2.PrincipalDirection1,
    Seed=seed_point_2,
    StepTolerance=Slider(0.02, range=0..1),
    MaxError=_10º_8)
preview_9 = CustomPreview(
    Geometry=stress_line_6,
    Material={diffuse=RGB(82, 184, 59), emission=RGB(25, 55, 18), shine=0.5, specular=RGB(255, 255, 255), transparency=0})

# ---- group: Step 5: Evaluate Principle Mesh
# Evaluation
eval_7 = EvaluatePrincipalMesh(Principal=defmeshhigh_2.PrincipalDirection2, Location=seed_point_2)
# Results
eval_8 = EvaluatePrincipalMesh(Principal=defmeshhigh_2.PrincipalDirection1, Location=seed_point_2)
vdisex_7 = VectorDisplayEx(Point=seed_point_2, Vector=eval_7, Colour=RGB(255, 143, 212), Width=2)
vdisex_8 = VectorDisplayEx(Point=seed_point_2, Vector=eval_8, Colour=RGB(82, 184, 59), Width=2)

# ==== cluster Cluster
T = ClusterInput()
split = TextSplit(Text=T, Separators=" - ")
item = ListItem(List=split, Index=0, Wrap=True)  # -> flatten(Item)
bool = Boolean(item)
bool_2 = ClusterOutput(bool)
