# Grasshopper definition GSA Model Generation.gh (Grasshopper 1.0.8)
# plug-ins: RichedGraphMapper, GSA, Weaverbird

srf = Surface(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)
pt = Point(Point(0.6442296738, -3.087753168, 0))
crv = Curve([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])
triremesh = TriRemesh(Geometry=srf, Length="0.2", Iterations=25)  # -> Triangulation, Dual, Creases
demesh = DeconstructMesh(Mesh=triremesh.Triangulation)  # -> Vertices, Faces, Colours, Normals
medges = MeshEdges(Mesh=triremesh.Triangulation)  # -> NakedEdges, InteriorEdges, NonManifoldEdges
rec = Rectangle({Plane=PlaneXY(-1.104370152, 5.871407174, 0), Size=Domain2(u=-8.242935374..8.242935374, v=-8.242935374..8.242935374)})
pull = PullPoint(Point=demesh.Vertices, Geometry=[crv, pt], ClosestOnly=True)  # -> ClosestPoint, Distance, Index
mesh_uv = MeshSurface(Surface=rec, UCount="10", VCount="10", Overhang=True, Equalize=False)
demesh_2 = DeconstructMesh(Mesh=mesh_uv)  # -> Vertices, Faces, Colours, Normals
smaller = SmallerThan(FirstNumber=pull.Distance, SecondNumber=0.05)  # -> SmallerThan, OrEqualTo
Z = UnitZ(Factor=Slider(0.027, range=0..1))
load = Load(Point=demesh.Vertices, ForceVector=Z, Weighting=1)
edgelengths = EdgeLengths(Mesh=triremesh.Triangulation, LengthFactor=1, Strength=1)
pull_2 = PullPoint(Point=demesh_2.Vertices, Geometry=rec, ClosestOnly=True)  # -> ClosestPoint, Distance, Index
cull = CullPattern(List=demesh.Vertices, CullPattern=smaller.SmallerThan)
lng = ListLength(List=demesh_2.Vertices)
length_line = LengthLine(Line=medges.NakedEdges, Strength=10)
bnd = Bounds(Numbers=pull_2.Distance)
random = Random(Range=Domain(-1, 1), Number=lng, Seed=2)
series = Series(Start=0, Step=1, Count=10)
anchor = Anchor(Point=cull, Strength=10000)
series_2 = Series(Start=0, Step=1, Count=10)
rich_graph = RichGraphMapper(
    Values=pull_2.Distance,
    Source=bnd,
    Target=Domain(0, 1),
    Remap=False,
    x0=0,
    x1=8.242935374,
    y0=0,
    y1=1,
    Cx=0.4346313477,
    Cy=0.6542413831,
    container_name="Conic")
xz = XZPlane(Origin=Point(0, 0, 0))
pt_2 = ConstructPoint(XCoordinate=series, YCoordinate=0, ZCoordinate=0)
pt_3 = ConstructPoint(XCoordinate=series_2, YCoordinate=0, ZCoordinate=0)
multiplication = Multiplication(A=rich_graph, B=random)
xz_2 = XZPlane(Origin=Point(0, 0, 0))
rectangle = Rectangle(Plane=PlaneXY(0, 0, 0), XSize="-5 to 5", YSize="-5 to 5", Radius=0)  # -> Rectangle, Length
rectangle_2 = Rectangle(Plane=xz, XSize="-5 to 5", YSize="-5 to 5", Radius=0)  # -> Rectangle, Length
multiplication_2 = Multiplication(A="5", B=rich_graph)
show = Show(G=triremesh.Triangulation)
entwine = Entwine(Branch00=show, Branch01=anchor, Branch02=length_line, Branch03=edgelengths, Branch04=load, FlattenInputs=True)
yz = YZPlane(Origin=pt_2)
multiplication_3 = Multiplication(A=multiplication, B="2")
yz_2 = YZPlane(Origin=pt_3)
rectangle_3 = Rectangle(Plane=xz_2, XSize="-5 to 5", YSize="-5 to 5", Radius=0)  # -> Rectangle, Length
panel = Panel("25")
addition = Addition(A=multiplication_2, B=multiplication_3)
rectangle_4 = Rectangle(Plane=PlaneXY(0, 0, 0), XSize="-100 to 100", YSize="-100 to 100", Radius=0)  # -> Rectangle, Length
cir = Circle(Plane=yz, Radius="5")
cir_2 = Circle(Plane=yz_2, Radius="5")
Z_2 = UnitZ(Factor=addition)
solver = Solver(GoalObjects=entwine, Reset=Button(), Threshold=1e-15, Tolerance=0.0001, On=True)  # -> I, V, O
mesh_uv_2 = MeshSurface(Surface=rectangle.Rectangle, UCount="50", VCount="50", Overhang=True, Equalize=False)
mesh_uv_3 = MeshSurface(Surface=rectangle_2.Rectangle, UCount="50", VCount="50", Overhang=True, Equalize=False)
move = Move(Geometry=demesh_2.Vertices, Motion=Z_2)  # -> Geometry, Transform
split = SplitWithBrep(Curve=cir_2, Brep=rectangle_4.Rectangle)  # -> Curve, Points
mesh_uv_4 = MeshSurface(Surface=rectangle_3.Rectangle, UCount="50", VCount="50", Overhang=True, Equalize=False)
bang = ExplodeTree(Data=solver.O)  # -> Branch0, Branch1
msphereex = MeshSphereEx(Base=PlaneXY(0, 0, 0), Radius="5", Count="30")
item = ListItem(List=split.Curve, Index=0, Wrap=True)  # -> flatten(Item)
conmesh = ConstructMesh(Vertices=move.Geometry, Faces=demesh_2.Faces)
md_slider = MDSlider(
    SliderMode=0,
    slider_value=Point(0.4565891173, 1, 0.5),
    x_domain=Domain(0, 1),
    y_domain=Domain(0.5, 1),
    z_domain=Domain(0, 1))
md_slider_2 = MDSlider(
    SliderMode=0,
    slider_value=Point(0.4992720441, 0.500380865, 0.5),
    x_domain=Domain(0, 1),
    y_domain=Domain(0, 1),
    z_domain=Domain(0, 1))
xy = XYPlane(Origin=Point(0, 0, 0))
sph = Sphere(Base=PlaneXY(0, 0, 0), Radius="5")
medges_2 = MeshEdges(Mesh=mesh_uv_3)  # -> NakedEdges, InteriorEdges, NonManifoldEdges
dam = DataDam(DataA=bang.Branch0, BufferDelay=10000000, BufferMode=0)
loft = Loft(Curves=item, Options={Adjust=False, Closed=False, LoftEnds=0, LoftSimp=0, LoftType=0, Rebuild=10, Refit=0.01})
wbcatmullclark = WeaverbirdsCatmullClarkSubdivision(MeshCurves=conmesh, Level=1, SmoothNakedEdges=1)  # disabled
wbloop = WeaverbirdsLoopSubdivision(MeshCurves=conmesh, Level=3, SmoothNakedEdges=0)
msplit = MeshSplitPlane(Mesh=msphereex, Plane=xy)  # -> Above, Below
join = JoinCurves(Curves=medges_2.NakedEdges, Preserve=False)
quad = Quadrangulate(Mesh=msplit.Above, Angle=0.03490658504, Ratio=0.875)  # -> Mesh, Count
splitatcorners = SplitAtCorners(Poly=join, Angle=Slider(0.785, range=0..1))  # -> Corners, Parts
triremesh_2 = TriRemesh(Geometry=wbloop, Length="0.3", Iterations=25)  # -> Triangulation, Dual, Creases
mesh_uv_5 = MeshSurface(Surface=loft, UCount="50", VCount="50", Overhang=True, Equalize=False)
triremesh_3 = TriRemesh(Geometry=dam, Length="0.25", Iterations="100")  # -> Triangulation, Dual, Creases
evalsrf = EvaluateSurface(Surface=reparameterize(sph), Point=md_slider)  # -> Point, Normal, UDirection, VDirection, Frame
evalsrf_2 = EvaluateSurface(Surface=reparameterize(loft), Point=md_slider_2)  # -> Point, Normal, UDirection, VDirection, Frame
clean = CombineClean(Meshes=quad.Mesh)
item_2 = ListItem(List=splitatcorners.Parts, Index=2, Wrap=True)
mat = CreateMaterial(Material_type="Steel", Design_Code="EN 1993-1-1:2005", Grade="S355")
mat_2 = CreateMaterial(Material_type="Steel", Design_Code="EN 1993-1-1:2005", Grade="S355")
mesh = Mesh(clean)
number_slider = Slider(5, range=0..10)
demesh_3 = DeconstructMesh(Mesh=mesh)  # -> Vertices, Faces, Colours, Normals
demesh_4 = DeconstructMesh(Mesh=mesh_uv_5)  # -> Vertices, Faces, Colours, Normals
mat_3 = CreateMaterial(Material_type="Steel", Design_Code="EN 1993-1-1:2005", Grade="S355")
explode = Explode(Curve=item_2, Recursive=True)  # -> Segments, Vertices
demesh_5 = DeconstructMesh(Mesh=triremesh_2.Triangulation)  # -> Vertices, Faces, Colours, Normals
lng_2 = ListLength(List=demesh_3.Vertices)
explode_2 = Explode(Curve=rectangle.Rectangle, Recursive=True)  # -> Segments, Vertices
cp = ClosestPoint(Point=evalsrf_2.Point, Cloud=demesh_4.Vertices)  # -> ClosestPoint, CPIndex, Distance
explode_3 = Explode(Curve=rectangle_3.Rectangle, Recursive=True)  # -> Segments, Vertices
subtraction = Subtraction(A=lng_2, B=number_slider)
pdecon = Deconstruct(Point=demesh_5.Vertices)  # -> XComponent, YComponent, ZComponent
duppt = RemoveDuplicatePts(Points=explode_2.Vertices, Tolerance=0.01)
duppt_2 = RemoveDuplicatePts(Points=explode.Vertices, Tolerance=0.01)
prop2d = Create2DProperty(Thickness_cm="2", Material=mat, Type="Shell", Unit="cm")
cps = ClosestPoints(Point=evalsrf.Point, Cloud=demesh_3.Vertices, Count=number_slider)  # -> ClosestPoint, CPIndex, Distance
cps_2 = ClosestPoints(Point=evalsrf_2.Point, Cloud=demesh_4.Vertices, Count=Slider(5, range=0..10))  # -> ClosestPoint, CPIndex, Distance
item_3 = ListItem(List=splitatcorners.Parts, Index=0, Wrap=True)
prop2d_2 = Create2DProperty(Thickness_cm="2", Material=mat_2, Type="Shell", Unit="cm")
smaller_2 = SmallerThan(FirstNumber=pdecon.ZComponent, SecondNumber=0.01)  # -> SmallerThan, OrEqualTo
loadcase = CreateLoadCase(CaseID="1", Name="DL", Type="Dead")
duppt_3 = RemoveDuplicatePts(Points=explode_3.Vertices, Tolerance=0.01)
loadcase_2 = CreateLoadCase(CaseID="1", Name="DL", Type="Dead")
reduce = RandomReduce(List=demesh_3.Vertices, Reduction=subtraction, Seed=1)
prop2d_3 = Create2DProperty(Thickness_cm="2", Material=mat_3, Type="Shell", Unit="cm")
explode_4 = Explode(Curve=item_3, Recursive=True)  # -> Segments, Vertices
cull_2 = CullPattern(List=demesh_5.Vertices, CullPattern=smaller_2.SmallerThan)
support = CreateSupport(Point=duppt, Plane=PlaneXY(0, 0, 0), x=True, xx=False, y=True, yy=False, z=True, zz=False)
loadcase_3 = CreateLoadCase(CaseID="1", Name="DL", Type="Dead")
support_2 = CreateSupport(Point=duppt_2, Plane=PlaneXY(0, 0, 0), x=True, xx=True, y=True, yy=True, z=True, zz=True)
medges_3 = MeshEdges(Mesh=mesh)  # -> NakedEdges, InteriorEdges, NonManifoldEdges
lng_3 = ListLength(List=explode_4.Vertices)
medges_4 = MeshEdges(Mesh=mesh_uv_5)  # -> NakedEdges, InteriorEdges, NonManifoldEdges
support_3 = CreateSupport(Point=duppt_3, Plane=PlaneXY(0, 0, 0), x=True, xx=False, y=True, yy=False, z=True, zz=False)
σa = CreateAnalysisCase(Name="LC1", Description="LC1")
elem2d = Create2DElement(Geometry=mesh_uv_2, Property2D=prop2d, Preview3dSection=False)
division = Division(A=lng_3, B=2)
elem2d_2 = Create2DElement(Geometry=mesh_uv_3, Property2D=prop2d_2, Preview3dSection=False)
join_2 = JoinCurves(Curves=medges_3.NakedEdges, Preserve=False)
join_3 = JoinCurves(Curves=medges_4.NakedEdges, Preserve=False)
faceload = CreateFaceLoad(
    LoadCase=loadcase,
    Loadable2DObjects=elem2d,
    Axis=-1,
    Direction="z",
    Projected=False,
    Value_kN_m²="-1",
    Type="Uniform",
    Unit="kN/m²")
σt = CreateAnalysisTask(Name="LC1", casesParamIndex=2, Solver="Static")
elem2d_3 = Create2DElement(Geometry=mesh_uv_4, Property2D=prop2d_3, Preview3dSection=False)
round = Round(Number=division)  # -> Nearest, Floor, Ceiling
σt_2 = CreateAnalysisTask(AnalysisCases=σa, casesParamIndex=2, Solver="Static")
splitatcorners_2 = SplitAtCorners(Poly=join_2, Angle=Slider(0.785, range=0..1))  # -> Corners, Parts
splitatcorners_3 = SplitAtCorners(Poly=join_3, Angle=Slider(0.785, range=0..1))  # -> Corners, Parts
faceload_2 = CreateFaceLoad(
    LoadCase=loadcase_3,
    Loadable2DObjects=elem2d_3,
    Axis=-1,
    Direction="z",
    Projected=False,
    Value_kN_m²="-1",
    Type="Uniform",
    Unit="kN/m²")
σt_3 = CreateAnalysisTask(casesParamIndex=2, Solver="Static")
mat_4 = CreateMaterial(Material_type="Steel", Design_Code="EN 1993-1-1:2005", Grade="S355")
item_4 = ListItem(List=splitatcorners_3.Parts, Index=[0, 2], Wrap=True)
item_5 = ListItem(List=explode_4.Vertices, Index=round.Ceiling, Wrap=True)
mat_5 = CreateMaterial(Material_type="Steel", Design_Code="EN 1993-1-1:2005", Grade="S355")
mat_6 = CreateMaterial(Material_type="Steel", Design_Code="EN 1993-1-1:2005", Grade="S355")
nodeload = CreateNodeLoad(LoadCase=loadcase_2, NodeList=item_5, Direction="z", Value_kN="-1", Type="NodeForce", Unit="kN")
explode_5 = Explode(Curve=splitatcorners_2.Parts, Recursive=True)  # -> Segments, Vertices
explode_6 = Explode(Curve=item_4, Recursive=True)  # -> Segments, Vertices
duppt_4 = RemoveDuplicatePts(Points=flatten(cull_2), Tolerance=0.01)
loadcase_4 = CreateLoadCase(CaseID="1", Name="DL", Type="Dead")
duppt_5 = RemoveDuplicatePts(Points=flatten(explode_5.Vertices), Tolerance=0.01)
model = CreateModel(
    GSAGeometryIn_m=flatten([support, elem2d]),
    Load=faceload,
    AnalysisTasksCombinations=σt,
    ReMesh=True,
    Tolerance=0.01,
    Unit="m")
prop2d_4 = Create2DProperty(Thickness_cm="2", Material=mat_4, Type="Shell", Unit="cm")
loadcase_5 = CreateLoadCase(CaseID="1", Name="DL", Type="Dead")
loadcase_6 = CreateLoadCase(CaseID="1", Name="DL", Type="Dead")
model_2 = CreateModel(
    GSAGeometryIn_m=flatten([support_2, elem2d_2]),
    Load=nodeload,
    AnalysisTasksCombinations=σt_2,
    ReMesh=True,
    Tolerance=0.01,
    Unit="m")
duppt_6 = RemoveDuplicatePts(Points=explode_6.Vertices, Tolerance=0.01)
prop2d_5 = Create2DProperty(Thickness_cm="2", Material=mat_5, Type="Shell", Unit="cm")
prop2d_6 = Create2DProperty(Thickness_cm="2", Material=mat_6, Type="Shell", Unit="cm")
model_3 = CreateModel(
    GSAGeometryIn_m=flatten([support_3, elem2d_3]),
    Load=faceload_2,
    AnalysisTasksCombinations=σt_3,
    ReMesh=True,
    Tolerance=0.01,
    Unit="m")
support_4 = CreateSupport(Point=duppt_4, Plane=PlaneXY(0, 0, 0), x=True, xx=False, y=True, yy=False, z=True, zz=False)
support_5 = CreateSupport(Point=duppt_5, Plane=PlaneXY(0, 0, 0), x=True, xx=False, y=True, yy=False, z=True, zz=False)
support_6 = CreateSupport(Point=duppt_6, Plane=PlaneXY(0, 0, 0), x=True, xx=False, y=True, yy=False, z=True, zz=False)
σa_2 = CreateAnalysisCase(Name="L1", Description="L1")
elem2d_4 = Create2DElement(Geometry=triremesh_2.Triangulation, Property2D=prop2d_4, Preview3dSection=False)
σa_3 = CreateAnalysisCase(Name="L1", Description="L1")
σa_4 = CreateAnalysisCase(Name="L1", Description="L1")
elem2d_5 = Create2DElement(Geometry=mesh, Property2D=prop2d_5, Preview3dSection=False)
elem2d_6 = Create2DElement(Geometry=mesh_uv_5, Property2D=prop2d_6, Preview3dSection=False)
panel_3 = Panel("C:\Users\Matt C\Documents\GitHub\PrincipalStressLines\Example Files\GSA  Model.gwb")
loadcase_7 = CreateLoadCase(CaseID="1", Name="DL", Type="Dead")
save = Button()
σt_4 = CreateAnalysisTask(AnalysisCases=σa_2, casesParamIndex=2, Solver="Static")
σt_5 = CreateAnalysisTask(AnalysisCases=σa_3, casesParamIndex=2, Solver="Static")
faceload_3 = CreateFaceLoad(
    LoadCase=loadcase_4,
    Loadable2DObjects=elem2d_4,
    Axis=0,
    Direction="z",
    Projected=False,
    Value_kN_m²="-1",
    Type="Uniform",
    Unit="kN/m²")
σt_6 = CreateAnalysisTask(AnalysisCases=σa_4, casesParamIndex=2, Solver="Static")
nodeload_2 = CreateNodeLoad(LoadCase=loadcase_5, NodeList=reduce, Direction="z", Value_kN="-1", Type="NodeForce", Unit="kN")
nodeload_3 = CreateNodeLoad(LoadCase=loadcase_6, NodeList=cps_2.ClosestPoint, Direction="z", Value_kN="-1", Type="NodeForce", Unit="kN")
save_2 = SaveGSAModel(GSAModel=model_2, Save=save, FileAndPath=panel_3)
faceload_4 = CreateFaceLoad(
    LoadCase=loadcase_7,
    Loadable2DObjects=elem2d_6,
    Axis=-1,
    Direction="z",
    Projected=False,
    Value_kN_m²="-1",
    Type="Uniform",
    Unit="kN/m²")
panel_4 = Panel("C:\Users\4Matt\Documents\GitHub\PrincipalStressLines\Example Files\Model.gwb")
save_3 = Button()
model_4 = CreateModel(
    GSAGeometryIn_m=flatten([support_4, elem2d_4]),
    Load=faceload_3,
    AnalysisTasksCombinations=σt_4,
    ReMesh=True,
    Tolerance=0.01,
    Unit="m")
model_5 = CreateModel(
    GSAGeometryIn_m=flatten([support_5, elem2d_5]),
    Load=nodeload_2,
    AnalysisTasksCombinations=σt_5,
    ReMesh=True,
    Tolerance=0.01,
    Unit="m")
model_6 = CreateModel(
    GSAGeometryIn_m=flatten([support_6, elem2d_6]),
    Load=nodeload_3,
    AnalysisTasksCombinations=σt_6,
    ReMesh=True,
    Tolerance=0.01,
    Unit="m")
save_4 = SaveGSAModel(GSAModel=model, Save=save_3, FileAndPath=panel_4)
panel_5 = Panel("C:\Users\Matt C\Documents\GitHub\PrincipalStressLines\Example Files\FreeFormShell_Rev01.gwb")
panel_6 = Panel("C:\Users\4Matt\Documents\GitHub\PrincipalStressLines\Example Files\Spherical Shell1.gwb")
save_5 = Button()
panel_7 = Panel("C:\Users\4Matt\Documents\GitHub\PrincipalStressLines\Example Files\Cylindrical Shell.gwb")
save_6 = Button()
save_7 = Button()
save_8 = SaveGSAModel(GSAModel=model_4, Save=save_5, FileAndPath=panel_5)
save_9 = SaveGSAModel(GSAModel=model_5, Save=save_6, FileAndPath=panel_6)
save_10 = SaveGSAModel(GSAModel=model_6, Save=save_7, FileAndPath=panel_7)
