# Grasshopper definition Karamba.gh (Grasshopper 1.0.8)
# plug-ins: Karamba3D, Human, LunchBox, LilyPad

series = Series(Start=0, Step=1, Count=10)
pt = ConstructPoint(XCoordinate=series, YCoordinate=0, ZCoordinate=0)
yz = YZPlane(Origin=pt)
cir = Circle(Plane=yz, Radius="5")
msphereex = MeshSphereEx(Base=PlaneXY(0, 0, 0), Radius="5", Count="30")
md_slider = MDSlider(
    SliderMode=0,
    slider_value=Point(0.4565891173, 1, 0.5),
    x_domain=Domain(0, 1),
    y_domain=Domain(0.5, 1),
    z_domain=Domain(0, 1))
xy = XYPlane(Origin=Point(0, 0, 0))
sph = Sphere(Base=PlaneXY(0, 0, 0), Radius="5")
msplit = MeshSplitPlane(Mesh=msphereex, Plane=xy)  # -> Above, Below
quad = Quadrangulate(Mesh=msplit.Above, Angle=0.03490658504, Ratio=0.875)  # -> Mesh, Count
evalsrf = EvaluateSurface(Surface=reparameterize(sph), Point=md_slider)  # -> Point, Normal, UDirection, VDirection, Frame
clean = CombineClean(Meshes=quad.Mesh)
mesh = Mesh(clean)
number_slider = Slider(5, range=0..10)
demesh = DeconstructMesh(Mesh=mesh)  # -> Vertices, Faces, Colours, Normals
lng = ListLength(List=demesh.Vertices)
subtraction = Subtraction(A=lng, B=number_slider)
cps = ClosestPoints(Point=evalsrf.Point, Cloud=demesh.Vertices, Count=number_slider)  # -> ClosestPoint, CPIndex, Distance
reduce = RandomReduce(List=demesh.Vertices, Reduction=subtraction, Seed=1)
pt_2 = ConstructPoint(XCoordinate="-2", YCoordinate=0, ZCoordinate=0)
pt_3 = ConstructPoint(XCoordinate="2", YCoordinate=0, ZCoordinate=0)
Z = UnitZ(Factor=1)
cat = Catenary(PointA=pt_2, PointB=pt_3, Length="5", Gravity=Z)
shatter = Shatter(Curve=reparameterize(cat), Parameters=0.5)
Z_2 = UnitZ(Factor=1)
pt_4 = ConstructPoint(XCoordinate=0, YCoordinate=0, ZCoordinate=0)
item = ListItem(List=shatter, Index=0, Wrap=True)
line = LineSDL(Start=pt_4, Direction=Z_2, Length=1)
reb = RebuildCurve(Curve=item, Degree=2, Count=10, Tangents=False)
revsrf = Revolution(Curve=reb, Axis=line, Domain=Domain(0, 6.283185307))
triremesh = TriRemesh(Geometry=revsrf, Iterations=25)  # -> Triangulation, Dual, Creases
tri = Triangulate(Mesh=mesh)  # -> Mesh, Count
matselect = MaterialSelectionKaramba3D(menu=[dropdown(1), dropdown(0)])
crosec = CrossSectionKaramba3D(FamilyNameOfCrossSection="DefaultCroSec", NameOfCrossSection=matselect, Height_cm="1", mode="Shell - Const")
demesh_2 = DeconstructMesh(Mesh=tri.Mesh)  # -> Vertices, Faces, Colours, Normals
pdecon = Deconstruct(Point=demesh_2.Vertices)  # -> XComponent, YComponent, ZComponent
smaller = SmallerThan(FirstNumber=pdecon.ZComponent, SecondNumber="0.001")  # -> SmallerThan, OrEqualTo
Z_3 = UnitZ(Factor="-1")
cull = CullPattern(List=demesh_2.Vertices, CullPattern=smaller.SmallerThan)
loads = LoadsKaramba3D(ForceVector=Z_3, Local=False, PosInd=reduce, LCase="LC0", mode="Point")
supp = SupportKaramba3D(PosInd=cull, Ct_kN_m=Vector(0, 0, 0), Cr_kNm_rad=Vector(0, 0, 0), menu=[buttons(on, on, on, off, off, off)])
surfelem = CreateSurfaceElementKaramba3D(Mesh=tri.Mesh, CrossSection=crosec, LimitDistance_m=0.005, Bending=True, mode="MeshToShell")  # -> Element, Points, Info
assemble = AssembleModelKaramba3D(Elem=surfelem.Element, Support=supp, Load=loads, LimitDistance_m=0.005)  # -> Model, Info, Mass_kg, CentreOfGravity, LoadCaseNames
license = LicenseKaramba3D()
panel = Panel(license)
analyse = AnalyseKaramba3D(Model=assemble.Model)  # -> AnalysedModel, MaximumDisplacement_cm, ResultingForce_kN, ChangeOfElasticEnergy_kNm
modelview = ModelViewKaramba3D(Model=analyse.AnalysedModel)  # -> Model, DeformedMesh, DeformedAxes, DeformedModel, MaximumDeformation
nodedisp = NodalDisplacementsKaramba3D(AnalysedModel=analyse.AnalysedModel, PositionsIndexes=demesh_2.Vertices)  # -> Model, flatten(NodalTranslations_m), NodalRotations_rad, DisplacementPosition, LoadCaseIndex
shellvecresults = ResultVectorsOnShellsKaramba3D(Model=analyse.AnalysedModel, LayerPosition=0, mode="PrincStress")  # -> Model, Points, FirstPrincipalStressVector_kN_cm², SecondPrincipalStressVector_kN_cm², FirstPrincipalStressValue_kN_cm², SecondPrincipalStressValue_kN_cm²
shellview = ShellViewKaramba3D(Model=modelview.Model, IndexOfLayer=0)  # -> Model, MeshesOfRenderedShells, LegendColours, LegendTags
facen = FaceNormals(Mesh=tri.Mesh)  # -> Centers, Normals
rtree = CreateRTree(InputGeometry=shellvecresults.Points)
legend = Legend(Colour=shellview.LegendColours, Tags=shellview.LegendTags, LegendType=1)
rtree_cp = RTreeClosestPoint(SearchPoints=facen.Centers, RTree=rtree)  # -> ClosestPoint, ClosestIndex
item_2 = ListItem(List=shellvecresults.SecondPrincipalStressVector_kN_cm², Index=rtree_cp.ClosestIndex, Wrap=True)
item_3 = ListItem(List=shellvecresults.FirstPrincipalStressVector_kN_cm², Index=rtree_cp.ClosestIndex, Wrap=True)
tri3mem = _3NodeTriangularMembrane(Mesh=tri.Mesh, Displacments=nodedisp.NodalTranslations_m, PoissonsRatio="0.005")  # -> PrincipleDirection1, PrincipleDirection2

# ----
# Evaluation
eval = EvaluatePrincipalMesh(Principal=tri3mem.PrincipleDirection2, Location=facen.Centers)
eval_2 = EvaluatePrincipalMesh(Principal=tri3mem.PrincipleDirection1, Location=facen.Centers)
vdis = VectorDisplay(Anchor=facen.Centers, Vector=eval_2)
vdis_2 = VectorDisplay(Anchor=facen.Centers, Vector=eval)

vectormesh = CreateVectorMesh(Mesh=tri.Mesh, Vectors1st=eval_2, Vectors2nd=eval, Radius="0.3")  # -> PrincipleDirection1, PrincipleDirection2
pt_5 = Point(Point(-0.3520673353, 0.9428868015, 0.6771889255))
meshcp = MeshClosestPoint(Point=pt_5, Mesh=tri.Mesh)  # -> Point, Index, Parameter
md_slider_2 = MDSlider(
    SliderMode=0,
    slider_value=Point(0.8699854409, 0.5149678486, 0.5),
    x_domain=Domain(0, 1),
    y_domain=Domain(0.5, 1),
    z_domain=Domain(0, 1))
srf = Surface(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)
evalsrf_2 = EvaluateSurface(Surface=reparameterize(srf), Point=md_slider_2)  # -> Point, Normal, UDirection, VDirection, Frame
pt_6 = Point(evalsrf_2.Point)
sph_2 = Sphere(Base=pt_6, Radius="0.3")

# ----
# Stress Lines
number_slider_2 = Slider(-8, range=-10..0)
number_slider_3 = Slider(0.1, range=0..1)
number_slider_4 = Slider(0.5, range=0..1)
number_slider_5 = Slider(0.05, range=0..0.1)
_10º = PowerOf10(Value=number_slider_2)
panel_2 = Panel("1")  # disabled
panel_3 = Panel("0.05")  # disabled
number_slider_6 = Slider(5, range=1..5)
sls = StressLines(
    PrincipalMesh=tri3mem.PrincipleDirection1,
    Seed=evalsrf_2.Point,
    StepTolerance=number_slider_3,
    MaxError=_10º,
    SeedingMethod="1",
    Seperation=number_slider_4,
    TestDist=number_slider_5)
sls_2 = StressLines(
    PrincipalMesh=vectormesh.PrincipleDirection2,
    Seed=evalsrf_2.Point,
    StepTolerance=number_slider_3,
    MaxError=_10º,
    SeedingMethod=panel_2,
    Seperation=number_slider_4,
    TestDist=number_slider_5)  # disabled
swatch = ColourSwatch(SwatchColor=RGB(255, 143, 212))  # disabled
previewlw = CustomPreviewLineweights(Geometry=sls, Shader=ColourSwatch(SwatchColor=RGB(82, 184, 59)), Thickness=number_slider_6, Absolute=False)
previewlw_2 = CustomPreviewLineweights(Geometry=sls_2, Shader=swatch, Thickness=number_slider_6, Absolute=False)  # disabled

# ----
# Stress Line
number_slider_7 = Slider(-10, range=-10..0)
_10º_2 = PowerOf10(Value=number_slider_7)
stress_line = StressLine(
    PrincipalMesh=vectormesh.PrincipleDirection2,
    Seed=evalsrf_2.Point,
    StepTolerance="0.2",
    IntegrationMethod="4",
    MaxError=_10º_2)
stress_line_2 = StressLine(
    PrincipalMesh=tri3mem.PrincipleDirection1,
    Seed=evalsrf_2.Point,
    StepTolerance="0.2",
    IntegrationMethod="4",
    MaxError=_10º_2)
preview = CustomPreview(
    Geometry=stress_line_2,
    Material={diffuse=RGB(13, 201, 0), emission=RGB(4, 60, 0), shine=0.5, specular=RGB(255, 255, 255), transparency=0})
preview_2 = CustomPreview(
    Geometry=stress_line,
    Material={diffuse=RGB(13, 201, 0), emission=RGB(4, 60, 0), shine=0.5, specular=RGB(255, 255, 255), transparency=0})

# ----
# Evaluation
eval_3 = EvaluatePrincipalMesh(Principal=vectormesh.PrincipleDirection2, Location=evalsrf_2.Point)
# Results
eval_4 = EvaluatePrincipalMesh(Principal=tri3mem.PrincipleDirection1, Location=evalsrf_2.Point)
vdis_3 = VectorDisplay(Anchor=evalsrf_2.Point, Vector=eval_4)
vdis_4 = VectorDisplay(Anchor=evalsrf_2.Point, Vector=eval_3)
