# Grasshopper definition Karamba_CrappersShell In Plane StressLines_rv1.gh (Grasshopper 1.0.8)
# plug-ins: Karamba3D, Human, Kangaroo Components, LilyPad

# Structure: Hemisphere Under Point Load
# Analysis Input: Data/Oasys GSA
# Field Generation Method: Vector Field Method
mesh = Mesh([<mesh referenced from the Rhino model> x75])
clean = CombineClean(Meshes=mesh)
mesh_2 = Mesh(clean)

nv = NakedVertices(Mesh=mesh_2)  # -> ClothedIndex, NakedIndex, ClothedPts, NakedPts
cluster = Cluster(M=mesh_2)
data = Data(nv.ClothedPts)
matselect = MaterialSelectionKaramba3D(menu=[dropdown(1), dropdown(0)])
crosec = CrossSectionKaramba3D(FamilyNameOfCrossSection="DefaultCroSec", NameOfCrossSection=matselect, Height_cm="1", mode="Shell - Const")
Z = UnitZ(Factor="-0.1")
subtraction = Subtraction(A=nv.ClothedPts, B=Z)
loads = LoadsKaramba3D(ForceVector=Z, Local=False, PosInd=nv.ClothedPts, LCase="LC0", mode="Point")
vdisex = VectorDisplayEx(Point=subtraction, Vector=Z, Colour=RGB(0, 0, 0), Width=2)
supp = SupportKaramba3D(PosInd=cluster, Ct_kN_m=Vector(0, 0, 0), Cr_kNm_rad=Vector(0, 0, 0), menu=[buttons(on, on, on, off, off, off)])
surfelem = CreateSurfaceElementKaramba3D(Mesh=mesh_2, CrossSection=crosec, LimitDistance_m=0.005, Bending=True, mode="MeshToShell")  # -> Element, Points, Info
assemble = AssembleModelKaramba3D(Elem=surfelem.Element, Support=supp, Load=loads, LimitDistance_m=0.005)  # -> Model, Info, Mass_kg, CentreOfGravity, LoadCaseNames
license = LicenseKaramba3D()
panel = Panel(license)
analyse = AnalyseKaramba3D(Model=assemble.Model)  # -> AnalysedModel, MaximumDisplacement_cm, ResultingForce_kN, ChangeOfElasticEnergy_kNm
modelview = ModelViewKaramba3D(Model=analyse.AnalysedModel)  # -> Model, DeformedMesh, DeformedAxes, DeformedModel, MaximumDeformation
shellview = ShellViewKaramba3D(Model=modelview.Model, IndexOfLayer=0)  # -> Model, MeshesOfRenderedShells, LegendColours, LegendTags
legend = Legend(Colour=shellview.LegendColours, Tags=shellview.LegendTags, LegendType=1)

# ---- group: Step 3.1: Create Deformation Mesh(Generating vector fields)
# Create Principle Mesh
tri = Triangulate(Mesh=mesh_2)  # -> Mesh, Count
demesh = DeconstructMesh(Mesh=tri.Mesh)  # -> Vertices, Faces, Colours, Normals
panel_2 = Panel("""True - Bending Stress Lines
False - In-plane Stress Lines""")
nodedisp = NodalDisplacementsKaramba3D(AnalysedModel=analyse.AnalysedModel, PositionsIndexes=demesh.Vertices)  # -> Model, flatten(NodalTranslations_m), flatten(NodalRotations_rad), DisplacementPosition, LoadCaseIndex
list = ItemSelector(panel_2, {"True - Bending Stress Lines", "False - In-plane Stress Lines"}, selected="False - In-plane Stress Lines")
# Note On Vector Field Generation: Principle Vector Field(P1/P2) is generated for either Bending stress lines or In-plane stress lines
# Bending stress lines - rotational input is required - i.e.slab structure/dome structure
# In-plane stress lines - translational input is required - i.e.shear wall structure
cluster_2 = Cluster_2(T=list)
facen = FaceNormals(Mesh=tri.Mesh)  # -> Centers, Normals
defmesh = CreateDeformationMesh(
    Mesh=tri.Mesh,
    Translations=nodedisp.NodalTranslations_m,
    Rotations=nodedisp.NodalRotations_rad,
    PoissonsRatio="0.3",
    BendingStressLines=cluster_2)  # -> PrincipalDirection1, PrincipalDirection2
eval = EvaluatePrincipalMesh(Principal=defmesh.PrincipalDirection1, Location=facen.Centers)
eval_2 = EvaluatePrincipalMesh(Principal=defmesh.PrincipalDirection2, Location=facen.Centers)
vdisex_2 = VectorDisplayEx(Point=facen.Centers, Vector=expr("x/10", eval_2), Colour=RGB(255, 143, 212), Width=2)
vdisex_3 = VectorDisplayEx(Point=facen.Centers, Vector=expr("x/10", eval), Colour=RGB(82, 184, 59), Width=2)

# ---- group: Step 3.0: Input Mesh Topo Check
demesh_2 = DeconstructMesh(Mesh=tri.Mesh)  # -> Vertices, Faces, Colours, Normals
deface = DeconstructFace(Face=graft(demesh_2.Faces))  # -> CornerA, CornerB, CornerC, CornerD
merge = Merge(Data1=deface.CornerA, Data2=deface.CornerB, Data3=deface.CornerC, Data4=deface.CornerD)  # -> simplify(Result)
tstat = TreeStatistics(Tree=merge)  # -> Paths, Length, Count
item = ListItem(List=tstat.Paths, Index=0, Wrap=True)
split = SplitTree(Data=merge, Masks=flatten(item))  # -> Positive, Negative
cset = CreateSet(List=split.Positive)  # -> Set, Map
item_2 = ListItem(List=demesh_2.Vertices, Index=cset.Set, Wrap=True)
pline = PolyLine(Vertices=item_2, Closed=True)
points = PointList(Points=item_2, Size=0.05)
previewlw = CustomPreviewLineweights(Geometry=pline, Shader=ColourSwatch(SwatchColor=RGB(0, 0, 0)), Thickness=4, Absolute=False)

# ---- group: Vector Field
v1 = Data(eval)
# Input the principle stress fields that is avaliable
v2 = Data(eval_2)

# ---- group: Step 3.2: Vector Mesh (Smoothing vectors for stressline generation)
# Smoothing Radius: Refine vector to be the average vectors within the radius distance
smoothing_radius = Panel("0.4")
vectormesh = CreateVectorMesh(Mesh=tri.Mesh, Vectors1st=v1, Vectors2nd=v2, Radius=smoothing_radius)  # -> PrincipleDirection1, PrincipleDirection2

# ---- group: Step 4: Selecting Seed Point
md_slider = MDSlider(SliderMode=0, slider_value=Point(1, 1, 0.5), x_domain=Domain(0, 1), y_domain=Domain(0.5, 1), z_domain=Domain(0, 1))
srf = Surface(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)
evalsrf = EvaluateSurface(Surface=reparameterize(srf), Point=md_slider)  # -> Point, Normal, UDirection, VDirection, Frame
meshcp = MeshClosestPoint(Point=evalsrf.Point, Mesh=tri.Mesh)  # -> Point, Index, Parameter

# ----
sph = Sphere(Base=meshcp.Point, Radius=smoothing_radius)

# ---- group: Step 5: Create Evenly Spaced Stress Lines
number_slider = Slider(0.1, range=0..1)
number_slider_2 = Slider(0.5, range=0..1)
number_slider_3 = Slider(0.05, range=0..0.1)
_10º = PowerOf10(Value=Slider(-5, range=-10..0))
number_slider_4 = Slider(5, range=1..5)
sls = StressLines(
    PrincipalMesh=vectormesh.PrincipleDirection2,
    Seed=meshcp.Point,
    StepTolerance=number_slider,
    MaxError=_10º,
    Seperation=number_slider_2,
    TestDist=number_slider_3)
sls_2 = StressLines(
    PrincipalMesh=vectormesh.PrincipleDirection1,
    Seed=meshcp.Point,
    StepTolerance=number_slider,
    MaxError=_10º,
    Seperation=number_slider_2,
    TestDist=number_slider_3)
previewlw_2 = CustomPreviewLineweights(Geometry=sls_2, Shader=ColourSwatch(SwatchColor=RGB(82, 184, 59)), Thickness=number_slider_4, Absolute=False)
previewlw_3 = CustomPreviewLineweights(Geometry=sls, Shader=ColourSwatch(SwatchColor=RGB(255, 143, 212)), Thickness=number_slider_4, Absolute=False)

# ---- group: Step 5: Create A Stressline_P1
_10º_2 = PowerOf10(Value=Slider(-4, range=-10..0))
stress_line = StressLine(PrincipalMesh=vectormesh.PrincipleDirection1, Seed=meshcp.Point, StepTolerance="0.2", MaxError=_10º_2)
stress_line_2 = StressLine(PrincipalMesh=vectormesh.PrincipleDirection2, Seed=meshcp.Point, StepTolerance="0.2", MaxError=_10º_2)
preview = CustomPreview(
    Geometry=stress_line,
    Material={diffuse=RGB(13, 201, 0), emission=RGB(4, 60, 0), shine=0.5, specular=RGB(255, 255, 255), transparency=0})
preview_2 = CustomPreview(
    Geometry=stress_line_2,
    Material={diffuse=RGB(13, 201, 0), emission=RGB(4, 60, 0), shine=0.5, specular=RGB(255, 255, 255), transparency=0})

# ---- group: Step 5: Evaluate Principle Mesh
eval_3 = EvaluatePrincipalMesh(Principal=vectormesh.PrincipleDirection2, Location=meshcp.Point)
# Results
eval_4 = EvaluatePrincipalMesh(Principal=vectormesh.PrincipleDirection1, Location=meshcp.Point)
vdisex_4 = VectorDisplayEx(Point=meshcp.Point, Vector=eval_3, Colour=RGB(255, 143, 212), Width=2)
vdisex_5 = VectorDisplayEx(Point=meshcp.Point, Vector=eval_4, Colour=RGB(82, 184, 59), Width=2)

# ==== cluster Cluster
M = ClusterInput()
nv = NakedVertices(Mesh=M)  # -> ClothedIndex, NakedIndex, ClothedPts, NakedPts
pdecon = Deconstruct(Point=nv.NakedPts)  # -> XComponent, YComponent, ZComponent
smaller = SmallerThan(FirstNumber=pdecon.ZComponent, SecondNumber=0.01)  # -> SmallerThan, OrEqualTo
cull = CullPattern(List=nv.NakedPts, CullPattern=smaller.SmallerThan)
L = ClusterOutput(cull)

# ==== cluster Cluster_2
T = ClusterInput()
split = TextSplit(Text=T, Separators=" - ")
item = ListItem(List=split, Index=0, Wrap=True)  # -> flatten(Item)
bool = Boolean(item)
bool_2 = ClusterOutput(bool)
