# Grasshopper definition Karamba_Flat Slab Bending StressLines_rv1.gh (Grasshopper 1.0.8)
# plug-ins: Karamba3D, Human, LilyPad

# ---- group: Step 1: Create Geometry
rectangle = Rectangle(Plane=PlaneXY(0, 0, 0), XSize="-5 to 5", YSize="-5 to 5", Radius=0)  # -> Rectangle, Length
mplane = MeshPlane(Boundary=rectangle.Rectangle, WidthCount="30", HeightCount="30")  # -> Mesh, Area
mesh = Mesh(mplane.Mesh)
preview = CustomPreview(Geometry=mesh, Material=ColourSwatch(SwatchColor=RGB(217, 217, 217)))
demesh = DeconstructMesh(Mesh=mesh)  # -> Vertices, Faces, Colours, Normals
lng = ListLength(List=demesh.Vertices)
subtraction = Subtraction(A=lng, B=Slider(5, range=0..10))
tri = Triangulate(Mesh=mesh)  # -> Mesh, Count
reduce = RandomReduce(List=demesh.Vertices, Reduction=subtraction, Seed=1)

# ---- group: Step 3.0: Input Mesh Topo Check
demesh_2 = DeconstructMesh(Mesh=tri.Mesh)  # -> Vertices, Faces, Colours, Normals
deface = DeconstructFace(Face=graft(demesh_2.Faces))  # -> CornerA, CornerB, CornerC, CornerD
merge = Merge(Data1=deface.CornerA, Data2=deface.CornerB, Data3=deface.CornerC, Data4=deface.CornerD)  # -> simplify(Result)
tstat = TreeStatistics(Tree=merge)  # -> Paths, Length, Count
item = ListItem(List=tstat.Paths, Index=0, Wrap=True)
split = SplitTree(Data=merge, Masks=flatten(item))  # -> Positive, Negative
cset = CreateSet(List=split.Positive)  # -> Set, Map
item_2 = ListItem(List=demesh_2.Vertices, Index=cset.Set, Wrap=True)
pline = PolyLine(Vertices=item_2, Closed=True)
points = PointList(Points=item_2, Size=0.05)
previewlw = CustomPreviewLineweights(Geometry=pline, Shader=ColourSwatch(SwatchColor=RGB(0, 0, 0)), Thickness=4, Absolute=False)

# ---- group: Vector Field
v1 = Data([Vector(0.7184826753, 0.695544855, 0), Vector(0.710606314, 0.7035898426, 0), Vector(0.7132904898, 0.7008685163, 0), Vector(0.7147773024, 0.6993521345, 0), Vector(0.7166846154, 0.6973974204, 0), Vector(0.7187786972, 0.6952389405, 0)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])
# Input the principle stress fields that is avaliable
v2 = Data([Vector(-0.695544855, 0.7184826753, 0), Vector(-0.7035898426, 0.710606314, 0), Vector(-0.7008685163, 0.7132904898, 0), Vector(-0.6993521345, 0.7147773024, 0), Vector(-0.6973974204, 0.7166846154, 0), Vector(-0.6952389405, 0.7187786972, 0)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])

# ---- group: Step 3.2: Vector Mesh (Smoothing vectors for stressline generation)
# Smoothing Radius: Refine vector to be the average vectors within the radius distance
smoothing_radius = Panel("0.5")
vectormesh = CreateVectorMesh(Mesh=tri.Mesh, Vectors1st=v1, Vectors2nd=v2, Radius=smoothing_radius)  # -> PrincipleDirection1, PrincipleDirection2

# ---- group: Step 4: Selecting Seed Point
md_slider = MDSlider(SliderMode=0, slider_value=Point(1, 1, 0.5), x_domain=Domain(0, 1), y_domain=Domain(0.5, 1), z_domain=Domain(0, 1))
srf = Surface(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)
evalsrf = EvaluateSurface(Surface=reparameterize(srf), Point=md_slider)  # -> Point, Normal, UDirection, VDirection, Frame
meshcp = MeshClosestPoint(Point=evalsrf.Point, Mesh=tri.Mesh)  # -> Point, Index, Parameter

# ----
sph = Sphere(Base=meshcp.Point, Radius=smoothing_radius)

# ---- group: Step 5: Create Evenly Spaced Stress Lines
# Evenly Spaced Stress Lines
number_slider = Slider(-5, range=-10..0)
number_slider_2 = Slider(0.1, range=0..1)
number_slider_3 = Slider(0.5, range=0..1)
number_slider_4 = Slider(0.05, range=0..0.1)
_10º = PowerOf10(Value=number_slider)
number_slider_5 = Slider(5, range=1..5)
sls = StressLines(
    PrincipalMesh=vectormesh.PrincipleDirection2,
    Seed=meshcp.Point,
    StepTolerance=number_slider_2,
    MaxError=_10º,
    Seperation=number_slider_3,
    TestDist=number_slider_4)
sls_2 = StressLines(
    PrincipalMesh=vectormesh.PrincipleDirection1,
    Seed=meshcp.Point,
    StepTolerance=number_slider_2,
    MaxError=_10º,
    Seperation=number_slider_3,
    TestDist=number_slider_4)
previewlw_2 = CustomPreviewLineweights(Geometry=sls_2, Shader=ColourSwatch(SwatchColor=RGB(82, 184, 59)), Thickness=number_slider_5, Absolute=False)
previewlw_3 = CustomPreviewLineweights(Geometry=sls, Shader=ColourSwatch(SwatchColor=RGB(255, 143, 212)), Thickness=number_slider_5, Absolute=False)

# ---- group: Step 5: Create A Stressline_P1
# Single Stress Line
number_slider_6 = Slider(-4, range=-10..0)
_10º_2 = PowerOf10(Value=number_slider_6)
stress_line = StressLine(PrincipalMesh=vectormesh.PrincipleDirection1, Seed=meshcp.Point, StepTolerance="0.2", MaxError=_10º_2)
stress_line_2 = StressLine(PrincipalMesh=vectormesh.PrincipleDirection2, Seed=meshcp.Point, StepTolerance="0.2", MaxError=_10º_2)
preview_2 = CustomPreview(
    Geometry=stress_line,
    Material={diffuse=RGB(13, 201, 0), emission=RGB(4, 60, 0), shine=0.5, specular=RGB(255, 255, 255), transparency=0})
preview_3 = CustomPreview(
    Geometry=stress_line_2,
    Material={diffuse=RGB(13, 201, 0), emission=RGB(4, 60, 0), shine=0.5, specular=RGB(255, 255, 255), transparency=0})

# ---- group: Step 5: Evaluate Principle Mesh
# Vectors
eval = EvaluatePrincipalMesh(Principal=vectormesh.PrincipleDirection2, Location=meshcp.Point)
# Results
eval_2 = EvaluatePrincipalMesh(Principal=vectormesh.PrincipleDirection1, Location=meshcp.Point)
vdisex = VectorDisplayEx(Point=meshcp.Point, Vector=eval, Colour=RGB(255, 143, 212), Width=2)
vdisex_2 = VectorDisplayEx(Point=meshcp.Point, Vector=eval_2, Colour=RGB(82, 184, 59), Width=2)

# ---- group: Step 2: K3D Analysis Model
matselect = MaterialSelectionKaramba3D(menu=[dropdown(1), dropdown(0)])
# Structure: Square Slab Under UDL
# Analysis Input: Karamba 3D
# Field Generation Method: Vector Field Method
nv = NakedVertices(Mesh=tri.Mesh)  # -> ClothedIndex, NakedIndex, ClothedPts, NakedPts
crosec = CrossSectionKaramba3D(FamilyNameOfCrossSection="DefaultCroSec", NameOfCrossSection=matselect, Height_cm="1", mode="Shell - Const")
Z = UnitZ(Factor="-1")
loads = LoadsKaramba3D(ForceVector=Z, Local=False, PosInd=demesh.Vertices, LCase="LC0", mode="Point")
supp = SupportKaramba3D(PosInd=nv.NakedPts, Ct_kN_m=Vector(0, 0, 0), Cr_kNm_rad=Vector(0, 0, 0), menu=[buttons(on, on, on, off, off, on)])
surfelem = CreateSurfaceElementKaramba3D(Mesh=tri.Mesh, CrossSection=crosec, LimitDistance_m=0.005, Bending=True, mode="MeshToShell")  # -> Element, Points, Info
assemble = AssembleModelKaramba3D(Elem=surfelem.Element, Support=supp, Load=loads, LimitDistance_m=0.005)  # -> Model, Info, Mass_kg, CentreOfGravity, LoadCaseNames
license = LicenseKaramba3D()
panel = Panel(license)
analyse = AnalyseKaramba3D(Model=assemble.Model)  # -> AnalysedModel, MaximumDisplacement_cm, ResultingForce_kN, ChangeOfElasticEnergy_kNm
modelview = ModelViewKaramba3D(Model=analyse.AnalysedModel)  # -> Model, DeformedMesh, DeformedAxes, DeformedModel, MaximumDeformation
shellview = ShellViewKaramba3D(Model=modelview.Model, IndexOfLayer=0)  # -> Model, MeshesOfRenderedShells, LegendColours, LegendTags
legend = Legend(Colour=shellview.LegendColours, Tags=shellview.LegendTags, LegendType=1)

# ----
multiplication = Multiplication(A=Z, B=0.1)

# ---- group: Step 2: K3D Analysis Model (continued)
subtraction_2 = Subtraction(A=demesh.Vertices, B=multiplication)
vdisex_3 = VectorDisplayEx(Point=subtraction_2, Vector=expr("X*0.1", Z), Colour=RGB(0, 0, 0), Width=2)

# ---- group: Step 3.1: Create Deformation Mesh(Generating vector fields)
# Create Principle Mesh
demesh_3 = DeconstructMesh(Mesh=tri.Mesh)  # -> Vertices, Faces, Colours, Normals
panel_2 = Panel("""True - Bending Stress Lines
False - In-plane Stress Lines""")
nodedisp = NodalDisplacementsKaramba3D(AnalysedModel=analyse.AnalysedModel, PositionsIndexes=demesh_3.Vertices)  # -> Model, flatten(NodalTranslations_m), flatten(NodalRotations_rad), DisplacementPosition, LoadCaseIndex
list = ItemSelector(panel_2, {"True - Bending Stress Lines", "False - In-plane Stress Lines"}, selected="True - Bending Stress Lines")
# Note On Vector Field Generation: Principle Vector Field(P1/P2) is generated for either Bending stress lines or In-plane stress lines
# Bending stress lines - rotational input is required - i.e.slab structure/dome structure
# In-plane stress lines - translational input is required - i.e.shear wall structure
cluster = Cluster(T=list)
facen = FaceNormals(Mesh=tri.Mesh)  # -> Centers, Normals
defmesh = CreateDeformationMesh(
    Mesh=tri.Mesh,
    Translations=nodedisp.NodalTranslations_m,
    Rotations=nodedisp.NodalRotations_rad,
    PoissonsRatio="0.3",
    BendingStressLines=cluster)  # -> PrincipalDirection1, PrincipalDirection2
eval_3 = EvaluatePrincipalMesh(Principal=defmesh.PrincipalDirection1, Location=facen.Centers)
eval_4 = EvaluatePrincipalMesh(Principal=defmesh.PrincipalDirection2, Location=facen.Centers)
vdisex_4 = VectorDisplayEx(Point=facen.Centers, Vector=expr("x/10", eval_4), Colour=RGB(255, 143, 212), Width=2)
vdisex_5 = VectorDisplayEx(Point=facen.Centers, Vector=expr("x/10", eval_3), Colour=RGB(82, 184, 59), Width=2)

# ==== cluster Cluster
T = ClusterInput()
split = TextSplit(Text=T, Separators=" - ")
item = ListItem(List=split, Index=0, Wrap=True)  # -> flatten(Item)
bool = Boolean(item)
bool_2 = ClusterOutput(bool)
