# Grasshopper definition LilyPad_Example-Plate_4Node-FromGSA.gh (Grasshopper 1.0.8)
# plug-ins: treesloth01, Human, GSA, LilyPad

panel = Panel("C:\Users\Matt C\Documents\GitHub\PrincipalStressLines\Example Files\GSA Model_Plate_4Node.gwb")
open = OpenModel(FilenameAndPath=panel)
getanalysis = GetModelAnalysis(GSAModel=open)  # -> AnalysisTasks, AnalysisCases, CombinationCases, DesignTasks
panel_2 = Panel(getanalysis.AnalysisCases)
getgeo = GetModelGeometry(GSAModel=open, Mode=1, Unit="m")  # -> NodesIn_m, _1DElementsIn_m, _2DElementsIn_m, _3DElementsIn_m, _1DMembersIn_m, _2DMembersIn_m, _3DMembersIn_m, Assemblies
getres = GetResult(GSAModel=open, T="A", Case=1)
nodedisp = NodeDisplacements(Result=getres, Max_Min="All", Unit="mm")  # -> TranslationsX_mm, TranslationsY_mm, TranslationsZ_mm, TranslationsXYZ_mm, RotationXX_rad, RotationYY_rad, RotationZZ_rad, RotationXYZ_rad, NodeIDs
nodeedit = EditNode(Node=getgeo.NodesIn_m, Mode=1)  # -> Node, NodeNumber, NodePosition, NodeLocalAxis, NodeRestraints, DamperProperty, MassProperty, SpringProperty, NodeName, NodeColour
elem2dedit = Edit2DElement(Element2D=getgeo._2DElementsIn_m, Preview3dSection=False)  # -> Element2D, Number, Geometry, _2DProperty, Group, ElementType, Offset, OrientationAngle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
num = Number(nodedisp.TranslationsX_mm)
num_2 = Number(nodedisp.TranslationsY_mm)
num_3 = Number(nodedisp.TranslationsZ_mm)
subtraction = Subtraction(A=elem2dedit.Topology, B=1)
vec = VectorXYZ(XComponent=num, YComponent=num_2, ZComponent=num_3)  # -> Vector, Length
int = Integer(nodeedit.NodeNumber)
int_2 = Integer(elem2dedit.Topology)
int_3 = Integer(subtraction)
mindex = MemberIndex(Set=int, Member=int_2)  # -> Index, Count
panel_3 = Panel(num_3)
shift = ShiftPaths(Data=mindex.Index, Offset=-1)

# ----
# FEA Data Import
displacement_vectors = Vector(vec.Vector)
element_node_ids = Number(simplify(shift))
node_locations = Point(nodeedit.NodePosition)

panel_4 = Panel("""0
1
3
2""")
item = ListItem(List=element_node_ids, Index=panel_4, Wrap=True)
tstat = TreeStatistics(Tree=item)  # -> Paths, Length, Count
item_2 = ListItem(List=tstat.Paths, Index=0, Wrap=True)
split = SplitTree(Data=item, Masks=flatten(item_2))  # -> Positive, Negative

# ----
# Setup
item_3 = ListItem(List=item, Index=0, Wrap=True)  # -> Item, Item1, Item2, Item3, Item4, Item5, Item6, Item7
quad = MeshQuad(CornerA=item_3.Item, CornerB=item_3.Item1, CornerC=item_3.Item3, CornerD=item_3.Item2)
conmesh = ConstructMesh(Vertices=node_locations, Faces=flatten(quad))

panel_5 = Panel(shift)
item_4 = ListItem(List=node_locations, Index=split.Positive, Wrap=True)
points = PointList(Points=item_4)
quad4mem = _4NodeQuadMembrane(Mesh=conmesh, Displacments=displacement_vectors, PoissonsRatio="0.15")  # -> PrincipleDirection1, PrincipleDirection2
pt = ConstructPoint(XCoordinate=Slider(-1.626, range=-5..5), YCoordinate=0, ZCoordinate=Slider(-5, range=-5..5))

# ----
# Results
# Evaluation
md_slider = MDSlider(
    SliderMode=0,
    slider_value=Point(0.2917629335, 0.1083024188, 0.5),
    x_domain=Domain(0, 8),
    y_domain=Domain(0, 8),
    z_domain=Domain(0, 1))
eval = EvaluatePrincipalMesh(Principal=quad4mem.PrincipleDirection2, Location=pt)
eval_2 = EvaluatePrincipalMesh(Principal=quad4mem.PrincipleDirection1, Location=pt)
vdis = VectorDisplay(Anchor=pt, Vector=eval_2)
vdis_2 = VectorDisplay(Anchor=pt, Vector=eval)

number_slider = Slider(2, range=1..5)

# ----
# Stress Lines
md_slider_2 = MDSlider(
    SliderMode=0,
    slider_value=Point(0.4701731612, 0, 0.5),
    x_domain=Domain(0, 8),
    y_domain=Domain(0, 8),
    z_domain=Domain(0, 1))
_10º = PowerOf10(Value=Slider(-4, range=-10..0))
sls = StressLines(
    PrincipalMesh=quad4mem.PrincipleDirection2,
    Seed=md_slider_2,
    StepTolerance=Slider(0.1, range=0..1),
    MaxError=_10º,
    SeedingMethod="1",
    Seperation=Slider(0.1, range=0..0.1),
    TestDist="0.05")
previewlw = CustomPreviewLineweights(Geometry=sls, Shader=ColourSwatch(SwatchColor=RGB(255, 143, 212)), Thickness=number_slider, Absolute=False)

# ----
# Stress Line
md_slider_3 = MDSlider(
    SliderMode=0,
    slider_value=Point(0.8094214463, 0.5273817109, 0.5),
    x_domain=Domain(0, 8),
    y_domain=Domain(0, 8),
    z_domain=Domain(0, 1))
_10º_2 = PowerOf10(Value=Slider(-4, range=-10..0))
stress_line = StressLine(
    PrincipalMesh=quad4mem.PrincipleDirection2,
    Seed=md_slider_2,
    StepTolerance=Slider(0.02, range=0..1),
    IntegrationMethod="4",
    MaxError=_10º_2)  # disabled
preview = CustomPreview(
    Geometry=stress_line,
    Material={diffuse=RGB(13, 201, 0), emission=RGB(4, 60, 0), shine=0.5, specular=RGB(255, 255, 255), transparency=0})

# ----
# Stress Lines
md_slider_4 = MDSlider(
    SliderMode=0,
    slider_value=Point(0.7115493402, 0.5547559785, 0.5),
    x_domain=Domain(0, 8),
    y_domain=Domain(0, 8),
    z_domain=Domain(0, 1))
_10º_3 = PowerOf10(Value=Slider(-6, range=-10..0))
sls_2 = StressLines(
    PrincipalMesh=quad4mem.PrincipleDirection1,
    Seed=md_slider_2,
    StepTolerance=Slider(0.1, range=0..1),
    MaxError=_10º_3,
    SeedingMethod="1",
    Seperation=Slider(0.1, range=0..0.1),
    TestDist="0.05")
previewlw_2 = CustomPreviewLineweights(Geometry=sls_2, Shader=ColourSwatch(SwatchColor=RGB(82, 184, 59)), Thickness=number_slider, Absolute=False)

# ----
# Stress Line
md_slider_5 = MDSlider(
    SliderMode=0,
    slider_value=Point(0.8094214463, 0.5273817109, 0.5),
    x_domain=Domain(0, 8),
    y_domain=Domain(0, 8),
    z_domain=Domain(0, 1))
_10º_4 = PowerOf10(Value=Slider(-4, range=-10..0))
stress_line_2 = StressLine(
    PrincipalMesh=quad4mem.PrincipleDirection1,
    Seed=md_slider_2,
    StepTolerance=Slider(0.02, range=0..1),
    IntegrationMethod="4",
    MaxError=_10º_4)
preview_2 = CustomPreview(
    Geometry=stress_line_2,
    Material={diffuse=RGB(13, 201, 0), emission=RGB(4, 60, 0), shine=0.5, specular=RGB(255, 255, 255), transparency=0})

pt_2 = Point(md_slider_2)
