# Grasshopper definition LilyPad_Example-SlabStressLines8NodeElements From GSA.gh (Grasshopper 1.0.7)
# plug-ins: LilyPad, Human, GSA, Pufferfish, treesloth01

# C:\Users\Matt C\Documents\GitHub\PrincipalStressLines\Example Files\GSA  Model.gwb
panel = Panel("C:\Users\Matt C\Documents\GitHub\PrincipalStressLines\Example Files\GSA  Model.gwb")
open = OpenModel(FilenameAndPath=panel)
getanalysis = GetModelAnalysis(GSAModel=open)  # -> AnalysisTasks, AnalysisCases, CombinationCases, DesignTasks
panel_2 = Panel(getanalysis.AnalysisCases)
selres = SelectResult(GSAModel=open, Type="AnalysisCase", Case_ID="A1")
selres_2 = SelectResult(GSAModel=open, Type="AnalysisCase", Case_ID="A1")
getgeo = GetModelGeometry(GSAModel=open, Mode=1, Unit="m")  # -> NodesIn_m, _1DElementsIn_m, _2DElementsIn_m, _3DElementsIn_m, _1DMembersIn_m, _2DMembersIn_m, _3DMembersIn_m, Assemblies
nodedisp = NodeDisplacements(Result=selres, Max_Min="All", Unit="mm")  # -> TranslationsX_mm, TranslationsY_mm, TranslationsZ_mm, TranslationsXYZ_mm, RotationXX_rad, RotationYY_rad, RotationZZ_rad, RotationXYZ_rad, NodeIDs
nodeedit = EditNode(Node=getgeo.NodesIn_m, Mode=1)  # -> Node, NodeNumber, NodePosition, NodeLocalAxis, NodeRestraints, DamperProperty, MassProperty, SpringProperty, NodeName, NodeColour
pt = Point(getgeo.NodesIn_m)
elem2dedit = Edit2DElement(Element2D=getgeo._2DElementsIn_m, Preview3dSection=False)  # -> Element2D, Number, Geometry, _2DProperty, Group, ElementType, Offset, OrientationAngle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
num = Number(nodedisp.RotationXX_rad)
num_2 = Number(nodedisp.RotationYY_rad)
num_3 = Number(nodedisp.RotationZZ_rad)
subtraction = Subtraction(A=elem2dedit.Topology, B=1)
listdexs = ListIndices()
vec = VectorXYZ(XComponent=num, YComponent=num_2, ZComponent=num_3)  # -> Vector, Length
int = Integer(nodeedit.NodeNumber)
int_2 = Integer(elem2dedit.Topology)
int_3 = Integer(subtraction)
mindex = MemberIndex(Set=int, Member=int_2)  # -> Index, Count
shift = ShiftPaths(Data=mindex.Index, Offset=-1)
panel_3 = Panel(shift)

# ----
# FEA Data Import
displacement_vectors = Vector(vec.Vector)
element_node_ids = Number(simplify(shift))
node_locations = Point(nodeedit.NodePosition)
panel_4 = Panel("""{14}
{232}
{450}
{794}
{1230}
{1574}
{1792}
{2010}""")
split = SplitTree(Data=element_node_ids, Masks=flatten(panel_4))  # -> Positive, Negative

# ----
# Setup
item = ListItem(List=node_locations, Index=element_node_ids, Wrap=True)
item_2 = ListItem(List=displacement_vectors, Index=element_node_ids, Wrap=True)
item_3 = ListItem(List=item, Index=0, Wrap=True)  # -> Item, Item1, Item2, Item3, Item4, Item5, Item6, Item7
item_4 = ListItem(List=item_2, Index=0, Wrap=True)  # -> Item, Item1, Item2, Item3, Item4, Item5, Item6, Item7
item_5 = ListItem(List=element_node_ids, Index=0, Wrap=True)  # -> Item, Item1, Item2, Item3, Item4, Item5, Item6, Item7
merge = Merge(Data1=item_3.Item1, Data2=item_3.Item3, Data3=item_3.Item5, Data4=item_3.Item7)  # -> flatten(Result)
merge_2 = Merge(Data1=item_4.Item1, Data2=item_4.Item3, Data3=item_4.Item5, Data4=item_4.Item7)  # -> flatten(Result)
quad = MeshQuad(CornerA=item_5.Item4, CornerB=item_5.Item2, CornerC=item_5.Item, CornerD=item_5.Item6)
conmesh = ConstructMesh(Vertices=node_locations, Faces=flatten(quad))
cullpt = CullDuplicates(Points=merge, Tolerance=0.001, CullMode=1)  # -> Points, Indices, Valence
item_6 = ListItem(List=merge_2, Index=cullpt.Indices, Wrap=True)
_8isoparaslab = _8NodeIsoparametricSlab(
    Mesh=conmesh,
    MidNodes=cullpt.Points,
    RotationsCorners=displacement_vectors,
    RotationsMidNodes=item_6,
    PoissonsRatio="0.15")  # -> PrincipleDirection1, PrincipleDirection2; disabled

panel_6 = Panel(quad)
panel_7 = Panel("C:\Users\Matt C\Documents\GitHub\PrincipalStressLines\Example Files\GSA  Model.gwb")

# ----
# Results
# Evaluation
md_slider = MDSlider(
    SliderMode=0,
    slider_value=Point(0.3912978754, 0.9218452268, 0.5),
    x_domain=Domain(0, 8),
    y_domain=Domain(0, 8),
    z_domain=Domain(0, 1))
eval = EvaluatePrincipalMesh(Principal=_8isoparaslab.PrincipleDirection2, Location=md_slider)
eval_2 = EvaluatePrincipalMesh(Principal=_8isoparaslab.PrincipleDirection1, Location=md_slider)
vdis = VectorDisplay(Anchor=md_slider, Vector=eval_2)
vdis_2 = VectorDisplay(Anchor=md_slider, Vector=eval)

open_2 = OpenModel(FilenameAndPath=panel_7)
number_slider = Slider(2, range=1..5)

# ----
# Stress Lines
md_slider_2 = MDSlider(
    SliderMode=0,
    slider_value=Point(0.7115493402, 0.5547559785, 0.5),
    x_domain=Domain(0, 8),
    y_domain=Domain(0, 8),
    z_domain=Domain(0, 1))
_10º = PowerOf10(Value=Slider(-6, range=-10..0))
sls = StressLines(
    PrincipalMesh=_8isoparaslab.PrincipleDirection1,
    Seed=md_slider_2,
    StepTolerance=Slider(0.1, range=0..1),
    MaxError=_10º,
    SeedingMethod="1",
    Seperation=Slider(0.1, range=0..0.1),
    TestDist="0.05")
previewlw = CustomPreviewLineweights(Geometry=sls, Shader=ColourSwatch(SwatchColor=RGB(82, 184, 59)), Thickness=number_slider, Absolute=False)

# ----
# Stress Lines
md_slider_3 = MDSlider(
    SliderMode=0,
    slider_value=Point(0.6700856279, 0.6273163586, 0.5),
    x_domain=Domain(0, 8),
    y_domain=Domain(0, 8),
    z_domain=Domain(0, 1))
_10º_2 = PowerOf10(Value=Slider(-4, range=-10..0))
sls_2 = StressLines(
    PrincipalMesh=_8isoparaslab.PrincipleDirection2,
    Seed=md_slider_3,
    StepTolerance=Slider(0.1, range=0..1),
    MaxError=_10º_2,
    SeedingMethod="1",
    Seperation=Slider(0.1, range=0..0.1),
    TestDist="0.05")
previewlw_2 = CustomPreviewLineweights(Geometry=sls_2, Shader=ColourSwatch(SwatchColor=RGB(255, 143, 212)), Thickness=number_slider, Absolute=False)

# ----
# Stress Line
md_slider_4 = MDSlider(
    SliderMode=0,
    slider_value=Point(0.7233380574, 0.6823313643, 0.5),
    x_domain=Domain(0, 8),
    y_domain=Domain(0, 8),
    z_domain=Domain(0, 1))
_10º_3 = PowerOf10(Value=Slider(-4, range=-10..0))
stress_line = StressLine(
    PrincipalMesh=_8isoparaslab.PrincipleDirection2,
    Seed=md_slider_3,
    StepTolerance=Slider(0.02, range=0..1),
    IntegrationMethod="4",
    MaxError=_10º_3)
preview = CustomPreview(
    Geometry=stress_line,
    Material={diffuse=RGB(13, 201, 0), emission=RGB(4, 60, 0), shine=0.5, specular=RGB(255, 255, 255), transparency=0})
