# Grasshopper definition LilyPad_Example-SlabStressLines8NodeElements.gh (Grasshopper 1.0.7)
# plug-ins: Human, LilyPad

# ----
# FEA
# Data
element_node_ids = Number(simplify(Tree({0}: [2, 287, 33, 317, 61, 318, 32, 316], {1}: [32, 318, 61, 319, 62, 320, 31, 315], {2}: [31, 320, 62, 321, 63, 322, 30, 314], {3}: [30, 322, 63, 323, 64, 324, 29, 313], {4}: [29, 324, 64, 325, 65, 326, 28, 312], {5}: [28, 326, 65, 327, 66, 328, 27, 311]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)))
displacement_vectors = Vector([Vector(-0.0009694475259, 0.0009694475259, 0), Vector(-0.001114443219, 0.0001603143681, 0), Vector(-0.0001126022809, 0.0001126022809, 0), Vector(-0.0001603143681, 0.001114443219, 0), Vector(-0.0001635218399, 0.001045261495, 0), Vector(-0.0001660684936, 0.0009755688356, 0)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])
node_locations = Point([Point(1, 1, 0), Point(1, 0, 0), Point(0, 0, 0), Point(0, 1, 0), Point(0, 0.9333, 0), Point(0, 0.8667, 0)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])

panel = Panel("""{14}
{232}
{450}
{794}
{1230}
{1574}
{1792}
{2010}""")
split = SplitTree(Data=element_node_ids, Masks=flatten(panel))  # -> Positive, Negative
subtraction = Subtraction(A=split.Negative, B=1)
item = ListItem(List=node_locations, Index=subtraction, Wrap=True)
item_2 = ListItem(List=displacement_vectors, Index=subtraction, Wrap=True)
item_3 = ListItem(List=item, Index=0, Wrap=True)  # -> Item, Item1, Item2, Item3, Item4, Item5, Item6, Item7
item_4 = ListItem(List=item_2, Index=0, Wrap=True)  # -> Item, Item1, Item2, Item3, Item4, Item5, Item6, Item7
item_5 = ListItem(List=subtraction, Index=0, Wrap=True)  # -> Item, Item1, Item2, Item3, Item4, Item5, Item6, Item7
merge = Merge(Data1=item_3.Item1, Data2=item_3.Item3, Data3=item_3.Item5, Data4=item_3.Item7)  # -> flatten(Result)
merge_2 = Merge(Data1=item_4.Item1, Data2=item_4.Item3, Data3=item_4.Item5, Data4=item_4.Item7)  # -> flatten(Result)
quad = MeshQuad(CornerA=item_5.Item4, CornerB=item_5.Item2, CornerC=item_5.Item, CornerD=item_5.Item6)
cullpt = CullDuplicates(Points=merge, Tolerance=0.001, CullMode=1)  # -> Points, Indices, Valence
conmesh = ConstructMesh(Vertices=node_locations, Faces=flatten(quad))
item_6 = ListItem(List=merge_2, Index=cullpt.Indices, Wrap=True)
_8isoparaslab = _8NodeIsoparametricSlab(
    Mesh=conmesh,
    MidNodes=cullpt.Points,
    RotationsCorners=displacement_vectors,
    RotationsMidNodes=item_6,
    PoissonsRatio="0.15")  # -> PrincipleDirection1, PrincipleDirection2

# ----
# Streamline
md_slider = MDSlider(
    SliderMode=0,
    slider_value=Point(0.7233380574, 0.6823313643, 0.5),
    x_domain=Domain(0, 8),
    y_domain=Domain(0, 8),
    z_domain=Domain(0, 1))
_10º = PowerOf10(Value=Slider(-4, range=-10..0))
streamline = Streamline(
    PrincipalMesh=_8isoparaslab.PrincipleDirection1,
    Seed=md_slider,
    StepTolerance=Slider(0.02, range=0..1),
    IntegrationMethod="4",
    MaxError=_10º)
preview = CustomPreview(
    Geometry=streamline,
    Material={diffuse=RGB(13, 201, 0), emission=RGB(4, 60, 0), shine=0.5, specular=RGB(255, 255, 255), transparency=0})

# ----
# Evaluation
md_slider_2 = MDSlider(
    SliderMode=0,
    slider_value=Point(0.3912978754, 0.9218452268, 0.5),
    x_domain=Domain(0, 8),
    y_domain=Domain(0, 8),
    z_domain=Domain(0, 1))
eval = EvaluatePrincipalMesh(Principal=_8isoparaslab.PrincipleDirection2, Location=md_slider_2)
eval_2 = EvaluatePrincipalMesh(Principal=_8isoparaslab.PrincipleDirection1, Location=md_slider_2)
vdis = VectorDisplay(Anchor=md_slider_2, Vector=eval_2)
vdis_2 = VectorDisplay(Anchor=md_slider_2, Vector=eval)

number_slider = Slider(2, range=1..5)

# ----
# Streamlines
md_slider_3 = MDSlider(
    SliderMode=0,
    slider_value=Point(0.6700856279, 0.6273163586, 0.5),
    x_domain=Domain(0, 8),
    y_domain=Domain(0, 8),
    z_domain=Domain(0, 1))
_10º_2 = PowerOf10(Value=Slider(-4, range=-10..0))
streamlines = Streamlines(
    PrincipalMesh=_8isoparaslab.PrincipleDirection2,
    Seed=md_slider_3,
    StepTolerance=Slider(0.1, range=0..1),
    IntegrationMethod="4",
    MaxError=_10º_2,
    SeedingMethod="1",
    Seperation=Slider(0.1, range=0..0.1),
    TestDist="0")
previewlw = CustomPreviewLineweights(Geometry=streamlines, Shader=ColourSwatch(SwatchColor=RGB(232, 76, 34)), Thickness=number_slider, Absolute=False)

# ----
# Streamlines
md_slider_4 = MDSlider(
    SliderMode=0,
    slider_value=Point(0.6700856279, 0.6273163586, 0.5),
    x_domain=Domain(0, 8),
    y_domain=Domain(0, 8),
    z_domain=Domain(0, 1))
_10º_3 = PowerOf10(Value=Slider(-6, range=-10..0))
streamlines_2 = Streamlines(
    PrincipalMesh=_8isoparaslab.PrincipleDirection1,
    Seed=md_slider_4,
    StepTolerance=Slider(0.1, range=0..1),
    IntegrationMethod="4",
    MaxError=_10º_3,
    SeedingMethod="1",
    Seperation=Slider(0.1, range=0..0.1),
    TestDist="0")
previewlw_2 = CustomPreviewLineweights(Geometry=streamlines_2, Shader=ColourSwatch(SwatchColor=RGB(255, 189, 71)), Thickness=number_slider, Absolute=False)

explode = Explode(Curve=streamlines, Recursive=True)  # -> Segments, Vertices
# Principle Mesh Assembly
lng = ListLength(List=explode.Vertices)  # -> flatten(Length)
# Streamline
# Streamlines
# Streamlines
sort = SortList(Keys=lng)  # -> Keys, ValuesA
# Evaluation
# FEA
# Data
# Data Processing
# Principle Mesh Assembly
panel_2 = Panel(sort.Keys)
