# Grasshopper definition LilyPad_Example-Slab_8Node.gh (Grasshopper 1.0.8)
# plug-ins: Human, LilyPad

# ----
# FEA Data Import
displacement_vectors = Vector([Vector(-0.3817981184, 0, 0.3817981184), Vector(-0.3817981184, 0, -0.3817981184), Vector(0.3817981184, 0, -0.3817981184), Vector(0.3817981184, 0, 0.3817981184), Vector(-0.3582888544, 0, 0.3789351285), Vector(-0.3579543531, 0, 0.3579543531)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])
node_locations = Point([Point(-5, 0, -5), Point(5, 0, -5), Point(5, 0, 5), Point(-5, 0, 5), Point(-4.8, 0, -5), Point(-4.8, 0, -4.8)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])

element_node_ids = Number(simplify(Tree({0}: [4, 2601, 0, 2602, 2604, 5, 2603, 6], {1}: [5, 2603, 6, 2605, 2607, 7, 2606, 8], {2}: [7, 2606, 8, 2608, 2610, 9, 2609, 10], {3}: [9, 2609, 10, 2611, 2613, 11, 2612, 12], {4}: [11, 2612, 12, 2614, 2616, 13, 2615, 14], {5}: [13, 2615, 14, 2617, 2619, 15, 2618, 16]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)))
tstat = TreeStatistics(Tree=element_node_ids)  # -> Paths, Length, Count
item = ListItem(List=tstat.Paths, Index=0, Wrap=True)

# ----
# Setup
item_2 = ListItem(List=node_locations, Index=element_node_ids, Wrap=True)
item_3 = ListItem(List=displacement_vectors, Index=element_node_ids, Wrap=True)
item_4 = ListItem(List=item_2, Index=0, Wrap=True)  # -> Item, Item1, Item2, Item3, Item4, Item5, Item6, Item7
item_5 = ListItem(List=item_3, Index=0, Wrap=True)  # -> Item, Item1, Item2, Item3, Item4, Item5, Item6, Item7
item_6 = ListItem(List=element_node_ids, Index=0, Wrap=True)  # -> Item, Item1, Item2, Item3, Item4, Item5, Item6, Item7
merge = Merge(Data1=item_4.Item1, Data2=item_4.Item3, Data3=item_4.Item4, Data4=item_4.Item6)  # -> flatten(Result)
merge_2 = Merge(Data1=item_5.Item1, Data2=item_5.Item3, Data3=item_5.Item4, Data4=item_5.Item6)  # -> flatten(Result)
quad = MeshQuad(CornerA=item_6.Item, CornerB=item_6.Item2, CornerC=item_6.Item7, CornerD=item_6.Item5)
conmesh = ConstructMesh(Vertices=node_locations, Faces=flatten(quad))
cullpt = CullDuplicates(Points=merge, Tolerance=0.001, CullMode=1)  # -> Points, Indices, Valence
item_7 = ListItem(List=merge_2, Index=cullpt.Indices, Wrap=True)
_8isoparaslab = _8NodeIsoparametricSlab(
    Mesh=conmesh,
    MidNodes=cullpt.Points,
    RotationsCorners=displacement_vectors,
    RotationsMidNodes=item_7,
    PoissonsRatio="0.15")  # -> PrincipleDirection1, PrincipleDirection2

split = SplitTree(Data=element_node_ids, Masks=flatten(item))  # -> Positive, Negative
item_8 = ListItem(List=node_locations, Index=split.Positive, Wrap=True)
points = PointList(Points=item_8)
preview = CustomPreview(Geometry=conmesh, Material=ColourSwatch(SwatchColor=RGB(128, 128, 128)))
pt = Point(Point(0.06335881407, 0, -0.1752870659))

# ----
# Stress Line
number_slider = Slider(-4, range=-10..0)
_10º = PowerOf10(Value=number_slider)
stress_line = StressLine(PrincipalMesh=_8isoparaslab.PrincipleDirection2, Seed=pt, StepTolerance=Slider(0.02, range=0..1), IntegrationMethod=_10º)
preview_2 = CustomPreview(
    Geometry=stress_line,
    Material={diffuse=RGB(255, 143, 212), emission=RGB(76, 43, 64), shine=0.5, specular=RGB(255, 255, 255), transparency=0})

# ----
# Stress Line
number_slider_2 = Slider(-4, range=-10..0)
_10º_2 = PowerOf10(Value=number_slider_2)
stress_line_2 = StressLine(
    PrincipalMesh=_8isoparaslab.PrincipleDirection1,
    Seed=pt,
    StepTolerance=Slider(0.02, range=0..1),
    IntegrationMethod=_10º_2)
preview_3 = CustomPreview(
    Geometry=stress_line_2,
    Material={diffuse=RGB(82, 184, 59), emission=RGB(25, 55, 18), shine=0.5, specular=RGB(255, 255, 255), transparency=0})

# ----
# Evaluation
eval = EvaluatePrincipalMesh(Principal=_8isoparaslab.PrincipleDirection2, Location=pt)
# Results
eval_2 = EvaluatePrincipalMesh(Principal=_8isoparaslab.PrincipleDirection1, Location=pt)
vdis = VectorDisplay(Anchor=pt, Vector=eval_2)
vdis_2 = VectorDisplay(Anchor=pt, Vector=eval)

# ----
# Evenly Spaced Stress Lines
number_slider_3 = Slider(-8, range=-10..0)
number_slider_4 = Slider(0.1, range=0..1)
number_slider_5 = Slider(0.5, range=0..1)
number_slider_6 = Slider(0.05, range=0..0.1)
_10º_3 = PowerOf10(Value=number_slider_3)
number_slider_7 = Slider(5, range=1..5)
sls = StressLines(
    PrincipalMesh=_8isoparaslab.PrincipleDirection1,
    Seed=pt,
    StepTolerance=number_slider_4,
    MaxError=_10º_3,
    Seperation=number_slider_5,
    TestDist=number_slider_6)
previewlw = CustomPreviewLineweights(Geometry=sls, Shader=ColourSwatch(SwatchColor=RGB(82, 184, 59)), Thickness=number_slider_7, Absolute=False)

sls_2 = StressLines(
    PrincipalMesh=_8isoparaslab.PrincipleDirection2,
    Seed=pt,
    StepTolerance=number_slider_4,
    MaxError=_10º_3,
    Seperation=number_slider_5,
    TestDist=number_slider_6)

previewlw_2 = CustomPreviewLineweights(Geometry=sls_2, Shader=ColourSwatch(SwatchColor=RGB(255, 143, 212)), Thickness=number_slider_7, Absolute=False)
