# Grasshopper definition LilyPad_Example-Vector Mesh.gh (Grasshopper 1.0.8)
# plug-ins: GSA, LilyPad

series = Series(Start=0, Step=1, Count=10)
pt = ConstructPoint(XCoordinate=series, YCoordinate=0, ZCoordinate=0)
yz = YZPlane(Origin=pt)
rectangle = Rectangle(Plane=PlaneXY(0, 0, 0), XSize="-100 to 100", YSize="-100 to 100", Radius=0)  # -> Rectangle, Length
cir = Circle(Plane=yz, Radius="5")
split = SplitWithBrep(Curve=cir, Brep=rectangle.Rectangle)  # -> Curve, Points
item = ListItem(List=split.Curve, Index=0, Wrap=True)  # -> flatten(Item)
md_slider = MDSlider(
    SliderMode=0,
    slider_value=Point(0.4992720441, 0.500380865, 0.5),
    x_domain=Domain(0, 1),
    y_domain=Domain(0, 1),
    z_domain=Domain(0, 1))
loft = Loft(Curves=item, Options={Adjust=False, Closed=False, LoftEnds=0, LoftSimp=0, LoftType=0, Rebuild=10, Refit=0.01})
mesh_uv = MeshSurface(Surface=loft, UCount="50", VCount="50", Overhang=True, Equalize=False)
evalsrf = EvaluateSurface(Surface=reparameterize(loft), Point=md_slider)  # -> Point, Normal, UDirection, VDirection, Frame
demesh = DeconstructMesh(Mesh=mesh_uv)  # -> Vertices, Faces, Colours, Normals
cp = ClosestPoint(Point=evalsrf.Point, Cloud=demesh.Vertices)  # -> ClosestPoint, CPIndex, Distance
cps = ClosestPoints(Point=evalsrf.Point, Cloud=demesh.Vertices, Count=Slider(5, range=0..10))  # -> ClosestPoint, CPIndex, Distance
rectangle_2 = Rectangle(Plane=PlaneXY(0, 0, 0), XSize="-1 to 1", YSize="-1 to 1", Radius=0)  # -> Rectangle, Length
medges = MeshEdges(Mesh=mesh_uv)  # -> NakedEdges, InteriorEdges, NonManifoldEdges
pt_2 = ConstructPoint(XCoordinate=0, YCoordinate=0, ZCoordinate=0)
join = JoinCurves(Curves=medges.NakedEdges, Preserve=False)
splitatcorners = SplitAtCorners(Poly=join, Angle=Slider(0.785, range=0..1))  # -> Corners, Parts
pcharge = PointCharge(Point=pt_2, Charge=1, Decay=2)
mesh_uv_2 = MeshSurface(Surface=rectangle_2.Rectangle, UCount="10", VCount="10", Overhang=True, Equalize=False)
item_2 = ListItem(List=splitatcorners.Parts, Index=[0, 2], Wrap=True)
mat = CreateMaterial(Material_type="Steel", Design_Code="EN 1993-1-1:2005", Grade="S355")
facen = FaceNormals(Mesh=mesh_uv_2)  # -> Centers, Normals
explode = Explode(Curve=item_2, Recursive=True)  # -> Segments, Vertices
lng = ListLength(List=facen.Centers)
X = UnitX(Factor=1)
loadcase = CreateLoadCase(CaseID="1", Name="DL", Type="Dead")
evf = EvaluateField(Field=pcharge, Point=facen.Centers)  # -> unitize(Tensor), Strength
dup = DuplicateData(Data=X, Number=lng, Order=True)
duppt = RemoveDuplicatePts(Points=explode.Vertices, Tolerance=0.01)
prop2d = Create2DProperty(Thickness_cm="2", Material=mat, Type="Shell", Unit="cm")
vectormesh = CreateVectorMesh(Mesh=mesh_uv_2, Vectors=evf.Tensor, Radius="0.3")
support = CreateSupport(Point=duppt, Plane=PlaneXY(0, 0, 0), x=True, xx=False, y=True, yy=False, z=True, zz=False)
md_slider_2 = MDSlider(
    SliderMode=0,
    slider_value=Point(0.3836952768, 0.1722315346, 0.5),
    x_domain=Domain(0, 1),
    y_domain=Domain(0, 1),
    z_domain=Domain(0, 1))
σa = CreateAnalysisCase(Name="L1", Description="L1")
elem2d = Create2DElement(Geometry=mesh_uv, Property2D=prop2d, Preview3dSection=False)
loadcase_2 = CreateLoadCase(CaseID="1", Name="DL", Type="Dead")
σt = CreateAnalysisTask(AnalysisCases=σa, casesParamIndex=2, Solver="Static")
nodeload = CreateNodeLoad(LoadCase=loadcase, NodeList=cps.ClosestPoint, Direction="z", Value_kN="-1", Type="NodeForce", Unit="kN")
eval = EvaluatePrincipalMesh(Principal=vectormesh, Location=md_slider_2)
faceload = CreateFaceLoad(
    LoadCase=loadcase_2,
    Loadable2DObjects=elem2d,
    Axis=-1,
    Direction="z",
    Projected=False,
    Value_kN_m²="-1",
    Type="Uniform",
    Unit="kN/m²")
division = Division(A="0.1", B=2)
stress_line = StressLine(PrincipalMesh=vectormesh, Seed=md_slider_2, StepTolerance="0.01", IntegrationMethod="4", MaxError=1.570796327)
vdis = VectorDisplay(Anchor=md_slider_2, Vector=eval)
sls = StressLines(
    PrincipalMesh=vectormesh,
    Seed=md_slider_2,
    StepTolerance="0.01",
    MaxError="0.001",
    SeedingMethod="1",
    Seperation="0.1",
    TestDist=division)
model = CreateModel(
    GSAGeometryIn_m=flatten([support, elem2d]),
    Load=nodeload,
    AnalysisTasksCombinations=σt,
    ReMesh=True,
    Tolerance=0.01,
    Unit="m")
panel = Panel("C:\Users\4Matt\Documents\GitHub\PrincipalStressLines\Example Files\Cylindrical Shell.gwb")
save = Button()
save_2 = SaveGSAModel(GSAModel=model, Save=save, FileAndPath=panel)
