# Grasshopper definition LilyPad_Example-Vector Mesh_1.gh (Grasshopper 1.0.8)
# plug-ins: Karamba3D, LilyPad

series = Series(Start=0, Step=1, Count=10)
pt = ConstructPoint(XCoordinate=series, YCoordinate=0, ZCoordinate=0)
yz = YZPlane(Origin=pt)
rectangle = Rectangle(Plane=PlaneXY(0, 0, 0), XSize="-100 to 100", YSize="-100 to 100", Radius=0)  # -> Rectangle, Length
cir = Circle(Plane=yz, Radius="5")
split = SplitWithBrep(Curve=cir, Brep=rectangle.Rectangle)  # -> Curve, Points
item = ListItem(List=split.Curve, Index=0, Wrap=True)  # -> flatten(Item)
md_slider = MDSlider(
    SliderMode=0,
    slider_value=Point(0.4992720441, 0.500380865, 0.5),
    x_domain=Domain(0, 1),
    y_domain=Domain(0, 1),
    z_domain=Domain(0, 1))
loft = Loft(Curves=item, Options={Adjust=False, Closed=False, LoftEnds=0, LoftSimp=0, LoftType=0, Rebuild=10, Refit=0.01})
evalsrf = EvaluateSurface(Surface=reparameterize(loft), Point=md_slider)  # -> Point, Normal, UDirection, VDirection, Frame
triremesh = TriRemesh(Geometry=loft, Length="0.25", Iterations=25)  # -> Triangulation, Dual, Creases
demesh = DeconstructMesh(Mesh=triremesh.Triangulation)  # -> Vertices, Faces, Colours, Normals
matselect = MaterialSelectionKaramba3D(menu=[dropdown(0), dropdown(0)])
cp = ClosestPoint(Point=evalsrf.Point, Cloud=demesh.Vertices)  # -> ClosestPoint, CPIndex, Distance
cps = ClosestPoints(Point=evalsrf.Point, Cloud=demesh.Vertices, Count=Slider(5, range=0..10))  # -> ClosestPoint, CPIndex, Distance
rectangle_2 = Rectangle(Plane=PlaneXY(0, 0, 0), XSize="-1 to 1", YSize="-1 to 1", Radius=0)  # -> Rectangle, Length
crosec = CrossSectionKaramba3D(FamilyNameOfCrossSection="DefaultCroSec", Material=matselect, Height_cm=1, mode="Shell - Const")
medges = MeshEdges(Mesh=triremesh.Triangulation)  # -> NakedEdges, InteriorEdges, NonManifoldEdges
pt_2 = ConstructPoint(XCoordinate=0, YCoordinate=0, ZCoordinate=0)
join = JoinCurves(Curves=medges.NakedEdges, Preserve=False)
splitatcorners = SplitAtCorners(Poly=join, Angle=Slider(0.785, range=0..1))  # -> Corners, Parts
pcharge = PointCharge(Point=pt_2, Charge=1, Decay=2)
mesh_uv = MeshSurface(Surface=rectangle_2.Rectangle, UCount="10", VCount="10", Overhang=True, Equalize=False)
item_2 = ListItem(List=splitatcorners.Parts, Index=[0, 2], Wrap=True)
facen = FaceNormals(Mesh=mesh_uv)  # -> Centers, Normals
explode = Explode(Curve=item_2, Recursive=True)  # -> Segments, Vertices
lng = ListLength(List=facen.Centers)
X = UnitX(Factor=1)
surfelem = CreateSurfaceElementKaramba3D(Mesh=triremesh.Triangulation, CrossSection=crosec, LimitDistance_m=0.005, Bending=True, mode="MeshToShell")  # -> Element, Points, Info
Z = UnitZ(Factor="-1")
evf = EvaluateField(Field=pcharge, Point=facen.Centers)  # -> unitize(Tensor), Strength
dup = DuplicateData(Data=X, Number=lng, Order=True)
duppt = RemoveDuplicatePts(Points=explode.Vertices, Tolerance=0.01)
loads = LoadsKaramba3D(ForceVector=Z, Local=False, PosInd=cps.ClosestPoint, LCase="LC0", mode="Point")
vectormesh = CreateVectorMesh(Mesh=mesh_uv, Vectors=evf.Tensor, Radius="0.3")
supp = SupportKaramba3D(PosInd=duppt, Ct_kN_m=Vector(0, 0, 0), Cr_kNm_rad=Vector(0, 0, 0), menu=[buttons(on, on, on, off, off, off)])
md_slider_2 = MDSlider(
    SliderMode=0,
    slider_value=Point(0.3836952768, 0.1722315346, 0.5),
    x_domain=Domain(0, 1),
    y_domain=Domain(0, 1),
    z_domain=Domain(0, 1))
eval = EvaluatePrincipalMesh(Principal=vectormesh, Location=md_slider_2)
division = Division(A="0.1", B=2)
stress_line = StressLine(PrincipalMesh=vectormesh, Seed=md_slider_2, StepTolerance="0.01", IntegrationMethod="4", MaxError=1.570796327)
vdis = VectorDisplay(Anchor=md_slider_2, Vector=eval)
assemble = AssembleModelKaramba3D(Elem=flatten(surfelem.Element), Support=flatten(supp), Load=flatten(loads), LimitDistance_m=0.005)  # -> Model, Info, Mass_kg, CentreOfGravity, LoadCaseNames
sls = StressLines(
    PrincipalMesh=vectormesh,
    Seed=md_slider_2,
    StepTolerance="0.01",
    MaxError="0.001",
    SeedingMethod="1",
    Seperation="0.1",
    TestDist=division)
license = LicenseKaramba3D()
panel = Panel(license)
analyse = AnalyseKaramba3D(Model=assemble.Model)  # -> AnalysedModel, MaximumDisplacement_cm, ResultingForce_kN, ChangeOfElasticEnergy_kNm
disassemble = DisassembleModelKaramba3D(Model=analyse.AnalysedModel)  # -> Model, Point, Beam, Shell, Support, Load, Line, Mesh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
s_forces = ShellForcesKaramba3D(AnalysedModel=analyse.AnalysedModel, mode="Local")  # -> Model, Nxx_kN_m, Nyy_kN_m, Nxy_kN_m, Mxx_kNm_m, Myy_kNm_m, Mxy_kNm_m, Vx_kN_m, Vy_kN_m, LoadCaseIndex
nodedisp = NodalDisplacementsKaramba3D(AnalysedModel=analyse.AnalysedModel)  # -> Model, flatten(NodalTranslations_m), NodalRotations_rad, DisplacementPosition, LoadCaseIndex
shellvecresults = ResultVectorsOnShellsKaramba3D(Model=analyse.AnalysedModel, LayerPosition=0, mode="PrincStress")  # -> Model, Points, FirstPrincipalStressVector_kN_cm², SecondPrincipalStressVector_kN_cm², FirstPrincipalStressValue_kN_cm², SecondPrincipalStressValue_kN_cm²
mesh = Mesh(disassemble.Shell)
devec = DeconstructVector(Vector=nodedisp.NodalRotations_rad)  # -> XComponent, YComponent, ZComponent
vec = Vector(unitize(flatten(shellvecresults.SecondPrincipalStressVector_kN_cm²)))
vec_2 = Vector(unitize(flatten(shellvecresults.FirstPrincipalStressVector_kN_cm²)))
pt_3 = Point(shellvecresults.Points)
pt_4 = Point(shellvecresults.Points)
neg = Negative(Value=s_forces.Nxx_kN_m)
neg_2 = Negative(Value=devec.XComponent)
c_script = CSharpScript(SigmaX=s_forces.Nxx_kN_m, SigmaY=s_forces.Nyy_kN_m, TauXY=s_forces.Nxy_kN_m)  # -> out, theta, vector; inputs SigmaX: Double, SigmaY: Double, TauXY: Double
# ---------- c_script: C# ----------
// Grasshopper Script Instance
#region Usings
using System;
using System.Linq;
using System.Collections;
using System.Collections.Generic;
using System.Drawing;

using Rhino;
using Rhino.Geometry;

using Grasshopper;
using Grasshopper.Kernel;
using Grasshopper.Kernel.Data;
using Grasshopper.Kernel.Types;
#endregion

public class Script_Instance : GH_ScriptInstance
{
    #region Notes
    /* 
      Members:
        RhinoDoc RhinoDocument
        GH_Document GrasshopperDocument
        IGH_Component Component
        int Iteration

      Methods (Virtual & overridable):
        Print(string text)
        Print(string format, params object[] args)
        Reflect(object obj)
        Reflect(object obj, string method_name)
    */
    #endregion

    private void RunScript(
		double SigmaX,
		double SigmaY,
		double TauXY,
		ref object theta,
		ref object vector)
    {
        double Theta = Math.Atan(2 * TauXY / (SigmaX - SigmaY)) / 2;

        if (SigmaY > (SigmaX + SigmaY) / 2)
        {
            if (TauXY > 0) Theta -= Math.PI / 2;
            else Theta += Math.PI / 2;
        }


        Vector3d Vector = new Vector3d(Math.Cos(Theta), Math.Sin(Theta),0);
        
        theta = Theta;
        vector = Vector;
    }
}
# ---------- end c_script ----------
c_script_2 = CSharpScript(SigmaX=s_forces.Nyy_kN_m, SigmaY=neg, TauXY=s_forces.Nxy_kN_m)  # -> out, theta, vector; inputs SigmaX: Double, SigmaY: Double, TauXY: Double; same code as c_script
vec_3 = VectorXYZ(XComponent=devec.YComponent, YComponent=neg_2, ZComponent=0)  # -> flatten(Vector), Length
division_2 = Division(A=vec, B=10)
division_3 = Division(A=vec_2, B=10)
facen_2 = FaceNormals(Mesh=triremesh.Triangulation)  # -> Centers, Normals
larger = LargerThan(SecondNumber=0)  # -> LargerThan, OrEqualTo
vec_4 = Vector(unitize(flatten(c_script.vector)))
vdisex = VectorDisplayEx(Point=pt_3, Vector=division_2, Colour=ColourSwatch(SwatchColor=RGB(115, 115, 115)), Width=2)
vdisex_2 = VectorDisplayEx(Point=pt_4, Vector=division_3, Colour=RGB(0, 0, 0), Width=2)
division_4 = Division(A=vec_4, B=10)
vdisex_3 = VectorDisplayEx(Point=pt_4, Vector=division_4, Colour=ColourSwatch(SwatchColor=RGB(255, 0, 0)), Width=2)
tri3mem = _3NodeTriangularMembrane(Mesh=mesh, Displacments=vec_3.Vector, PoissonsRatio="0.1")  # -> PrincipleDirection1, PrincipleDirection2
vectormesh_2 = CreateVectorMesh(Mesh=triremesh.Triangulation, Radius="0.3")  # disabled
md_slider_3 = MDSlider(
    SliderMode=0,
    slider_value=Point(0.2627340177, 0.6741355338, 0.5),
    x_domain=Domain(0, 1),
    y_domain=Domain(0, 1),
    z_domain=Domain(0, 1))
panel_2 = Panel(c_script_2.vector)
evalsrf_2 = EvaluateSurface(Surface=reparameterize(loft), Point=md_slider_3)  # -> Point, Normal, UDirection, VDirection, Frame
panel_3 = Panel("0.1")  # disabled
panel_4 = Panel("0.001")  # disabled
panel_5 = Panel("0.01")  # disabled
panel_6 = Panel("4")  # disabled
panel_7 = Panel("1")  # disabled
division_5 = Division(A=panel_3, B=2)  # disabled
stress_line_2 = StressLine(
    PrincipalMesh=tri3mem.PrincipleDirection1,
    Seed=evalsrf_2.Point,
    StepTolerance=panel_5,
    IntegrationMethod=panel_6,
    MaxError=1.570796327)  # disabled
sls_2 = StressLines(
    PrincipalMesh=tri3mem.PrincipleDirection1,
    Seed=evalsrf_2.Point,
    StepTolerance=panel_5,
    MaxError=panel_4,
    SeedingMethod=panel_7,
    Seperation=panel_3,
    TestDist=division_5)  # disabled
explode_2 = Explode(Curve=stress_line_2, Recursive=True)  # -> Segments, Vertices; disabled
eval_2 = EvaluatePrincipalMesh(Principal=tri3mem.PrincipleDirection1, Location=pt_4)
division_6 = Division(A=eval_2, B=10)
vdisex_4 = VectorDisplayEx(Point=pt_4, Vector=division_6, Colour=ColourSwatch(SwatchColor=RGB(255, 0, 0)), Width=2)
