# Grasshopper definition LilyPad_Simple Intro.gh (Grasshopper 1.0.8)
# plug-ins: MeshEdit Components, Human, RichedGraphMapper, Weaverbird, LilyPad

# ---- group: Step 1: Input Mesh With Four Basic Topologies
# Structure: 8 Node Quads, 4 Node Quads, 6 Node Triangles, 3 Node Triangles
# Analysis Input: None
# Field Generation Method: Displacement Field Method (Higher Order/Standard), Vector Filed Method
panel = Panel("0 to 1")
rectangle = Rectangle(Plane=PlaneXY(0, 0, 0), XSize=panel, YSize=panel, Radius=0)  # -> Rectangle, Length
cluster = Cluster_2(B=rectangle.Rectangle)  # -> M_2, M, mesh_2
cluster_2 = Cluster_3(M=cluster.M)  # -> M_3, M_2
merge = Merge(Data1=flatten(cluster.M_2), Data2=flatten(cluster_2.M_3))
list = ItemSelector(merge, {"Mesh (V:8  F:1)": "Mesh (V:8 F:1)", "Mesh (V:9  F:2)": "Mesh (V:9 F:2)"}, selected="Mesh (V:8  F:1)")

# ----
merge_2 = Merge(Data1=flatten(cluster.mesh_2), Data2=flatten(cluster_2.M_2))
list_2 = ItemSelector(merge_2, {"Mesh (V:4  F:1)": "Mesh (V:4 F:1)", "Mesh (V:4  F:2)": "Mesh (V:4 F:2)"}, selected="Mesh (V:4  F:2)")

# ---- group: Step 2:Create Nodal Translation For Mesh Node
demesh = DeconstructMesh(Mesh=list)  # -> Vertices, Faces, Colours, Normals
pdecon = Deconstruct(Point=demesh.Vertices)  # -> XComponent, YComponent, ZComponent
number_slider = Slider(0, range=0..100)
dom = ConstructDomain(DomainStart=number_slider, DomainEnd=Slider(0.54, range=0..3))
bnd = Bounds(Numbers=pdecon.XComponent)
bnd_2 = Bounds(Numbers=pdecon.XComponent)
dom_2 = ConstructDomain(DomainStart=number_slider, DomainEnd=Slider(0.05, range=0..3))
rich_graph = RichGraphMapper(
    Values=pdecon.XComponent,
    Source=bnd,
    Target=dom,
    Remap=False,
    x0=0,
    x1=1,
    y0=0,
    y1=0.54,
    Ox=0,
    Oy=0,
    Px=1,
    Py=1,
    container_name="Parabola")
rich_graph_2 = RichGraphMapper(
    Values=pdecon.XComponent,
    Source=bnd_2,
    Target=dom_2,
    Remap=False,
    x0=0,
    x1=1,
    y0=0,
    y1=0.05,
    container_name="Bezier",
    cpx=[0, 0.25, 0.75, 1],
    cpy=[0, 0.25, 0.75, 1])
neg = Negative(Value=rich_graph)
pt = ConstructPoint(XCoordinate=rich_graph_2, YCoordinate=neg, ZCoordinate=0)
vdis = VectorDisplay(Anchor=demesh.Vertices, Vector=pt)
move = Move(Geometry=demesh.Vertices, Motion=pt)  # -> Geometry, Transform
conmesh = ConstructMesh(Vertices=move.Geometry, Faces=demesh.Faces)

# ---- group: Step 2: Create Nodal Translation For Mesh Node
demesh_2 = DeconstructMesh(Mesh=list_2)  # -> Vertices, Faces, Colours, Normals
pdecon_2 = Deconstruct(Point=demesh_2.Vertices)  # -> XComponent, YComponent, ZComponent
number_slider_2 = Slider(0, range=0..100)
dom_3 = ConstructDomain(DomainStart=number_slider_2, DomainEnd=Slider(0.54, range=0..3))
bnd_3 = Bounds(Numbers=pdecon_2.XComponent)
bnd_4 = Bounds(Numbers=pdecon_2.XComponent)
dom_4 = ConstructDomain(DomainStart=number_slider_2, DomainEnd=Slider(0.05, range=0..3))
rich_graph_3 = RichGraphMapper(
    Values=pdecon_2.XComponent,
    Source=bnd_3,
    Target=dom_3,
    Remap=False,
    x0=0,
    x1=1,
    y0=0,
    y1=0.54,
    Ox=0,
    Oy=0,
    Px=1,
    Py=1,
    container_name="Parabola")
rich_graph_4 = RichGraphMapper(
    Values=pdecon_2.XComponent,
    Source=bnd_4,
    Target=dom_4,
    Remap=False,
    x0=0,
    x1=1,
    y0=0,
    y1=0.05,
    container_name="Bezier",
    cpx=[0, 0.25, 0.75, 1],
    cpy=[0, 0.25, 0.75, 1])
neg_2 = Negative(Value=rich_graph_3)
pt_2 = ConstructPoint(XCoordinate=rich_graph_4, YCoordinate=neg_2, ZCoordinate=0)
vdis_2 = VectorDisplay(Anchor=demesh_2.Vertices, Vector=pt_2)
move_2 = Move(Geometry=demesh_2.Vertices, Motion=pt_2)  # -> Geometry, Transform
conmesh_2 = ConstructMesh(Vertices=move_2.Geometry, Faces=demesh_2.Faces)

# ---- group: Step 3.0: Input Mesh Topo Check
wbfacepolys = WeaverbirdsFacePolylines(Mesh=list_2)
demesh_3 = DeconstructMesh(Mesh=list_2)  # -> Vertices, Faces, Colours, Normals
previewlw = CustomPreviewLineweights(Geometry=wbfacepolys, Shader=ColourSwatch(SwatchColor=RGB(0, 0, 0)), Thickness=4, Absolute=False)
points = PointList(Points=demesh_3.Vertices, Size=Slider(0.1, range=0..1))

# ----
wbfacepolys_2 = WeaverbirdsFacePolylines(Mesh=conmesh)
previewlw_2 = CustomPreviewLineweights(Geometry=wbfacepolys_2, Shader=ColourSwatch(SwatchColor=RGB(0, 0, 0)), Thickness=1, Absolute=False)

# ---- group: Step 3.1: Create Deformation Mesh(Generating vector fields)
# Create Principle Mesh - Displacement Field Method (Higher Order)
panel_2 = Panel("""True - Bending Stress Lines
False - In-plane Stress Lines""")
list_3 = ItemSelector(panel_2, {"True - Bending Stress Lines", "False - In-plane Stress Lines"}, selected="False - In-plane Stress Lines")
cluster_3 = Cluster(T=list_3)
panel_3 = Panel("0.3")

# Create Principle Mesh - Displacement Field Method (Standard)
panel_4 = Panel("""True - Bending Stress Lines
False - In-plane Stress Lines""")
# Note On Vector Field Generation: Principle Vector Field(P1/P2) is generated for either Bending stress lines or In-plane stress lines
# Bending stress lines - rotational input is required - i.e.slab structure/dome structure
# In-plane stress lines - translational input is required - i.e.shear wall structure
list_4 = ItemSelector(panel_4, {"True - Bending Stress Lines", "False - In-plane Stress Lines"}, selected="False - In-plane Stress Lines")
cluster_4 = Cluster(T=list_4)
facen = FaceNormals(Mesh=list_2)  # -> Centers, Normals
defmesh = CreateDeformationMesh(Mesh=list_2, Translations=pt_2, Rotations=Vector(0, 0, 0), PoissonsRatio="0.3", BendingStressLines=cluster_4)  # -> PrincipalDirection1, PrincipalDirection2
eval = EvaluatePrincipalMesh(Principal=defmesh.PrincipalDirection2, Location=facen.Centers)
eval_2 = EvaluatePrincipalMesh(Principal=defmesh.PrincipalDirection1, Location=facen.Centers)
vdisex = VectorDisplayEx(Point=facen.Centers, Vector=expr("x/10", eval), Colour=RGB(255, 143, 212), Width=2)
vdisex_2 = VectorDisplayEx(Point=facen.Centers, Vector=expr("x/10", eval_2), Colour=RGB(82, 184, 59), Width=2)

# ----
area = MeshArea(Mesh=list)  # -> Area, Centroid
defmeshhigh = CreateDeformationMeshHigher(Mesh=list, Translations=pt, Rotations=Vector(0, 0, 0), PoissonsRatio=panel_3, BendingStressLines=cluster_3)  # -> PrincipalDirection1, PrincipalDirection2

popgeo = PopulateGeometry(Geometry=list, Count=100, Seed=1)
eval_3 = EvaluatePrincipalMesh(Principal=defmeshhigh.PrincipalDirection1, Location=popgeo)
eval_4 = EvaluatePrincipalMesh(Principal=defmeshhigh.PrincipalDirection2, Location=popgeo)
vdisex_3 = VectorDisplayEx(Point=popgeo, Vector=expr("x/10", eval_3), Colour=RGB(255, 143, 212), Width=2)
vdisex_4 = VectorDisplayEx(Point=popgeo, Vector=expr("x/10", eval_4), Colour=RGB(82, 184, 59), Width=2)

# ---- group: Vector Field
v1 = Data(eval_2)
v2 = Data(eval)

# ---- group: Step 3.2: Vector Mesh (Smoothing vectors for stressline generation)
# Create Principle Mesh - Vector Field Method
# Smoothing Radius: Refine vector to be the average vectors within the radius distance
smoothing_radius = Panel("0.5")
vectormesh = CreateVectorMesh(Mesh=list_2, Vectors1st=v1, Vectors2nd=v2, Radius=smoothing_radius)  # -> PrincipleDirection1, PrincipleDirection2

# ---- group: Step 4: Selecting Seed Point
md_slider = MDSlider(SliderMode=0, slider_value=Point(0.5, 0.5, 0.5), x_domain=Domain(0, 1), y_domain=Domain(0, 1), z_domain=Domain(0, 1))
wbedges = WeaverbirdsMeshEdges(MeshOrPolylines=list)
boundary = BoundarySurfaces(Edges=wbedges)
srf = Surface(boundary)
evalsrf = EvaluateSurface(Surface=reparameterize(srf), Point=md_slider)  # -> Point, Normal, UDirection, VDirection, Frame
meshcp = MeshClosestPoint(Point=evalsrf.Point, Mesh=list)  # -> Point, Index, Parameter
dots = DotDisplay(Point=meshcp.Point, Colour=RGB(0, 0, 0), Size=0.01)

md_slider_2 = MDSlider(SliderMode=0, slider_value=Point(0.5, 0.5, 0.5), x_domain=Domain(0, 1), y_domain=Domain(0, 1), z_domain=Domain(0, 1))
wbedges_2 = WeaverbirdsMeshEdges(MeshOrPolylines=list_2)
boundary_2 = BoundarySurfaces(Edges=wbedges_2)
srf_2 = Surface(boundary_2)
evalsrf_2 = EvaluateSurface(Surface=reparameterize(srf_2), Point=md_slider_2)  # -> Point, Normal, UDirection, VDirection, Frame
meshcp_2 = MeshClosestPoint(Point=evalsrf_2.Point, Mesh=list_2)  # -> Point, Index, Parameter
dots_2 = DotDisplay(Point=meshcp_2.Point, Colour=RGB(0, 0, 0), Size=0.01)

# ----
sph = Sphere(Base=meshcp_2.Point, Radius=smoothing_radius)

# ---- group: Step 5: Create Evenly Spaced Stress Lines
# Evenly Spaced Stress Lines
number_slider_3 = Slider(-5, range=-10..0)
number_slider_4 = Slider(0.1, range=0..1)
number_slider_5 = Slider(0.2, range=0..1)
number_slider_6 = Slider(0.05, range=0..0.1)
_10º = PowerOf10(Value=number_slider_3)
number_slider_7 = Slider(5, range=1..5)
sls = StressLines(
    PrincipalMesh=vectormesh.PrincipleDirection2,
    Seed=meshcp_2.Point,
    StepTolerance=number_slider_4,
    MaxError=_10º,
    Seperation=number_slider_5,
    TestDist=number_slider_6)
sls_2 = StressLines(
    PrincipalMesh=vectormesh.PrincipleDirection1,
    Seed=meshcp_2.Point,
    StepTolerance=number_slider_4,
    MaxError=_10º,
    Seperation=number_slider_5,
    TestDist=number_slider_6)
previewlw_3 = CustomPreviewLineweights(Geometry=sls_2, Shader=ColourSwatch(SwatchColor=RGB(82, 184, 59)), Thickness=number_slider_7, Absolute=False)
previewlw_4 = CustomPreviewLineweights(Geometry=sls, Shader=ColourSwatch(SwatchColor=RGB(255, 143, 212)), Thickness=number_slider_7, Absolute=False)

# ---- group: Step 5: Create A Stressline_P1
# Single Stress Line
number_slider_8 = Slider(-4, range=-10..0)
_10º_2 = PowerOf10(Value=number_slider_8)
stress_line = StressLine(PrincipalMesh=vectormesh.PrincipleDirection1, Seed=meshcp_2.Point, StepTolerance="0.2", MaxError=_10º_2)
stress_line_2 = StressLine(PrincipalMesh=vectormesh.PrincipleDirection2, Seed=meshcp_2.Point, StepTolerance="0.2", MaxError=_10º_2)
preview = CustomPreview(
    Geometry=stress_line,
    Material={diffuse=RGB(13, 201, 0), emission=RGB(4, 60, 0), shine=0.5, specular=RGB(255, 255, 255), transparency=0})
preview_2 = CustomPreview(
    Geometry=stress_line_2,
    Material={diffuse=RGB(13, 201, 0), emission=RGB(4, 60, 0), shine=0.5, specular=RGB(255, 255, 255), transparency=0})

# Single Stress Line
number_slider_9 = Slider(-5, range=-10..0)
_10º_3 = PowerOf10(Value=number_slider_9)
stress_line_3 = StressLine(PrincipalMesh=defmeshhigh.PrincipalDirection1, Seed=meshcp.Point, StepTolerance="0.1", MaxError=_10º_3)
stress_line_4 = StressLine(PrincipalMesh=defmeshhigh.PrincipalDirection2, Seed=meshcp.Point, StepTolerance="0.1", MaxError=_10º_3)
preview_3 = CustomPreview(
    Geometry=stress_line_4,
    Material={diffuse=RGB(13, 201, 0), emission=RGB(4, 60, 0), shine=0.5, specular=RGB(255, 255, 255), transparency=0})
preview_4 = CustomPreview(
    Geometry=stress_line_3,
    Material={diffuse=RGB(13, 201, 0), emission=RGB(4, 60, 0), shine=0.5, specular=RGB(255, 255, 255), transparency=0})

# ---- group: Step 5: Create Evenly Spaced Stress Lines
# Evenly Spaced Stress Lines
number_slider_10 = Slider(-5, range=-10..0)
number_slider_11 = Slider(0.004, range=0..1)
number_slider_12 = Slider(0.2, range=0..10)
number_slider_13 = Slider(0.01, range=0..0.1)
_10º_4 = PowerOf10(Value=number_slider_10)
number_slider_14 = Slider(5, range=1..5)
sls_3 = StressLines(
    PrincipalMesh=defmeshhigh.PrincipalDirection2,
    Seed=meshcp.Point,
    StepTolerance=number_slider_11,
    MaxError=_10º_4,
    Seperation=number_slider_12,
    TestDist=number_slider_13)
sls_4 = StressLines(
    PrincipalMesh=defmeshhigh.PrincipalDirection1,
    Seed=meshcp.Point,
    StepTolerance=number_slider_11,
    MaxError=_10º_4,
    Seperation=number_slider_12,
    TestDist=number_slider_13)
previewlw_5 = CustomPreviewLineweights(Geometry=sls_4, Shader=ColourSwatch(SwatchColor=RGB(82, 184, 59)), Thickness=number_slider_14, Absolute=False)
previewlw_6 = CustomPreviewLineweights(Geometry=sls_3, Shader=ColourSwatch(SwatchColor=RGB(255, 143, 212)), Thickness=number_slider_14, Absolute=False)

# ---- group: Step 5: Evaluate Principle Mesh
# Vectors
eval_5 = EvaluatePrincipalMesh(Principal=vectormesh.PrincipleDirection2, Location=meshcp_2.Point)
# Results
eval_6 = EvaluatePrincipalMesh(Principal=vectormesh.PrincipleDirection1, Location=meshcp_2.Point)
vdisex_5 = VectorDisplayEx(Point=meshcp_2.Point, Vector=eval_5, Colour=RGB(255, 143, 212), Width=2)
vdisex_6 = VectorDisplayEx(Point=meshcp_2.Point, Vector=eval_6, Colour=RGB(82, 184, 59), Width=2)

# Vectors
eval_7 = EvaluatePrincipalMesh(Principal=defmeshhigh.PrincipalDirection2, Location=meshcp.Point)
# Results
eval_8 = EvaluatePrincipalMesh(Principal=defmeshhigh.PrincipalDirection1, Location=meshcp.Point)
vdisex_7 = VectorDisplayEx(Point=meshcp.Point, Vector=eval_7, Colour=RGB(255, 143, 212), Width=2)
vdisex_8 = VectorDisplayEx(Point=meshcp.Point, Vector=eval_8, Colour=RGB(82, 184, 59), Width=2)

# ==== cluster Cluster
T = ClusterInput()
split = TextSplit(Text=T, Separators=" - ")
item = ListItem(List=split, Index=0, Wrap=True)  # -> flatten(Item)
bool = Boolean(item)
bool_2 = ClusterOutput(bool)

# ==== cluster Cluster_2
B = ClusterInput()

mplane = MeshPlane(Boundary=B, WidthCount="1", HeightCount="1")  # -> Mesh, Area
mesh = Mesh(graft(mplane.Mesh))

M = ClusterOutput(mplane.Mesh)
mesh_2 = ClusterOutput(mesh)
explode = MeshExplode(Mesh=mesh, Interpolate=False)

wbfacepolys = WeaverbirdsFacePolylines(Mesh=explode)
disc = Discontinuity(Curve=wbfacepolys, Level=1)  # -> Points, Parameters
area = Area(Geometry=wbfacepolys)  # -> Area, Centroid
shatter = Shatter(Curve=wbfacepolys, Parameters=disc.Parameters)
midpt = CurveMiddle(Curve=shatter)
merge = Merge(Data1=disc.Points, Data2=midpt)  # -> simplify(Result)

duppt = RemoveDuplicatePts(Points=flatten(merge), Tolerance=0.01)

avr = Average(Input=area.Centroid)
cir = Circle(Plane=avr, Radius=0.1)
alongcrv = SortAlongCurve(Points=simplify(disc.Points), Curve=cir)  # -> simplify(Points), Indices
cp = ClosestPoint(Point=alongcrv.Points, Cloud=duppt)  # -> ClosestPoint, CPIndex, Distance
item = ListItem(List=cp.CPIndex, Index=0, Wrap=True)  # -> Item, Item1, Item2, Item3
quad = MeshQuad(CornerA=item.Item, CornerB=item.Item1, CornerC=item.Item2, CornerD=item.Item3)
conmesh = ConstructMesh(Vertices=flatten(duppt), Faces=flatten(quad))

shift = ShiftPaths(Data=cp.CPIndex, Offset=-1)
M_2 = ClusterOutput(conmesh)

# ==== cluster Cluster_3
M = ClusterInput()

tri = Triangulate(Mesh=M)  # -> Mesh, Count
nv = NakedVertices(Mesh=graft(tri.Mesh))  # -> ClothedIndex, NakedIndex, ClothedPts, NakedPts
wbfacepolys = WeaverbirdsFacePolylines(Mesh=tri.Mesh)
disc = Discontinuity(Curve=wbfacepolys, Level=1)  # -> Points, Parameters
avr = Average(Input=disc.Points)
cir = Circle(Plane=avr, Radius=1)
alongcrv = SortAlongCurve(Points=simplify(disc.Points), Curve=cir)  # -> simplify(Points), Indices

clean = CombineClean(Meshes=tri.Mesh)
M_2 = ClusterOutput(clean)
shatter = Shatter(Curve=graft(wbfacepolys), Parameters=disc.Parameters)
midpt = CurveMiddle(Curve=shatter)
merge = Merge(Data1=disc.Points, Data2=midpt)  # -> flatten(Result)
duppt = RemoveDuplicatePts(Points=merge, Tolerance=0.001)

cp = ClosestPoint(Point=graft(alongcrv.Points), Cloud=duppt)  # -> ClosestPoint, CPIndex, Distance
shift = ShiftPaths(Data=cp.CPIndex, Offset=-1)
item = ListItem(List=shift, Index=0, Wrap=True)  # -> Item, Item1, Item2
triangle = MeshTriangle(CornerA=item.Item, CornerB=item.Item1, CornerC=item.Item2)
conmesh = ConstructMesh(Vertices=flatten(duppt), Faces=flatten(triangle))

M_3 = ClusterOutput(conmesh)
