# Grasshopper definition Crappers_6 node tri.gh (Grasshopper 1.0.8)
# plug-ins: CORE.Toolbox.Grasshopper, MeshEdit Components, treesloth01, Pufferfish, Human, Kangaroo Components, GSA, Weaverbird, LilyPad, HDTTreeUtils

panel = Panel("C:\Users\glformat\Documents\GitHub\PrincipalStressLines\Testing Files\Crappershell01.gwb")

# ---- group: Step 0: Read GSA Analysis Results
# Input Analysis Model Results (Optional)
open = OpenModel(FilenameAndPath=panel)
getanalysis = GetModelAnalysis(GSAModel=open)  # -> AnalysisTasks, AnalysisCases, CombinationCases, DesignTasks
panel_2 = Panel(getanalysis.AnalysisCases)
getres = GetResult(GSAModel=open, T="A", Case=1)
getgeo = GetModelGeometry(GSAModel=open, Mode=1, Unit="m")  # -> NodesIn_m, _1DElementsIn_m, _2DElementsIn_m, _3DElementsIn_m, _1DMembersIn_m, _2DMembersIn_m, _3DMembersIn_m, Assemblies
nodedisp = NodeDisplacements(Result=getres, Max_Min="All", Unit="mm")  # -> TranslationsX_mm, TranslationsY_mm, TranslationsZ_mm, TranslationsXYZ_mm, RotationXX_rad, RotationYY_rad, RotationZZ_rad, RotationXYZ_rad, NodeIDs
nodeedit = EditNode(Node=getgeo.NodesIn_m, Mode=1)  # -> Node, NodeNumber, NodePosition, NodeLocalAxis, NodeRestraints, DamperProperty, MassProperty, SpringProperty, NodeName, NodeColour
elem2dedit = Edit2DElement(Element2D=getgeo._2DElementsIn_m, Preview3dSection=False)  # -> Element2D, Number, Geometry, _2DProperty, Group, ElementType, Offset, OrientationAngle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
num = Number(nodedisp.RotationXX_rad)
num_2 = Number(nodedisp.RotationYY_rad)
num_3 = Number(nodedisp.RotationZZ_rad)
subtraction = Subtraction(A=elem2dedit.Topology, B=1)
vec = VectorXYZ(XComponent=num, YComponent=num_2, ZComponent=num_3)  # -> Vector, Length
int = Integer(nodeedit.NodeNumber)
int_2 = Integer(elem2dedit.Topology)
int_3 = Integer(subtraction)
mindex = MemberIndex(Set=int, Member=int_2)  # -> Index, Count
shift = ShiftPaths(Data=mindex.Index, Offset=-1)
displacement_vectors = Vector(vec.Vector)
element_node_ids = Number(simplify(shift))
node_locations = Point(nodeedit.NodePosition)

# ----
mesh = Mesh([<mesh referenced from the Rhino model> x75])
clean = CombineClean(Meshes=mesh)
tri = Triangulate(Mesh=clean)  # -> Mesh, Count
wbfacepolys = WeaverbirdsFacePolylines(Mesh=tri.Mesh)
pa = PlanarityAnalysis(Mesh=mesh, Max=0.01)  # -> M, P
disc = Discontinuity(Curve=wbfacepolys, Level=1)  # -> Points, Parameters
boundary = BoundarySurfaces(Edges=wbfacepolys)
shatter = Shatter(Curve=graft(wbfacepolys), Parameters=disc.Parameters)
nv = NakedVertices(Mesh=clean)  # -> ClothedIndex, NakedIndex, ClothedPts, NakedPts
midpt = CurveMiddle(Curve=shatter)
merge = Merge(Data1=simplify(disc.Points), Data2=simplify(midpt))
planarize = Planarize(PlanarizeStrength=100)
planarize_2 = Planarize(Strength=100)
avr = Average(Input=disc.Points)
pdecon = Deconstruct(Point=nv.NakedPts)  # -> XComponent, YComponent, ZComponent
duppt = RemoveDuplicatePts(Points=flatten(merge), Tolerance=0.001)
item = ListItem(List=disc.Points, Index=0, Wrap=True)  # -> Item, Item1, Item2
roundd = RoundToDecimalPlace(NumberX=pdecon.ZComponent, DecimalPlace=Slider(2, range=0..10), RoundType=0)  # -> Rounded, Difference
planarize_3 = Planarize(PlanarizeStrength=100)
pl_3pt = Plane3Pt(PointA=avr, PointB=item.Item1, PointC=item.Item2)  # -> simplify(Plane)
planarize_4 = Planarize(Strength=100)
cp = ClosestPoint(Point=graft(disc.Points), Cloud=duppt)  # -> ClosestPoint, CPIndex, Distance
cset = CreateSet(List=roundd.Rounded)  # -> Set, Map
mem2d = Create2DMember(Brep=graft(boundary), InclPoints=merge, InternalOffset=True, Preview3dSection=False, Mesh_mode="Tri only")
shift_2 = ShiftPaths(Data=cp.CPIndex, Offset=-1)  # -> simplify(Data)
assign_paths = AssignPaths(InputData=flatten(nv.NakedPts), PathsToAssign=flatten(cset.Map))
elem2d = Create2DElement(Preview3dSection=False)
item_2 = ListItem(List=duppt, Index=shift_2, Wrap=True)
branch = BranchByIndex(Tree=assign_paths, Branch=Slider(0, range=0..1))
elemfrommem = CreateElementsFromMembers(_2DMembers_m=mem2d, Tolerance=0.0001, Unit="m")  # -> Nodes, _1DElements, _2DElements, _3DElements, GSAModel
item_3 = ListItem(List=shift_2, Index=0, Wrap=True)  # -> Item, Item1, Item2
panel_3 = Panel(item_3.Item)
triangle = MeshTriangle(CornerA=item_3.Item, CornerB=item_3.Item1, CornerC=item_3.Item2)
conmesh = ConstructMesh(Vertices=duppt, Faces=flatten(triangle))
explode = MeshExplode(Mesh=conmesh, Interpolate=False)
demesh = DeconstructMesh(Mesh=conmesh)  # -> Vertices, Faces, Colours, Normals
mat = CreateMaterial(Material_type="Steel", Design_Code="EN 1993-1-1:2005", Grade="S355")
explode_2 = Explode(Recursive=True)  # -> Segments, Vertices
prop2d = Create2DProperty(Thickness_cm="2", Material=mat, Type="Shell", Unit="cm")
duppt_2 = RemoveDuplicatePts(Points=flatten(explode_2.Vertices), Tolerance=0.01)
support = CreateSupport(Point=branch, Plane=PlaneXY(0, 0, 0), x=True, xx=False, y=True, yy=False, z=True, zz=False)
σa = CreateAnalysisCase(Name="L1", Description="L1")
elem2d_2 = Create2DElement(Geometry=conmesh, Property2D=prop2d, Preview3dSection=False)
support_2 = CreateSupport(Point=demesh.Vertices, Plane=PlaneXY(0, 0, 0), x=False, xx=False, y=False, yy=False, z=False, zz=False)
σt = CreateAnalysisTask(AnalysisCases=σa, casesParamIndex=2, Solver="Static")
model = CreateModel(
    GSAGeometryIn_m=flatten([support, elem2d_2, support_2]),
    AnalysisTasksCombinations=σt,
    ReMesh=True,
    Tolerance=0.001,
    Unit="m")
panel_4 = Panel("C:\Users\glformat\Documents\GitHub\PrincipalStressLines\Testing Files\Crappershell01.gwb")
panel_5 = Panel("C:\Users\glformat\Documents\GitHub\PrincipalStressLines\Testing Files\Crappershell01.gwb")
save = Button()
save_2 = SaveGSAModel(GSAModel=model, Save=True, FileAndPath=panel_5)

conmesh_2 = ConstructMesh(Vertices=[Point(0, 0, 0), Point(10, 0, 0), Point(10, 10, 0), Point(0, 10, 0)], Faces={A=0, B=1, C=2, D=3})
# Structure: Square Slab Under UDL
# Analysis Input: Data/Oasys GSA
# Field Generation Method: Displacement Field Method (Higher Order)
branch_2 = BranchByIndex()  # disabled
# Connecting the input if GSA data is avaliable; otherwise remain unconnected.
data = Data(node_locations)  # disabled
element_node_ids_2 = Number(simplify(element_node_ids))

# ---- group: Step 1: FEA Data Import
displacement_vectors_2 = Vector(displacement_vectors)
node_locations_2 = Point(node_locations)

# ----
panel_6 = Panel(node_locations_2)

# ---- group: Step 2.1: Select Corner Vetices (0,2,7,5) For Mesh Quads
tstat = TreeStatistics(Tree=element_node_ids_2)  # -> Paths, Length, Count
item_4 = ListItem(List=tstat.Paths, Index=0, Wrap=True)
split = SplitTree(Data=element_node_ids_2, Masks=flatten(item_4))  # -> Positive, Negative
item_5 = ListItem(List=node_locations_2, Index=split.Positive, Wrap=True)
pline = PolyLine(Vertices=item_5, Closed=True)
previewlw = CustomPreviewLineweights(Geometry=pline, Shader=ColourSwatch(SwatchColor=RGB(0, 0, 0)), Thickness=4, Absolute=False)
points = PointList(Points=item_5, Size=0.03)

# ---- group: Step 2.2: Construct Input Mesh
item_6 = ListItem(List=element_node_ids_2, Index=0, Wrap=True)  # -> Item, Item1, Item2, Item3, Item4, Item5, Item6, Item7

# ----
triangle_2 = MeshTriangle(CornerA=item_6.Item, CornerB=item_6.Item1, CornerC=item_6.Item2)

# ---- group: Step 2.2: Construct Input Mesh (continued)
conmesh_3 = ConstructMesh(Vertices=node_locations_2, Faces=flatten(triangle_2))

# ---- group: Step 4: Selecting Seed Point
cullvertices = MeshCullUnusedVertices(Mesh=conmesh_3)
demesh_2 = DeconstructMesh(Mesh=cullvertices)  # -> Vertices, Faces, Colours, Normals
selecting_seed_point = Slider(1352, range=0..2602)
item_7 = ListItem(List=demesh_2.Vertices, Index=selecting_seed_point, Wrap=True)
dots = DotDisplay(Point=item_7, Colour=RGB(0, 0, 0), Size=0.1)
seed_point = Point(item_7)

# ---- group: Step 3: Create Deformation Mesh
panel_7 = Panel("""True - Bending Stress Lines
False - In-plane Stress Lines""")
list = ItemSelector(panel_7, {"True - Bending Stress Lines", "False - In-plane Stress Lines"}, selected="True - Bending Stress Lines")
# Note On Vector Field Generation: Principle Vector Field(P1/P2) is generated for either Bending stress lines or In-plane stress lines
# Bending stress lines - rotational input is required - i.e.slab structure/dome structure
# In-plane stress lines - translational input is required - i.e.shear wall structure
cluster = Cluster(T=list)
defmeshhigh = CreateDeformationMeshHigher(
    Mesh=conmesh_3,
    Translations=Vector(0, 0, 0),
    Rotations=displacement_vectors_2,
    PoissonsRatio="0.15",
    BendingStressLines=cluster)  # -> PrincipalDirection1, PrincipalDirection2

# ----
# Setup
swatch = ColourSwatch(SwatchColor=RGB(97, 97, 97))
preview = CustomPreview(Geometry=conmesh_3, Material=swatch)

# ---- group: Step 5: Create Evenly Spaced Stress Lines
# Evenly Spaced Stress Lines
number_slider = Slider(-4, range=-10..0)  # disabled
number_slider_2 = Slider(0.1, range=0..1)  # disabled
number_slider_3 = Slider(0.08, range=0..0.1)  # disabled
number_slider_4 = Slider(1, range=0..1)  # disabled
_10º = PowerOf10(Value=number_slider)  # disabled
sls = StressLines(
    PrincipalMesh=defmeshhigh.PrincipalDirection2,
    Seed=seed_point,
    StepTolerance=number_slider_2,
    MaxError=_10º,
    Seperation=number_slider_4,
    TestDist=number_slider_3)  # disabled
sls_2 = StressLines(
    PrincipalMesh=defmeshhigh.PrincipalDirection1,
    Seed=seed_point,
    StepTolerance=number_slider_2,
    MaxError=_10º,
    Seperation=number_slider_4,
    TestDist=number_slider_3)  # disabled
swatch_2 = ColourSwatch(SwatchColor=RGB(82, 184, 59))  # disabled
swatch_3 = ColourSwatch(SwatchColor=RGB(255, 143, 212))  # disabled
previewlw_2 = CustomPreviewLineweights(Geometry=sls_2, Shader=swatch_2, Thickness=2, Absolute=False)  # disabled
previewlw_3 = CustomPreviewLineweights(Geometry=sls, Shader=swatch_3, Thickness=2, Absolute=False)  # disabled

# ---- group: Step 5: Create A Stressline_P2
# Single Stress Line
number_slider_5 = Slider(0.364, range=0..1)
_10º_2 = PowerOf10(Value=Slider(-6, range=-10..0))
stress_line = StressLine(PrincipalMesh=defmeshhigh.PrincipalDirection2, Seed=seed_point, StepTolerance=number_slider_5, MaxError=_10º_2)
preview_2 = CustomPreview(
    Geometry=stress_line,
    Material={diffuse=RGB(255, 143, 212), emission=RGB(76, 43, 64), shine=0.5, specular=RGB(255, 255, 255), transparency=0})

# ---- group: Step 5: Create A Stressline_P1
# Single Stress Line
number_slider_6 = Slider(-4, range=-10..0)
_10º_3 = PowerOf10(Value=number_slider_6)
stress_line_2 = StressLine(PrincipalMesh=defmeshhigh.PrincipalDirection1, Seed=seed_point, StepTolerance=Slider(0.02, range=0..1), MaxError=_10º_3)
preview_3 = CustomPreview(
    Geometry=stress_line_2,
    Material={diffuse=RGB(82, 184, 59), emission=RGB(25, 55, 18), shine=0.5, specular=RGB(255, 255, 255), transparency=0})

# ---- group: Step 5: Evaluate Principle Mesh
# Evaluation
eval = EvaluatePrincipalMesh(Principal=defmeshhigh.PrincipalDirection2, Location=seed_point)
# Results
eval_2 = EvaluatePrincipalMesh(Principal=defmeshhigh.PrincipalDirection1, Location=seed_point)
vdisex = VectorDisplayEx(Point=seed_point, Vector=eval, Colour=RGB(255, 143, 212), Width=2)
vdisex_2 = VectorDisplayEx(Point=seed_point, Vector=eval_2, Colour=RGB(82, 184, 59), Width=2)

# ==== cluster Cluster
T = ClusterInput()
split = TextSplit(Text=T, Separators=" - ")
item = ListItem(List=split, Index=0, Wrap=True)  # -> flatten(Item)
bool = Boolean(item)
bool_2 = ClusterOutput(bool)
