# Grasshopper definition LilyPad_Example-Cylindrical Plate_Tri6-FromGSA.gh (Grasshopper 1.0.8)
# plug-ins: treesloth01, Human, GSA, LilyPad

# C:\Users\Matt C\Documents\GitHub\PrincipalStressLines\Example Files\GSA Model_Plate_8Node.gwb
panel = Panel("C:\Users\Matt C\Documents\GitHub\PrincipalStressLines\Example Files\Cylindrical Shell.gwb")
open = OpenModel(FilenameAndPath=panel)
getgeo = GetModelGeometry(GSAModel=open, Mode=1, Unit="m")  # -> NodesIn_m, _1DElementsIn_m, _2DElementsIn_m, _3DElementsIn_m, _1DMembersIn_m, _2DMembersIn_m, _3DMembersIn_m, Assemblies
panel_2 = Panel("C:\Users\Matt C\Documents\GitHub\PrincipalStressLines\Example Files\Cylindrical Shell_Tri6.gwb")
getres = GetResult(GSAModel=open, T="A", Case=1)
nodedisp = NodeDisplacements(Result=getres, Max_Min="All", Unit="mm")  # -> TranslationsX_mm, TranslationsY_mm, TranslationsZ_mm, TranslationsXYZ_mm, RotationXX_rad, RotationYY_rad, RotationZZ_rad, RotationXYZ_rad, NodeIDs
open_2 = OpenModel(FilenameAndPath=panel_2)
nodeedit = EditNode(Node=getgeo.NodesIn_m, Mode=1)  # -> Node, NodeNumber, NodePosition, NodeLocalAxis, NodeRestraints, DamperProperty, MassProperty, SpringProperty, NodeName, NodeColour
elem2dedit = Edit2DElement(Element2D=getgeo._2DElementsIn_m, Preview3dSection=False)  # -> Element2D, Number, Geometry, _2DProperty, Group, ElementType, Offset, OrientationAngle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
num = Number(nodedisp.TranslationsX_mm)
num_2 = Number(nodedisp.TranslationsY_mm)
num_3 = Number(nodedisp.RotationXX_rad)
num_4 = Number(nodedisp.RotationYY_rad)
num_5 = Number(nodedisp.TranslationsZ_mm)
num_6 = Number(nodedisp.RotationZZ_rad)
subtraction = Subtraction(A=elem2dedit.Topology, B=1)
getgeo_2 = GetModelGeometry(GSAModel=open_2, Mode=1, Unit="m")  # -> NodesIn_m, _1DElementsIn_m, _2DElementsIn_m, _3DElementsIn_m, _1DMembersIn_m, _2DMembersIn_m, _3DMembersIn_m, Assemblies
vec = VectorXYZ(XComponent=num, YComponent=num_2, ZComponent=num_5)  # -> Vector, Length
vec_2 = VectorXYZ(XComponent=num_3, YComponent=num_4, ZComponent=num_6)  # -> Vector, Length
getres_2 = GetResult(GSAModel=open_2, T="A", Case=1)
int = Integer(nodeedit.NodeNumber)
int_2 = Integer(elem2dedit.Topology)
int_3 = Integer(subtraction)
mindex = MemberIndex(Set=int, Member=int_2)  # -> Index, Count
nodedisp_2 = NodeDisplacements(Result=getres_2, Max_Min="All", Unit="mm")  # -> TranslationsX_mm, TranslationsY_mm, TranslationsZ_mm, TranslationsXYZ_mm, RotationXX_rad, RotationYY_rad, RotationZZ_rad, RotationXYZ_rad, NodeIDs
shift = ShiftPaths(Data=mindex.Index, Offset=-1)
elem2dedit_2 = Edit2DElement(Element2D=getgeo_2._2DElementsIn_m, Preview3dSection=False)  # -> Element2D, Number, Geometry, _2DProperty, Group, ElementType, Offset, OrientationAngle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
nodeedit_2 = EditNode(Node=getgeo_2.NodesIn_m, Mode=1)  # -> Node, NodeNumber, NodePosition, NodeLocalAxis, NodeRestraints, DamperProperty, MassProperty, SpringProperty, NodeName, NodeColour
num_7 = Number(nodedisp_2.TranslationsX_mm)
num_8 = Number(nodedisp_2.TranslationsY_mm)
num_9 = Number(nodedisp_2.RotationXX_rad)
num_10 = Number(nodedisp_2.RotationYY_rad)
num_11 = Number(nodedisp_2.TranslationsZ_mm)
num_12 = Number(nodedisp_2.RotationZZ_rad)
subtraction_2 = Subtraction(A=elem2dedit_2.Topology, B=1)
vec_3 = VectorXYZ(XComponent=num_7, YComponent=num_8, ZComponent=num_11)  # -> Vector, Length
vec_4 = VectorXYZ(XComponent=num_9, YComponent=num_10, ZComponent=num_12)  # -> Vector, Length
int_4 = Integer(nodeedit_2.NodeNumber)
int_5 = Integer(elem2dedit_2.Topology)
int_6 = Integer(subtraction_2)
panel_3 = Panel("""0
4
1
7
5
3
6
2""")
panel_4 = Panel("""2
6
3
5
7
1
4
0""")
panel_5 = Panel("""3
7
0
6
4
2
5
1""")  # disabled
panel_6 = Panel("""3
7
0
6
4
2
5
1""")
mindex_2 = MemberIndex(Set=int_4, Member=int_5)  # -> Index, Count
shift_2 = ShiftPaths(Data=mindex_2.Index, Offset=-1)
displacement_vectors = Vector(vec_2.Vector)

# ----
# FEA Data Import
displacement_vectors_2 = Vector(vec.Vector)
element_node_ids = Number(simplify(shift))
node_locations = Point(nodeedit.NodePosition)

panel_7 = Panel("""1
4
0
5
7
2
6
3""")
item = ListItem(List=element_node_ids, Index=panel_7, Wrap=True)
displacement_vectors_3 = Vector(vec_4.Vector)

# ----
# FEA Data Import
displacement_vectors_4 = Vector(vec_3.Vector)
element_node_ids_2 = Number(simplify(shift_2))
node_locations_2 = Point(nodeedit_2.NodePosition)

panel_8 = Panel("""1
4
2
3
5
0""")
tstat = TreeStatistics(Tree=item)  # -> Paths, Length, Count
item_2 = ListItem(List=element_node_ids_2, Index=panel_8, Wrap=True)
item_3 = ListItem(List=tstat.Paths, Index=0, Wrap=True)
item_4 = ListItem(List=displacement_vectors, Index=item, Wrap=True)

# ----
# Setup
item_5 = ListItem(List=node_locations, Index=item, Wrap=True)
item_6 = ListItem(List=displacement_vectors_2, Index=item, Wrap=True)
item_7 = ListItem(List=item_5, Index=0, Wrap=True)  # -> Item, Item1, Item2, Item3, Item4, Item5, Item6, Item7
item_8 = ListItem(List=item_6, Index=0, Wrap=True)  # -> Item, Item1, Item2, Item3, Item4, Item5, Item6, Item7
item_9 = ListItem(List=item, Index=0, Wrap=True)  # -> Item, Item1, Item2, Item3, Item4, Item5, Item6, Item7
merge = Merge(Data1=item_7.Item1, Data2=item_7.Item3, Data3=item_7.Item4, Data4=item_7.Item6)  # -> flatten(Result)
merge_2 = Merge(Data1=item_8.Item1, Data2=item_8.Item3, Data3=item_8.Item4, Data4=item_8.Item6)  # -> flatten(Result)
quad = MeshQuad(CornerA=item_9.Item, CornerB=item_9.Item2, CornerC=item_9.Item7, CornerD=item_9.Item5)
conmesh = ConstructMesh(Vertices=node_locations, Faces=flatten(quad))
cullpt = CullDuplicates(Points=merge, Tolerance=0.001, CullMode=1)  # -> Points, Indices, Valence
item_10 = ListItem(List=merge_2, Index=cullpt.Indices, Wrap=True)
quad8mem = _8NodeQuadMembrane(
    Mesh=conmesh,
    MidNodes=cullpt.Points,
    DisplacmentsCorners=displacement_vectors_2,
    DisplacmentsMidNodes=item_10,
    PoissonsRatio="0.15")  # -> PrincipleDirection1, PrincipleDirection2

split = SplitTree(Data=item, Masks=flatten(item_3))  # -> Positive, Negative
item_11 = ListItem(List=item_4, Index=0, Wrap=True)  # -> Item, Item1, Item2, Item3, Item4, Item5, Item6, Item7
panel_9 = Panel(shift)
item_12 = ListItem(List=node_locations, Index=split.Positive, Wrap=True)
facen = FaceNormals(Mesh=conmesh)  # -> Centers, Normals
points = PointList(Points=item_12)
tstat_2 = TreeStatistics(Tree=item_2)  # -> Paths, Length, Count
merge_3 = Merge(Data1=item_11.Item1, Data2=item_11.Item3, Data3=item_11.Item4, Data4=item_11.Item6)  # -> flatten(Result)
item_13 = ListItem(List=tstat_2.Paths, Index=0, Wrap=True)
split_2 = SplitTree(Data=item_2, Masks=flatten(item_13))  # -> Positive, Negative
item_14 = ListItem(List=merge_3, Index=cullpt.Indices, Wrap=True)
item_15 = ListItem(List=node_locations_2, Index=split_2.Positive, Wrap=True)
points_2 = PointList(Points=item_15)
quad8slab = _8NodeQuadSlab(
    Mesh=conmesh,
    MidNodes=cullpt.Points,
    RotationsCorners=displacement_vectors,
    RotationsMidNodes=item_14,
    PoissonsRatio="0.15")  # -> PrincipleDirection1, PrincipleDirection2

# ----
# Evaluation
md_slider = MDSlider(
    SliderMode=0,
    slider_value=Point(0.3726479135, 0, 0.5),
    x_domain=Domain(0, 8),
    y_domain=Domain(0, 8),
    z_domain=Domain(0, 1))
eval = EvaluatePrincipalMesh(Principal=quad8mem.PrincipleDirection2, Location=facen.Centers)
eval_2 = EvaluatePrincipalMesh(Principal=quad8mem.PrincipleDirection1, Location=facen.Centers)
division = Division(A=eval, B=10)
division_2 = Division(A=eval_2, B=10)
vdis = VectorDisplay(Anchor=facen.Centers, Vector=division_2)
vdis_2 = VectorDisplay(Anchor=facen.Centers, Vector=eval)

md_slider_2 = MDSlider(
    SliderMode=0,
    slider_value=Point(0.6786900962, 0.5347555672, 0.5),
    x_domain=Domain(0, 1),
    y_domain=Domain(0, 1),
    z_domain=Domain(0, 1))
material = CreateMaterial(
    Diffuse=ColourSwatch(SwatchColor=RGB(71, 71, 71)),
    Specular=ColourSwatch(SwatchColor=RGB(87, 87, 87)),
    Emission=ColourSwatch(SwatchColor=RGB(0, 0, 0)),
    Transparency=0,
    Shine=Slider(0, range=0..100))
# Results
preview = CustomPreview(Geometry=conmesh, Material=material)
srf = Surface(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)
evalsrf = EvaluateSurface(Surface=reparameterize(srf), Point=md_slider_2)  # -> Point, Normal, UDirection, VDirection, Frame
number_slider = Slider(0, range=0..1)
md_slider_3 = MDSlider(
    SliderMode=0,
    slider_value=Point(0.755740282, 0.09020889096, 0.5),
    x_domain=Domain(0, 1),
    y_domain=Domain(0, 1),
    z_domain=Domain(0, 1))
srf_2 = Surface(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)
evalsrf_2 = EvaluateSurface(Surface=reparameterize(srf_2), Point=md_slider_3)  # -> Point, Normal, UDirection, VDirection, Frame
popgeo = PopulateGeometry(Geometry=srf_2, Count=100, Seed=1)
number_slider_2 = Slider(2, range=1..5)

# ----
# Setup
item_16 = ListItem(List=node_locations_2, Index=item_2, Wrap=True)
item_17 = ListItem(List=displacement_vectors_4, Index=item_2, Wrap=True)
item_18 = ListItem(List=item_16, Index=0, Wrap=True)  # -> Item, Item1, Item2, Item3, Item4, Item5
item_19 = ListItem(List=item_17, Index=0, Wrap=True)  # -> Item, Item1, Item2, Item3, Item4, Item5
item_20 = ListItem(List=item_2, Index=0, Wrap=True)  # -> Item, Item1, Item2, Item3, Item4, Item5
merge_4 = Merge(Data1=item_18.Item1, Data2=item_18.Item3, Data3=item_18.Item4)  # -> flatten(Result)
merge_5 = Merge(Data1=item_19.Item1, Data2=item_19.Item3, Data3=item_19.Item4)  # -> flatten(Result)
cullpt_2 = CullDuplicates(Points=merge_4, Tolerance=0.001, CullMode=1)  # -> Points, Indices, Valence
item_21 = ListItem(List=merge_5, Index=cullpt_2.Indices, Wrap=True)

triangle = MeshTriangle(CornerA=item_20.Item, CornerB=item_20.Item2, CornerC=item_20.Item5)

conmesh_2 = ConstructMesh(Vertices=node_locations_2, Faces=flatten(triangle))

tri6mem = _6NodeTriangleMembrane(
    Mesh=conmesh_2,
    MidNodes=cullpt_2.Points,
    DisplacmentsCorners=displacement_vectors_4,
    DisplacmentsMidNodes=item_21,
    PoissonsRatio="0.15")  # -> PrincipleDirection1, PrincipleDirection2
filter = StreamFilter(Gate=number_slider, Stream0=quad8mem.PrincipleDirection1, Stream1=tri6mem.PrincipleDirection1)
filter_2 = StreamFilter(Gate=number_slider, Stream0=quad8mem.PrincipleDirection2, Stream1=tri6mem.PrincipleDirection2)

# ----
# Stress Lines
md_slider_4 = MDSlider(
    SliderMode=0,
    slider_value=Point(0.229776522, 0, 0.5),
    x_domain=Domain(0, 8),
    y_domain=Domain(0, 8),
    z_domain=Domain(0, 1))  # disabled
number_slider_3 = Slider(-4, range=-10..0)  # disabled
number_slider_4 = Slider(0.1, range=0..1)  # disabled
number_slider_5 = Slider(0.1, range=0..0.1)  # disabled
_10º = PowerOf10(Value=number_slider_3)  # disabled
panel_10 = Panel("1")  # disabled
panel_11 = Panel("0.05")  # disabled
sls = StressLines(
    PrincipalMesh=filter_2,
    Seed=md_slider_4,
    StepTolerance=number_slider_4,
    MaxError=_10º,
    SeedingMethod=panel_10,
    Seperation=number_slider_5,
    TestDist=panel_11)  # disabled
swatch = ColourSwatch(SwatchColor=RGB(255, 143, 212))  # disabled
previewlw = CustomPreviewLineweights(Geometry=sls, Shader=swatch, Thickness=number_slider_2, Absolute=False)  # disabled

# ----
# Stress Line
md_slider_5 = MDSlider(
    SliderMode=0,
    slider_value=Point(0.8094214463, 0.5273817109, 0.5),
    x_domain=Domain(0, 8),
    y_domain=Domain(0, 8),
    z_domain=Domain(0, 1))  # disabled
number_slider_6 = Slider(-4, range=-10..0)  # disabled
number_slider_7 = Slider(0.02, range=0..1)  # disabled
_10º_2 = PowerOf10(Value=number_slider_6)  # disabled
panel_12 = Panel("4")  # disabled
stress_line = StressLine(PrincipalMesh=filter_2, Seed=evalsrf_2.Point, StepTolerance=number_slider_7, IntegrationMethod=panel_12, MaxError=_10º_2)  # disabled
preview_2 = CustomPreview(
    Geometry=stress_line,
    Material={diffuse=RGB(13, 201, 0), emission=RGB(4, 60, 0), shine=0.5, specular=RGB(255, 255, 255), transparency=0})  # disabled

# ----
# Stress Lines
md_slider_6 = MDSlider(
    SliderMode=0,
    slider_value=Point(0.7115493402, 0.5547559785, 0.5),
    x_domain=Domain(0, 8),
    y_domain=Domain(0, 8),
    z_domain=Domain(0, 1))
_10º_3 = PowerOf10(Value=Slider(-6, range=-10..0))
sls_2 = StressLines(
    PrincipalMesh=filter,
    Seed=evalsrf_2.Point,
    StepTolerance=Slider(0.1, range=0..1),
    MaxError=_10º_3,
    SeedingMethod="1",
    Seperation=Slider(0.1, range=0..0.1),
    TestDist="0.05")
previewlw_2 = CustomPreviewLineweights(Geometry=sls_2, Shader=ColourSwatch(SwatchColor=RGB(82, 184, 59)), Thickness=number_slider_2, Absolute=False)

# ----
# Stress Line
md_slider_7 = MDSlider(
    SliderMode=0,
    slider_value=Point(0.8094214463, 0.5273817109, 0.5),
    x_domain=Domain(0, 8),
    y_domain=Domain(0, 8),
    z_domain=Domain(0, 1))
_10º_4 = PowerOf10(Value=Slider(-4, range=-10..0))
stress_line_2 = StressLine(PrincipalMesh=filter, Seed=popgeo, StepTolerance=Slider(0.1, range=0..1), IntegrationMethod="4", MaxError=_10º_4)
preview_3 = CustomPreview(
    Geometry=stress_line_2,
    Material={diffuse=RGB(13, 201, 0), emission=RGB(4, 60, 0), shine=0.5, specular=RGB(255, 255, 255), transparency=0})

# ----
# Evaluation
md_slider_8 = MDSlider(
    SliderMode=0,
    slider_value=Point(0.4759476825, 0.3041605135, 0.5),
    x_domain=Domain(0, 8),
    y_domain=Domain(0, 8),
    z_domain=Domain(0, 1))
facen_2 = FaceNormals(Mesh=conmesh_2)  # -> Centers, Normals
eval_3 = EvaluatePrincipalMesh(Principal=filter_2, Location=facen_2.Centers)
eval_4 = EvaluatePrincipalMesh(Principal=filter, Location=facen_2.Centers)
multiplication = Multiplication(A=eval_3, B="0.1")
multiplication_2 = Multiplication(A=eval_4, B="0.1")
move = Move(Geometry=facen_2.Centers, Motion=expr("-x/2", multiplication_2))  # -> Geometry, Transform
move_2 = Move(Geometry=facen_2.Centers, Motion=expr("-x/2", multiplication))  # -> Geometry, Transform
line = LineSDL(Start=move.Geometry, Direction=multiplication_2, Length="0.1")
line_2 = LineSDL(Start=move_2.Geometry, Direction=multiplication, Length="0.1")
previewlw_3 = CustomPreviewLineweights(Geometry=line, Shader=ColourSwatch(SwatchColor=RGB(0, 61, 194)), Thickness=2, Absolute=False)
previewlw_4 = CustomPreviewLineweights(Geometry=line_2, Shader=ColourSwatch(SwatchColor=RGB(194, 0, 0)), Thickness=2, Absolute=False)

medges = MeshEdges(Mesh=conmesh_2)  # -> NakedEdges, InteriorEdges, NonManifoldEdges
len = Length(Curve=medges.InteriorEdges)
avr = Average(Input=len)
panel_13 = Panel(eval_4)
unit = UnitVector(Vector=eval_4)
multiplication_3 = Multiplication(A=avr, B="0.5")
sph = Sphere(Base=evalsrf_2.Point, Radius=multiplication_3)
vectormesh = CreateVectorMesh(Mesh=conmesh_2, Vectors=unit, Radius=multiplication_3)

# ----
# Evaluation
eval_5 = EvaluatePrincipalMesh(Principal=filter_2, Location=evalsrf_2.Point)
eval_6 = EvaluatePrincipalMesh(Principal=vectormesh, Location=evalsrf_2.Point)
division_3 = Division(A=eval_6, B="5")
division_4 = Division(A=eval_5, B="5")
vdisex = VectorDisplayEx(Point=evalsrf_2.Point, Vector=division_4, Colour=ColourSwatch(SwatchColor=RGB(194, 0, 0)), Width=2)
vdisex_2 = VectorDisplayEx(Point=evalsrf_2.Point, Vector=division_3, Colour=ColourSwatch(SwatchColor=RGB(0, 61, 194)), Width=2)

pt = Point([move.Geometry, move_2.Geometry])
