# Grasshopper definition LilyPad_Example-FreeFormShell_Tri6-FromGSA.gh (Grasshopper 1.0.8)
# plug-ins: Karamba3D, treesloth01, Human, GSA, LilyPad

panel = Panel("C:\Users\Matt C\Documents\GitHub\PrincipalStressLines\Example Files\FreeFormShell_Rev01.gwb")
open = OpenModel(FilenameAndPath=panel)
getgeo = GetModelGeometry(GSAModel=open, Mode=1, Unit="m")  # -> NodesIn_m, _1DElementsIn_m, _2DElementsIn_m, _3DElementsIn_m, _1DMembersIn_m, _2DMembersIn_m, _3DMembersIn_m, Assemblies
getres = GetResult(GSAModel=open, T="A", Case=1)
nodedisp = NodeDisplacements(Result=getres, Max_Min="All", Unit="mm")  # -> TranslationsX_mm, TranslationsY_mm, TranslationsZ_mm, TranslationsXYZ_mm, RotationXX_rad, RotationYY_rad, RotationZZ_rad, RotationXYZ_rad, NodeIDs
elem2dedit = Edit2DElement(Element2D=getgeo._2DElementsIn_m, Preview3dSection=False)  # -> Element2D, Number, Geometry, _2DProperty, Group, ElementType, Offset, OrientationAngle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
nodeedit = EditNode(Node=getgeo.NodesIn_m, Mode=1)  # -> Node, NodeNumber, NodePosition, NodeLocalAxis, NodeRestraints, DamperProperty, MassProperty, SpringProperty, NodeName, NodeColour
num = Number(nodedisp.TranslationsX_mm)
num_2 = Number(nodedisp.TranslationsY_mm)
num_3 = Number(nodedisp.RotationXX_rad)
num_4 = Number(nodedisp.RotationYY_rad)
num_5 = Number(nodedisp.TranslationsZ_mm)
num_6 = Number(nodedisp.RotationZZ_rad)
subtraction = Subtraction(A=elem2dedit.Topology, B=1)
vec = VectorXYZ(XComponent=num, YComponent=num_2, ZComponent=num_5)  # -> Vector, Length
vec_2 = VectorXYZ(XComponent=num_3, YComponent=num_4, ZComponent=num_6)  # -> Vector, Length
int = Integer(elem2dedit.Topology)
int_2 = Integer(subtraction)
subtraction_2 = Subtraction(A=int, B="1")
mindex = MemberIndex(Set=nodeedit.NodeNumber, Member=int)  # -> Index, Count
shift = ShiftPaths(Data=mindex.Index, Offset=-1)
displacement_vectors = Vector(vec_2.Vector)

# ----
# FEA Data Import
displacement_vectors_2 = Vector(vec.Vector)
element_node_ids = Number(simplify(shift))
node_locations = Point(nodeedit.NodePosition)

panel_2 = Panel("""1
4
2
3
5
0""")
item = ListItem(List=element_node_ids, Index=panel_2, Wrap=True)
tstat = TreeStatistics(Tree=item)  # -> Paths, Length, Count
item_2 = ListItem(List=tstat.Paths, Index=0, Wrap=True)
split = SplitTree(Data=item, Masks=flatten(item_2))  # -> Positive, Negative
item_3 = ListItem(List=node_locations, Index=split.Positive, Wrap=True)
points = PointList(Points=item_3)
md_slider = MDSlider(
    SliderMode=0,
    slider_value=Point(0.6786900962, 0.5347555672, 0.5),
    x_domain=Domain(0, 1),
    y_domain=Domain(0, 1),
    z_domain=Domain(0, 1))
srf = Surface(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)
evalsrf = EvaluateSurface(Surface=reparameterize(srf), Point=md_slider)  # -> Point, Normal, UDirection, VDirection, Frame
vectormesh = CreateVectorMesh()
quad4slab = _4NodeQuadSlab()  # -> PrincipleDirection1, PrincipleDirection2
quad4mem = _4NodeQuadMembrane()  # -> PrincipleDirection1, PrincipleDirection2
shelllineresults = LineResultsOnShellsKaramba3D(LayerPosition=0, SegmentLength_m=0.5, DA_deg=5, mode="PrincStress")  # -> Model, Lines1, Lines2
pt = Point(Point(-1.148274379, 9.928215442, 3.064935715))
number_slider = Slider(2, range=1..5)
number_slider_2 = Slider(2, range=1..5)
swatch = ColourSwatch(SwatchColor=RGB(255, 143, 212))  # disabled
del = DelaunayMesh(Plane=PlaneXY(0, 0, 0))  # disabled

# ----
# Setup
item_4 = ListItem(List=node_locations, Index=item, Wrap=True)
item_5 = ListItem(List=displacement_vectors_2, Index=item, Wrap=True)
item_6 = ListItem(List=item_4, Index=0, Wrap=True)  # -> Item, Item1, Item2, Item3, Item4, Item5
item_7 = ListItem(List=item_5, Index=0, Wrap=True)  # -> Item, Item1, Item2, Item3, Item4, Item5
item_8 = ListItem(List=item, Index=0, Wrap=True)  # -> Item, Item1, Item2, Item3, Item4, Item5
merge = Merge(Data1=item_6.Item1, Data2=item_6.Item3, Data3=item_6.Item4)  # -> flatten(Result)
merge_2 = Merge(Data1=item_7.Item1, Data2=item_7.Item3, Data3=item_7.Item4)  # -> flatten(Result)
cullpt = CullDuplicates(Points=merge, Tolerance=0.001, CullMode=1)  # -> Points, Indices, Valence
item_9 = ListItem(List=merge_2, Index=cullpt.Indices, Wrap=True)

triangle = MeshTriangle(CornerA=item_8.Item, CornerB=item_8.Item2, CornerC=item_8.Item5)

conmesh = ConstructMesh(Vertices=node_locations, Faces=flatten(triangle))

tri6mem = _6NodeTriangleMembrane(
    Mesh=conmesh,
    MidNodes=cullpt.Points,
    DisplacmentsCorners=displacement_vectors_2,
    DisplacmentsMidNodes=item_9,
    PoissonsRatio="0.15")  # -> PrincipleDirection1, PrincipleDirection2; disabled
meshcp = MeshClosestPoint(Point=pt, Mesh=conmesh)  # -> Point, Index, Parameter

# ----
# Stress Lines
md_slider_2 = MDSlider(
    SliderMode=0,
    slider_value=Point(0.229776522, 0, 0.5),
    x_domain=Domain(0, 8),
    y_domain=Domain(0, 8),
    z_domain=Domain(0, 1))  # disabled
number_slider_3 = Slider(-4, range=-10..0)  # disabled
number_slider_4 = Slider(0.5, range=0..1)  # disabled
number_slider_5 = Slider(0.2, range=0..1)  # disabled
_10º = PowerOf10(Value=number_slider_3)  # disabled
panel_3 = Panel("1")  # disabled
panel_4 = Panel("0.05")  # disabled
sls = StressLines(
    PrincipalMesh=tri6mem.PrincipleDirection2,
    Seed=meshcp.Point,
    StepTolerance=number_slider_4,
    MaxError=_10º,
    SeedingMethod=panel_3,
    Seperation=number_slider_5,
    TestDist=panel_4)  # disabled
swatch_2 = ColourSwatch(SwatchColor=RGB(255, 143, 212))  # disabled
previewlw = CustomPreviewLineweights(Geometry=sls, Shader=swatch_2, Thickness=number_slider, Absolute=False)  # disabled

# ----
# Stress Line
md_slider_3 = MDSlider(
    SliderMode=0,
    slider_value=Point(0.8094214463, 0.5273817109, 0.5),
    x_domain=Domain(0, 8),
    y_domain=Domain(0, 8),
    z_domain=Domain(0, 1))
_10º_2 = PowerOf10(Value=Slider(-4, range=-10..0))
stress_line = StressLine(
    PrincipalMesh=tri6mem.PrincipleDirection2,
    Seed=meshcp.Point,
    StepTolerance=Slider(0.5, range=0..1),
    IntegrationMethod="4",
    MaxError=_10º_2)  # disabled

# ----
# Stress Lines
md_slider_4 = MDSlider(
    SliderMode=0,
    slider_value=Point(0.7115493402, 0.5547559785, 0.5),
    x_domain=Domain(0, 8),
    y_domain=Domain(0, 8),
    z_domain=Domain(0, 1))
_10º_3 = PowerOf10(Value=Slider(-6, range=-10..0))
sls_2 = StressLines(
    PrincipalMesh=tri6mem.PrincipleDirection1,
    Seed=meshcp.Point,
    StepTolerance=Slider(0.5, range=0..1),
    MaxError=_10º_3,
    SeedingMethod="1",
    Seperation=Slider(0.2, range=0..1),
    TestDist="0.05")
previewlw_2 = CustomPreviewLineweights(Geometry=sls_2, Shader=ColourSwatch(SwatchColor=RGB(82, 184, 59)), Thickness=number_slider, Absolute=False)

# ----
# Stress Line
md_slider_5 = MDSlider(
    SliderMode=0,
    slider_value=Point(0.8094214463, 0.5273817109, 0.5),
    x_domain=Domain(0, 8),
    y_domain=Domain(0, 8),
    z_domain=Domain(0, 1))
_10º_4 = PowerOf10(Value=Slider(-6, range=-10..0))
stress_line_2 = StressLine(
    PrincipalMesh=tri6mem.PrincipleDirection1,
    Seed=meshcp.Point,
    StepTolerance=Slider(0.1, range=0..1),
    IntegrationMethod="4",
    MaxError=_10º_4)

# ----
# Evaluation
eval = EvaluatePrincipalMesh(Principal=tri6mem.PrincipleDirection2, Location=meshcp.Point)
eval_2 = EvaluatePrincipalMesh(Principal=tri6mem.PrincipleDirection1, Location=meshcp.Point)
division = Division(A=eval_2, B="5")
division_2 = Division(A=eval, B="5")
vdisex = VectorDisplayEx(Point=meshcp.Point, Vector=division_2, Colour=ColourSwatch(SwatchColor=RGB(194, 0, 0)), Width=2)
vdisex_2 = VectorDisplayEx(Point=meshcp.Point, Vector=division, Colour=ColourSwatch(SwatchColor=RGB(0, 61, 194)), Width=2)

previewlw_3 = CustomPreviewLineweights(Geometry=stress_line_2, Shader=ColourSwatch(SwatchColor=RGB(82, 184, 59)), Thickness=number_slider_2, Absolute=False)
previewlw_4 = CustomPreviewLineweights(Geometry=stress_line, Shader=swatch, Thickness=number_slider_2, Absolute=False)  # disabled
