# Grasshopper definition LilyPad_Example-Spherical Shell-FromGSA.gh (Grasshopper 1.0.8)
# plug-ins: treesloth01, Human, GSA, LilyPad

# C:\Users\4Matt\Documents\GitHub\PrincipalStressLines\Example Files\Spherical Shell.gwb
panel = Panel("C:\Users\Matt C\Documents\GitHub\PrincipalStressLines\Example Files\Spherical Shell1.gwb")
open = OpenModel(FilenameAndPath=panel)
getanalysis = GetModelAnalysis(GSAModel=open)  # -> AnalysisTasks, AnalysisCases, CombinationCases, DesignTasks
panel_2 = Panel(getanalysis.AnalysisCases)
pt = Point([Point(2.855457724, -1.297935329, 3.893805987), Point(1.226278679, 1.532848349, 4.598545046), Point(-3.077287274, 2.46182982, 3.077287274), Point(1.842885351, 4.607213376, 0.6142951168), Point(1.703885503, 1.98786642, 4.259713757)])
Z = UnitZ(Factor="-1")
getgeo = GetModelGeometry(GSAModel=open, Mode=1, Unit="m")  # -> NodesIn_m, _1DElementsIn_m, _2DElementsIn_m, _3DElementsIn_m, _1DMembersIn_m, _2DMembersIn_m, _3DMembersIn_m, Assemblies
move = Move(Geometry=pt, Motion=expr("-x", Z))  # -> Geometry, Transform
getres = GetResult(GSAModel=open, T="A", Case=1)
vdis = VectorDisplay(Anchor=move.Geometry, Vector=Z)
nodedisp = NodeDisplacements(Result=getres, Max_Min="All", Unit="mm")  # -> TranslationsX_mm, TranslationsY_mm, TranslationsZ_mm, TranslationsXYZ_mm, RotationXX_rad, RotationYY_rad, RotationZZ_rad, RotationXYZ_rad, NodeIDs
nodeedit = EditNode(Node=getgeo.NodesIn_m, Mode=1)  # -> Node, NodeNumber, NodePosition, NodeLocalAxis, NodeRestraints, DamperProperty, MassProperty, SpringProperty, NodeName, NodeColour
elem2dedit = Edit2DElement(Element2D=getgeo._2DElementsIn_m, Preview3dSection=False)  # -> Element2D, Number, Geometry, _2DProperty, Group, ElementType, Offset, OrientationAngle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
num = Number(nodedisp.TranslationsX_mm)
num_2 = Number(nodedisp.TranslationsY_mm)
num_3 = Number(nodedisp.TranslationsZ_mm)
subtraction = Subtraction(A=elem2dedit.Topology, B=1)
vec = VectorXYZ(XComponent=num, YComponent=num_2, ZComponent=num_3)  # -> Vector, Length
int = Integer(nodeedit.NodeNumber)
int_2 = Integer(elem2dedit.Topology)
int_3 = Integer(subtraction)
mindex = MemberIndex(Set=int, Member=int_2)  # -> Index, Count
shift = ShiftPaths(Data=mindex.Index, Offset=-1)
panel_3 = Panel("""0
4
1
7
5
3
6
2""")
panel_4 = Panel("""2
6
3
5
7
1
4
0""")
panel_5 = Panel("""3
7
0
6
4
2
5
1""")

# ----
# FEA Data Import
displacement_vectors = Vector(vec.Vector)
element_node_ids = Number(simplify(shift))
node_locations = Point(nodeedit.NodePosition)

panel_7 = Panel("""1
4
0
5
7
2
6
3""")
item = ListItem(List=element_node_ids, Index=panel_7, Wrap=True)
tstat = TreeStatistics(Tree=item)  # -> Paths, Length, Count
item_2 = ListItem(List=tstat.Paths, Index=0, Wrap=True)

# ----
# Setup
item_3 = ListItem(List=node_locations, Index=item, Wrap=True)
item_4 = ListItem(List=displacement_vectors, Index=item, Wrap=True)
item_5 = ListItem(List=item_3, Index=0, Wrap=True)  # -> Item, Item1, Item2, Item3, Item4, Item5, Item6, Item7
item_6 = ListItem(List=item_4, Index=0, Wrap=True)  # -> Item, Item1, Item2, Item3, Item4, Item5, Item6, Item7
item_7 = ListItem(List=item, Index=0, Wrap=True)  # -> Item, Item1, Item2, Item3, Item4, Item5, Item6, Item7
merge = Merge(Data1=item_5.Item1, Data2=item_5.Item3, Data3=item_5.Item4, Data4=item_5.Item6)  # -> flatten(Result)
merge_2 = Merge(Data1=item_6.Item1, Data2=item_6.Item3, Data3=item_6.Item4, Data4=item_6.Item6)  # -> flatten(Result)
quad = MeshQuad(CornerA=item_7.Item, CornerB=item_7.Item2, CornerC=item_7.Item7, CornerD=item_7.Item5)
conmesh = ConstructMesh(Vertices=node_locations, Faces=flatten(quad))
cullpt = CullDuplicates(Points=merge, Tolerance=0.001, CullMode=1)  # -> Points, Indices, Valence
item_8 = ListItem(List=merge_2, Index=cullpt.Indices, Wrap=True)
quad8mem = _8NodeQuadMembrane(
    Mesh=conmesh,
    MidNodes=cullpt.Points,
    DisplacmentsCorners=displacement_vectors,
    DisplacmentsMidNodes=item_8,
    PoissonsRatio="0.15")  # -> PrincipleDirection1, PrincipleDirection2

split = SplitTree(Data=item, Masks=flatten(item_2))  # -> Positive, Negative
panel_8 = Panel(shift)
item_9 = ListItem(List=node_locations, Index=split.Positive, Wrap=True)
points = PointList(Points=item_9)
md_slider = MDSlider(
    SliderMode=0,
    slider_value=Point(0.8699854409, 0.5149678486, 0.5),
    x_domain=Domain(0, 1),
    y_domain=Domain(0.5, 1),
    z_domain=Domain(0, 1))
mcol = MeshColours(Mesh=conmesh, Colours=ColourSwatch(SwatchColor=RGB(214, 214, 214)))
md_slider_2 = MDSlider(
    SliderMode=0,
    slider_value=Point(0.5821019615, 0.8968056469, 0.5),
    x_domain=Domain(0, 1),
    y_domain=Domain(0.5, 1),
    z_domain=Domain(0, 1))
srf = Surface(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)
srf_2 = Surface(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)
evalsrf = EvaluateSurface(Surface=reparameterize(srf), Point=md_slider)  # -> Point, Normal, UDirection, VDirection, Frame
evalsrf_2 = EvaluateSurface(Surface=reparameterize(srf_2), Point=md_slider_2)  # -> Point, Normal, UDirection, VDirection, Frame
pt_2 = Point(evalsrf.Point)

# ----
# Stress Line
md_slider_3 = MDSlider(
    SliderMode=0,
    slider_value=Point(0.8094214463, 0.5273817109, 0.5),
    x_domain=Domain(0, 8),
    y_domain=Domain(0, 8),
    z_domain=Domain(0, 1))
_10º = PowerOf10(Value=Slider(-4, range=-10..0))
stress_line = StressLine(
    PrincipalMesh=quad8mem.PrincipleDirection2,
    Seed=evalsrf_2.Point,
    StepTolerance=Slider(0.02, range=0..1),
    IntegrationMethod="4",
    MaxError=_10º)
preview = CustomPreview(
    Geometry=stress_line,
    Material={diffuse=RGB(13, 201, 0), emission=RGB(4, 60, 0), shine=0.5, specular=RGB(255, 255, 255), transparency=0})

number_slider = Slider(0.2, range=0..1)
number_slider_2 = Slider(0.05, range=0..0.1)

# ----
# Evaluation
eval = EvaluatePrincipalMesh(Principal=quad8mem.PrincipleDirection2, Location=evalsrf_2.Point)
# Results
eval_2 = EvaluatePrincipalMesh(Principal=quad8mem.PrincipleDirection1, Location=evalsrf_2.Point)
vdis_2 = VectorDisplay(Anchor=evalsrf_2.Point, Vector=eval_2)
vdis_3 = VectorDisplay(Anchor=evalsrf_2.Point, Vector=eval)

# ----
# Stress Line
md_slider_4 = MDSlider(
    SliderMode=0,
    slider_value=Point(0.8094214463, 0.5273817109, 0.5),
    x_domain=Domain(0, 8),
    y_domain=Domain(0, 8),
    z_domain=Domain(0, 1))
_10º_2 = PowerOf10(Value=Slider(-10, range=-10..0))
stress_line_2 = StressLine(
    PrincipalMesh=quad8mem.PrincipleDirection1,
    Seed=evalsrf.Point,
    StepTolerance="0.2",
    IntegrationMethod="4",
    MaxError=_10º_2)
preview_2 = CustomPreview(
    Geometry=stress_line_2,
    Material={diffuse=RGB(13, 201, 0), emission=RGB(4, 60, 0), shine=0.5, specular=RGB(255, 255, 255), transparency=0})

_10º_3 = PowerOf10(Value=Slider(-8, range=-10..0))
number_slider_3 = Slider(5, range=1..5)

# ----
# Stress Lines
md_slider_5 = MDSlider(
    SliderMode=0,
    slider_value=Point(0.7115493402, 0.5547559785, 0.5),
    x_domain=Domain(0, 8),
    y_domain=Domain(0, 8),
    z_domain=Domain(0, 1))
number_slider_4 = Slider(0.05, range=0..1)
sls = StressLines(
    PrincipalMesh=quad8mem.PrincipleDirection1,
    Seed=evalsrf_2.Point,
    StepTolerance=number_slider_4,
    MaxError=_10º_3,
    SeedingMethod="1",
    Seperation=number_slider,
    TestDist=number_slider_2)
previewlw = CustomPreviewLineweights(Geometry=sls, Shader=ColourSwatch(SwatchColor=RGB(82, 184, 59)), Thickness=number_slider_3, Absolute=False)

# ----
# Stress Lines
md_slider_6 = MDSlider(
    SliderMode=0,
    slider_value=Point(0.229776522, 0, 0.5),
    x_domain=Domain(0, 8),
    y_domain=Domain(0, 8),
    z_domain=Domain(0, 1))
panel_9 = Panel("0.05")
sls_2 = StressLines(
    PrincipalMesh=quad8mem.PrincipleDirection2,
    Seed=evalsrf_2.Point,
    StepTolerance=number_slider_4,
    MaxError=_10º_3,
    SeedingMethod="1",
    Seperation=number_slider,
    TestDist=number_slider_2)
previewlw_2 = CustomPreviewLineweights(Geometry=sls_2, Shader=ColourSwatch(SwatchColor=RGB(255, 143, 212)), Thickness=number_slider_3, Absolute=False)

crv_cp = CurveClosestPoint(Point=pt_2, Curve=stress_line_2)  # -> Point, Parameter, Distance
shatter = Shatter(Curve=stress_line_2, Parameters=crv_cp.Parameter)
item_10 = ListItem(List=shatter, Index=0, Wrap=True)  # -> Item, reverse(Item1)
number_slider_5 = Slider(148, range=0..1000)
explode = Explode(Curve=item_10.Item1, Recursive=True)  # -> Segments, Vertices
item_11 = ListItem(List=explode.Vertices, Index=0, Wrap=True)
item_12 = ListItem(List=explode.Vertices, Index=number_slider_5, Wrap=True)
partition = PartitionList(List=explode.Segments, Size=number_slider_5)
dist = Distance(PointA=item_11, PointB=item_12)
bang = ExplodeTree(Data=partition)  # -> _00000, Branch1
panel_10 = Panel(dist)
data = Data(bang._00000)
