# Grasshopper definition TriangleNetTesting.gh (Grasshopper 1.0.8)

c_script = CSharpScript()  # -> out, a
# ---------- c_script: C# ----------
// Grasshopper Script Instance
#region Usings
using System;
#r "C:\Users\4Matt\Documents\GitHub\Triangle.NET\src\Triangle\bin\Release\netstandard2.0\Triangle.dll"
#r "C:\Users\4Matt\Documents\GitHub\Triangle.NET\src\Triangle.Rendering\bin\Release\netstandard2.0\Triangle.Rendering.dll"
using System.Linq;
using System.Collections;
using System.Collections.Generic;
using System.Drawing;

using Rhino;
using Rhino.Geometry;

using Grasshopper;
using Grasshopper.Kernel;
using Grasshopper.Kernel.Data;
using Grasshopper.Kernel.Types;

using TriangleNet.Geometry;
using TriangleNet.Meshing.Algorithm;
using TriangleNet.Rendering.Text;


#endregion

public class Script_Instance : GH_ScriptInstance
{
    #region Notes
    /* 
      Members:
        RhinoDoc RhinoDocument
        GH_Document GrasshopperDocument
        IGH_Component Component
        int Iteration

      Methods (Virtual & overridable):
        Print(string text)
        Print(string format, params object[] args)
        Reflect(object obj)
        Reflect(object obj, string method_name)
    */
    #endregion

    private void RunScript(object x, object y, ref object a)
    {

        // Generate points.
        var points = Generate.RandomPoints(50, new TriangleNet.Geometry.Rectangle(0, 0, 50, 100));

        // Choose triangulator: Incremental, SweepLine or Dwyer.
        var triangulator = new Dwyer();

        // Generate mesh.
        var mesh = triangulator.Triangulate(points, new TriangleNet.Configuration());

        SvgImage.Save(mesh, "C:/Users/4Matt/Downloads/example-1.svg", 500);


    }

     static class Generate
    {
        public static List<Vertex> RandomPoints(int n, TriangleNet.Geometry.Rectangle bounds)
        {
            var points = new List<Vertex>(n);

            var xmin = bounds.Left;
            var ymin = bounds.Bottom;

            var width = bounds.Width;
            var height = bounds.Height;

            var random = Random.Shared;

            for (int i = 0; i < n; i++)
            {
                double x = random.NextDouble();
                double y = random.NextDouble();
                points.Add(new Vertex(xmin + x * width, ymin + y * height));
            }

            return points;
        }
    }
}
# ---------- end c_script ----------
